# Dynamo graph Pipeline.dyn (Dynamo 2.8.0.2471)

# group: Geometry Name+ Index
geometry_index = CodeBlock()
# ---------- geometry_index.designscript (5 lines) ----------
// length of indexes
1;
// index type
"EN";
"NUM";
# ----------------------------------------
geometry_names = CodeBlock()
# ---------- geometry_names.designscript (16 lines) ----------
// Geometry Types
"POINT";
"MULTIPOINT";
"LINESTRING";
"LINEARRING";
"MULTILINESTRING";
"POLYGON";
"MULTIPOLYGON";
"GEOMETRYCOLLECTION";
// Geometry List
["POINT","MULTIPOINT"];
"POLYGON1";
"POLYGON2";
"LINE1";
"LINE2";
"POINT1";
# ----------------------------------------

polygon1_name = Python()  # CPython3; unwired: IN[0], IN[1], IN[2]
# ---------- polygon1_name.python (40 lines) ----------
# Load the Python Standard and DesignScript Libraries
import sys
import clr
clr.AddReference('ProtoGeometry')
from Autodesk.DesignScript.Geometry import *

# The inputs to this node will be stored as a list in the IN variables.
#dataEnteringNode = IN
INDEX_EN = ['A','B','C','D'];
INDEX_NUM = ['1','2','3','4'];
INDEX = [];

if IN[2] == "EN":
    INDEX = INDEX_EN
if IN[2] == "NUM":
    INDEX = INDEX_NUM
"""
# Place your code below this line
def name_concatenation(geo_name:str, geo_number:int, index = INDEX):
    if geo_number > len(index):
        raise ValueError("No more indexes available!")
 
    geo_concat = [geo_name + index[i] for i in range(geo_number)]
    return geo_concat

def name_lst_concatenation(geo_name_lst:list, geo_number:int, index = INDEX):
    if geo_number > len(index):
        raise ValueError("No more indexes available!")
    
    geo_concat = [[geo_name + index[i] for i in range(geo_number)] for geo_name in geo_name_lst]
    return geo_concat


# Assign your output to the OUT variable.
if isinstance(IN[0], str):
    OUT = name_concatenation(IN[0], IN[1])
else:
    OUT = name_lst_concatenation(IN[0], IN[1])
"""
OUT = ""
# ----------------------------------------

# group: Coordinates
points = CodeBlock()
# ---------- points.designscript (10 lines) ----------
p1 = Point.ByCoordinates(2.5,3);
p2 = Point.ByCoordinates(5,0);
// Line1
line1S = Point.ByCoordinates(2.5,0,1);
line1E = Point.ByCoordinates(2.5,6,2);
line1 = [line1S, line2E];
// Line2
line2S = Point.ByCoordinates(0,4,1);
line2E = Point.ByCoordinates(4,4,2);
line2 = [line2S, line2E];
# ----------------------------------------
polygonCoordList1 = CodeBlock()
# ---------- polygonCoordList1.designscript (6 lines) ----------
p1 = Point.ByCoordinates(2,-1,0);
p2 = Point.ByCoordinates(2,1,0);
p3 = Point.ByCoordinates(0,1,0);
p4 = Point.ByCoordinates(0,-1,0);
//p5 = Point.ByCoordinates(2,-1,0);
p = [p1,p2,p3,p4];
# ----------------------------------------
polygonCoordList2 = CodeBlock()
# ---------- polygonCoordList2.designscript (6 lines) ----------
p1 = Point.ByCoordinates(4,0,0);
p2 = Point.ByCoordinates(4,4,0);
p3 = Point.ByCoordinates(0,4,0);
p4 = Point.ByCoordinates(0,0,0);
p5 = Point.ByCoordinates(4,0,0);
p = [p1,p2,p3,p4];
# ----------------------------------------

# group: Geometry Generator
geometry_object_point1 = CodeBlock(geo_data=points.p1, geo_name=geometry_names.out13, geo_type=geometry_names.out0) { geo_obj = [geo_data, geo_name, geo_type, geometry]; geo_obj[0]; geo_obj[1]; geo_obj[2]; geo_obj[3]; }  # unwired: geometry
line1 = Line.ByStartPointEndPoint(startPoint=points.line1S, endPoint=points.line1E)
geometry_object_line1 = CodeBlock(geo_data=points.line1, geo_name=geometry_names.out11, geo_type=geometry_names.out2, geometry=line1) { geo_obj = [geo_data, geo_name, geo_type, geometry]; geo_obj[0]; geo_obj[1]; geo_obj[2]; geo_obj[3]; }
line2 = Line.ByStartPointEndPoint(startPoint=points.line2S, endPoint=points.line2E)
geometry_object_line2 = CodeBlock(geo_data=points.line2, geo_name=geometry_names.out12, geo_type=geometry_names.out2, geometry=line2) { geo_obj = [geo_data, geo_name, geo_type, geometry]; geo_obj[0]; geo_obj[1]; geo_obj[2]; geo_obj[3]; }
byPerimeterPoints = Surface.ByPerimeterPoints(points=polygonCoordList1.p)
geometry_object_polygon1 = CodeBlock(geo_data=polygonCoordList1.p, geo_name=geometry_names.out9, geo_type=geometry_names.out5, geometry=byPerimeterPoints) { geo_obj = [geo_data, geo_name, geo_type, geometry]; geo_obj[0]; geo_obj[1]; geo_obj[2]; geo_obj[3]; }
byPerimeterPoints_2 = Surface.ByPerimeterPoints(points=polygonCoordList2.p)
geometry_object_polygon2 = CodeBlock(geo_data=polygonCoordList2.p, geo_name=geometry_names.out9, geo_type=geometry_names.out5, geometry=byPerimeterPoints_2) { geo_obj = [geo_data, geo_name, geo_type, geometry]; geo_obj[0]; geo_obj[1]; geo_obj[2]; geo_obj[3]; }

# group: XML(query result) Import and Parsing
on_off = CodeBlock { on = "True"; off = "False"; }
file_path = Filename("..\Workspace\ExtendingJena\target\classes\rdf\query_result.xml")
fileExists = FileSystem.FileExists(path=file_path)
file_from_path = FileObject(path=file_path)
python_script = Python(IN[0]=fileExists, IN[1]=file_from_path)  # CPython3
# ---------- python_script.python (86 lines) ----------
# Load the Python Standard and DesignScript Libraries
import sys
import clr
import ctypes
import xml.etree.ElementTree as ET
sys.path.append(r"C:\Users\nobita_yhe\AppData\Local\Programs\Python\Python310\Lib\site-packages")

clr.AddReference('ProtoGeometry')
from Autodesk.DesignScript.Geometry import *
from xml.dom.minidom import parse, parseString

dir = "r'C:\\Users\\nobita_yhe\\Workspace\\ExtendingJena\\src\\main\\resources\\rdf\\query_result.xml'"
#dir = r'C:\Users\nobita_yhe\Workspace\ExtendingJena\src\main\resources\rdf\query_result.xml'
warn_str = 'File or File Path does not exist.'
res = ''

def xmlParsing2Uri(path=dir):
    """ it returns the list in structure like [[uri1, uri2],...,[uri1, uri2]]"""
    dom = parse(path)
    data = dom.documentElement
    resList = data.getElementsByTagName('result')
    
    res_lst = []
    for res in resList: # handle the <result>...</result>
        ur_lst = []
        for bi in res.getElementsByTagName('binding'): # handle the <binding>...</binding>
            for ur in bi.getElementsByTagName('uri'):
                ur_lst.append(ur.childNodes[0].nodeValue)
        res_lst.append(ur_lst)
        ur_lst = []
    return res_lst


def xml2GeometryString(path=dir):
    """ it returns the list in structure like [[Geomety1, Geomety2],...,[Geomety1, Geomety2]]"""
    dom = parse(path)
    data = dom.documentElement
    resList = data.getElementsByTagName('result')
    seperator = '#'

    res_lst = []
    for res in resList: # handle the <result>...</result>
        ur_lst = []
        for bi in res.getElementsByTagName('binding'): # handle the <binding>...</binding>
            for ur in bi.getElementsByTagName('uri'):
                uri_str = ur.childNodes[0].nodeValue
                geo_index = uri_str.find(seperator) 
                geo_str = uri_str[geo_index+1:]
                ur_lst.append(geo_str)
        res_lst.append(ur_lst)
        ur_lst = []
    return res_lst

def xml2GeoInDynamo(path=dir):
    with open(r'C:\Users\nobita_yhe\Workspace\ExtendingJena\src\main\resources\rdf\query_result.xml', 'r', encoding='utf-8') as file:
        xml_data = file.read()
        dom = parseString(xml_data)
        #dom = parse(xml_data)
        data = dom.documentElement
        resList = data.getElementsByTagName('result')
        seperator = '#'
        
        res_lst = []
        for res in resList: # handle the <result>...</result>
            ur_lst = []
            for bi in res.getElementsByTagName('binding'): # handle the <binding>...</binding>
                for ur in bi.getElementsByTagName('uri'):
                    uri_str = ur.childNodes[0].nodeValue
                    geo_index = uri_str.find(seperator) 
                    geo_str = uri_str[geo_index+1:]
                    ur_lst.append(geo_str)
            res_lst.append(ur_lst)
            ur_lst = []
    return res_lst
    
   

if IN[0] == True:
	dir = IN[1]
	res = xml2GeoInDynamo(dir)
else:
	ctypes.windll.user32.MessageBoxW(0, warn_str, 'Input Exception',1)
	res = warn_str
	
# Assign your output to the OUT variable.
OUT = res
# ----------------------------------------
switcher = CodeBlock(SW=on_off.on, data=python_script) { SW == "True"? data : null; }
query_result_viewer = Watch(switcher)

# group: Geometry Highlighter
if_inlist = Python(IN[0]=query_result_viewer, IN[1]=geometry_object_point1.out2)  # CPython3
# ---------- if_inlist.python (49 lines) ----------
# Load the Python Standard and DesignScript Libraries
import sys
import clr
clr.AddReference('ProtoGeometry')
from Autodesk.DesignScript.Geometry import *

# The inputs to this node will be stored as a list in the IN variables.
#dataEnteringNode = IN

def flatten(inp_lst):
# Core: 
#		1. traverse the input list 
#		2. concatenate each two adjacent elements 
#		3. store the concatenation into the output list
#		4. remove the non-list element out of the input list
    out_lst = []
    while True:
        if inp_lst == []:
            break
        for ind, val in enumerate(inp_lst):
            if type(val) == list:
                inp_lst = val + inp_lst[ind+1:]
                break
            else:
                out_lst.append(val)
                inp_lst.pop(ind)
                break
    return out_lst

def inList(res_lst, geo):
    flat_lst = flatten(res_lst)
    res = False
    
    for e in flat_lst:
        if e is None:
            break
        if geo.upper() == e.upper():
            res = True
            break
    return res
	#return geo.upper() == e.upper() for e in flat_lst
    #if geo in flat_lst:
    #    return True
    #return False
	
# Assign your output to the OUT variable.
res_lst = IN[0]
geo_name = IN[1]
OUT = inList(res_lst, geo_name)
# ----------------------------------------
color_palette = ColorPalette({R: 255, G: 0, B: 255, A: 255})
geometry_highlighter = Python(IN[0]=geometry_object_point1.out1, IN[1]=if_inlist, IN[2]=color_palette)  # CPython3
# ---------- geometry_highlighter.python (22 lines) ----------
# Load the Python Standard and DesignScript Libraries
import sys
import clr
clr.AddReference('ProtoGeometry')
from Autodesk.DesignScript.Geometry import *
clr.AddReference('DSCoreNodes')
from DSCore import *
clr.AddReference('GeometryColor')
from Modifiers import GeometryColor

#cBoid = Cuboid.ByLengths(2,2,2)
color = Color.ByARGB(255,255,0,0) # red

geom = IN[0]
inList = IN[1]
color = IN[2]
o = ''

if inList:
    o = GeometryColor.ByGeometryColor(geom, color)
    
OUT = o
# ----------------------------------------
if_inlist_2 = Python(IN[0]=query_result_viewer, IN[1]=geometry_object_line1.out2)  # CPython3; same code as if_inlist
geometry_highlighter_2 = Python(IN[0]=geometry_object_line1.out4, IN[1]=if_inlist_2, IN[2]=color_palette)  # CPython3; same code as geometry_highlighter
if_inlist_3 = Python(IN[0]=query_result_viewer, IN[1]=geometry_object_line2.out2)  # CPython3; same code as if_inlist
geometry_highlighter_3 = Python(IN[0]=geometry_object_line2.out4, IN[1]=if_inlist_3, IN[2]=color_palette)  # CPython3
# ---------- geometry_highlighter_3.python (24 lines) ----------
# Load the Python Standard and DesignScript Libraries
import sys
import clr
clr.AddReference('ProtoGeometry')
from Autodesk.DesignScript.Geometry import *
clr.AddReference('DSCoreNodes')
from DSCore import *
clr.AddReference('GeometryColor')
from Modifiers import GeometryColor

#cBoid = Cuboid.ByLengths(2,2,2)
color = Color.ByARGB(255,255,0,0) # red

geom = IN[0]
inList = IN[1]
color = IN[2]
o = ''

if inList:
    o = GeometryColor.ByGeometryColor(geom, color)
#else:
#    o = geom
    
OUT = o
# ----------------------------------------
geometry_highlighter_4 = Python(IN[0]=geometry_object_polygon1.out4, IN[1]=if_inlist, IN[2]=color_palette)  # CPython3; same code as geometry_highlighter
geometry_highlighter_5 = Python(IN[0]=geometry_object_polygon2.out4, IN[1]=if_inlist, IN[2]=color_palette)  # CPython3; same code as geometry_highlighter
geo_list = List.Create(item0=geometry_highlighter, item1=geometry_highlighter_2, item2=geometry_highlighter_3, item3=geometry_highlighter_4, item4=geometry_highlighter_5)
if_inlist_4 = Python(IN[0]=query_result_viewer, IN[1]=geometry_object_polygon1.out2)  # CPython3; same code as if_inlist
if_inlist_5 = Python(IN[0]=query_result_viewer, IN[1]=geometry_object_polygon2.out2)  # CPython3; same code as if_inlist

list_viewer = Watch(geo_list)
watch_3d = Watch3D(list_viewer)

# group: WKT Generator
rdf_prefixes = CodeBlock()
# ---------- rdf_prefixes.designscript (27 lines) ----------
rdf="http://www.w3.org/1999/02/22-rdf-syntax-ns#";
owl="http://www.w3.org/2002/07/owl#";
ogc="http://www.opengis.net/";
my="https://www.inf.bi.ruhr-uni-bochum.de/jena/#";
gml="http://www.opengis.net/ont/gml#";
geo="http://www.opengis.net/ont/geosparql#";
geof="http://www.opengis.net/def/function/geosparql/";
rdfs="http://www.w3.org/2000/01/rdf-schema#";
uom="http://www.opengis.net/def/uom/OGC/1.0/";
sf="http://www.opengis.net/ont/sf#";
xsd="http://www.w3.org/2001/XMLSchema#";
geor="http://www.opengis.net/def/rule/geosparql/";

namespaces = {
	"rdf" : rdf,
	"owl" : owl,
	"ogc" : ogc,
	"my" : my,
	"gml" : gml,
	"geo" : geo,
	"geof": geof,
	"rdfs": rdfs,
	"uom": uom,
	"sf": sf,
	"xsd": xsd,
	"geor": geor
};
# ----------------------------------------
wkt_converter_python_script = Python(IN[0]=geometry_object_line1.out1, IN[1]=geometry_object_line1.out2, IN[2]=geometry_object_line1.out3, IN[3]=rdf_prefixes.my, IN[4]=rdf_prefixes.geo)  # CPython3
# ---------- wkt_converter_python_script.python (97 lines) ----------
# Phython-Standard- und DesignScript-Bibliotheken laden
import sys
import clr
clr.AddReference('ProtoGeometry')
from Autodesk.DesignScript.Geometry import *

# Die Eingaben für diesen Block werden in Form einer Liste in den IN-Variablen gespeichert.
dataEnteringNode = IN

geometry = dataEnteringNode[0];
name = dataEnteringNode[1];
if isinstance(dataEnteringNode[1], list):
    name = dataEnteringNode[1][0]
geometryType = dataEnteringNode[2];
exampleInstanceNamespace = dataEnteringNode[3];
geoSparqlNamespace = dataEnteringNode[4];

# Code unterhalb dieser Linie platzieren

def multipolygon2WKT():
    wktLiteral = "<sf:MultiPolygon>";
    wktLiteral += "<rdf:Description rdf:about='" + exampleInstanceNamespace + str(name) + "'>";
    wktLiteral += "<geo:asWKT rdf:datatype='" + geoSparqlNamespace + "wktLiteral'>";
      
    try:
        curves = Surface.PerimeterCurves(geometry);
    except:
        raise Exception("something wrong at geometry import!")
    wktLiteral += "MULTIPOLYGON Z(((";
    startP = None;
    for curve in curves:
        nextP = curve.StartPoint;
        if(startP != None):
            wktLiteral += ", ";
        else:
            startP = nextP;
        wktLiteral += str(nextP.X) + " " +  str(nextP.Y) + " " +  str(nextP.Z);
        
    #Close the tiangle loop with a repeat of the first Point
    wktLiteral += ", " + str(startP.X) + " " +  str(startP.Y) + " " +  str(startP.Z);
    wktLiteral += ")))"
    
    wktLiteral += "</geo:asWKT>";
    wktLiteral += "</rdf:Description>";
    wktLiteral += "</sf:MultiPolygon>";
    return wktLiteral
    
def polygon2WKT():
    wktLiteral = "<sf:POLYGON>";
    wktLiteral += "<rdf:Description rdf:about='" + exampleInstanceNamespace + str(name) + "'>";
    wktLiteral += "<geo:asWKT rdf:datatype='" + geoSparqlNamespace + "wktLiteral'>";
    wktLiteral += "POLYGON Z((";
    
    points =  geometry
    originP = points[0];
    
    wktLiteral += str(originP.X) + " " +  str(originP.Y) + " " +  str(originP.Z) # start point
    for i in range(1, len(points)):
        wktLiteral += ", " + str(points[i].X) + " " +  str(points[i].Y) + " " +  str(points[i].Z);       
    wktLiteral += ", " + str(originP.X) + " " +  str(originP.Y) + " " +  str(originP.Z); # end point
    wktLiteral += "))"
    
    wktLiteral += "</geo:asWKT>";
    wktLiteral += "</rdf:Description>";
    wktLiteral += "</sf:POLYGON>";
    return wktLiteral

def linestring2WKT():
    wktLiteral = "<sf:LINESTRING>";
    wktLiteral += "<rdf:Description rdf:about='" + exampleInstanceNamespace + str(name) + "'>";
    wktLiteral += "<geo:asWKT rdf:datatype='" + geoSparqlNamespace + "wktLiteral'>";
    wktLiteral += "LINESTRING Z(";
    
    originP = geometry[0];
    endP = geometry[1]
    
    wktLiteral += str(originP.X) + " " +  str(originP.Y) + " " +  str(originP.Z) # start point
    wktLiteral += ", " + str(endP.X) + " " +  str(endP.Y) + " " +  str(endP.Z); # end point
    wktLiteral += ")"
    
    wktLiteral += "</geo:asWKT>";
    wktLiteral += "</rdf:Description>";
    wktLiteral += "</sf:LINESTRING>";
    return wktLiteral

res = ""
# Weisen Sie Ihre Ausgabe der OUT-Variablen zu.
if(geometryType.upper() == "MULTIPOLYGON"):
    res = multipolygon2WKT()
    
if(geometryType.upper() == "POLYGON"):
    res = polygon2WKT()
    
if(geometryType.upper() == "LINESTRING"):
    res = linestring2WKT()

OUT = res
# ----------------------------------------
wkt_converter_python_script_2 = Python(IN[0]=geometry_object_line2.out1, IN[1]=geometry_object_line2.out2, IN[2]=geometry_object_line2.out3, IN[3]=rdf_prefixes.my, IN[4]=rdf_prefixes.geo)  # CPython3; same code as wkt_converter_python_script
wkt_converter_python_script_3 = Python(IN[0]=geometry_object_polygon1.out1, IN[1]=geometry_object_polygon1.out2, IN[2]=geometry_object_polygon1.out3, IN[3]=rdf_prefixes.my, IN[4]=rdf_prefixes.geo)  # CPython3
# ---------- wkt_converter_python_script_3.python (76 lines) ----------
# Phython-Standard- und DesignScript-Bibliotheken laden
import sys
import clr
clr.AddReference('ProtoGeometry')
from Autodesk.DesignScript.Geometry import *

# Die Eingaben für diesen Block werden in Form einer Liste in den IN-Variablen gespeichert.
dataEnteringNode = IN

geometry = dataEnteringNode[0];
name = dataEnteringNode[1];
if isinstance(dataEnteringNode[1], list):
    name = dataEnteringNode[1][0]
geometryType = dataEnteringNode[2];
exampleInstanceNamespace = dataEnteringNode[3];
geoSparqlNamespace = dataEnteringNode[4];

# Code unterhalb dieser Linie platzieren

def multipolygon2WKT():
    wktLiteral = "<sf:MultiPolygon>";
    wktLiteral += "<rdf:Description rdf:about='" + exampleInstanceNamespace + str(name) + "'>";
    wktLiteral += "<geo:asWKT rdf:datatype='" + geoSparqlNamespace + "wktLiteral'>";
      
    try:
        curves = Surface.PerimeterCurves(geometry);
    except:
        raise Exception("something wrong at geometry import!")
    wktLiteral += "MULTIPOLYGON Z(((";
    startP = None;
    for curve in curves:
        nextP = curve.StartPoint;
        if(startP != None):
            wktLiteral += ", ";
        else:
            startP = nextP;
        wktLiteral += str(nextP.X) + " " +  str(nextP.Y) + " " +  str(nextP.Z);
        
    #Close the tiangle loop with a repeat of the first Point
    wktLiteral += ", " + str(startP.X) + " " +  str(startP.Y) + " " +  str(startP.Z);
    wktLiteral += ")))"
    
    wktLiteral += "</geo:asWKT>";
    wktLiteral += "</rdf:Description>";
    wktLiteral += "</sf:MultiPolygon>";
    return wktLiteral
    
def polygon2WKT():
    wktLiteral = "<sf:POLYGON>";
    wktLiteral += "<rdf:Description rdf:about='" + exampleInstanceNamespace + str(name) + "'>";
    wktLiteral += "<geo:asWKT rdf:datatype='" + geoSparqlNamespace + "wktLiteral'>";
    wktLiteral += "POLYGON Z((";
    
    points =  geometry
    originP = points[0];
    
    wktLiteral += str(originP.X) + " " +  str(originP.Y) + " " +  str(originP.Z) # start point
    for i in range(1, len(points)):
        wktLiteral += ", " + str(points[i].X) + " " +  str(points[i].Y) + " " +  str(points[i].Z);       
    wktLiteral += ", " + str(originP.X) + " " +  str(originP.Y) + " " +  str(originP.Z); # end point
    wktLiteral += "))"
    
    wktLiteral += "</geo:asWKT>";
    wktLiteral += "</rdf:Description>";
    wktLiteral += "</sf:POLYGON>";
    return wktLiteral

res = ""
# Weisen Sie Ihre Ausgabe der OUT-Variablen zu.
if(geometryType.upper() == "MULTIPOLYGON"):
    res = multipolygon2WKT()
    
if(geometryType.upper() == "POLYGON"):
    res = polygon2WKT()

OUT = res
# ----------------------------------------
wkt_converter_python_script_4 = Python(IN[0]=geometry_object_polygon2.out1, IN[1]=geometry_object_polygon2.out2, IN[2]=geometry_object_polygon2.out3, IN[3]=rdf_prefixes.my, IN[4]=rdf_prefixes.geo)  # CPython3; same code as wkt_converter_python_script_3
wkt_converter_python_script_5 = Python(IN[0]=geometry_object_point1.out1, IN[1]=geometry_object_point1.out2, IN[2]=geometry_object_point1.out3, IN[3]=rdf_prefixes.my, IN[4]=rdf_prefixes.geo)  # CPython3
# ---------- wkt_converter_python_script_5.python (115 lines) ----------
# Phython-Standard- und DesignScript-Bibliotheken laden
import sys
import clr
clr.AddReference('ProtoGeometry')
from Autodesk.DesignScript.Geometry import *

# Die Eingaben für diesen Block werden in Form einer Liste in den IN-Variablen gespeichert.
dataEnteringNode = IN

geometry = dataEnteringNode[0];
name = dataEnteringNode[1];
if isinstance(dataEnteringNode[1], list):
    name = dataEnteringNode[1][0]
geometryType = dataEnteringNode[2];
exampleInstanceNamespace = dataEnteringNode[3];
geoSparqlNamespace = dataEnteringNode[4];

# Code unterhalb dieser Linie platzieren

def multipolygon2WKT():
    wktLiteral = "<sf:MultiPolygon>";
    wktLiteral += "<rdf:Description rdf:about='" + exampleInstanceNamespace + str(name) + "'>";
    wktLiteral += "<geo:asWKT rdf:datatype='" + geoSparqlNamespace + "wktLiteral'>";
      
    try:
        curves = Surface.PerimeterCurves(geometry);
    except:
        raise Exception("something wrong at geometry import!")
    wktLiteral += "MULTIPOLYGON Z(((";
    startP = None;
    for curve in curves:
        nextP = curve.StartPoint;
        if(startP != None):
            wktLiteral += ", ";
        else:
            startP = nextP;
        wktLiteral += str(nextP.X) + " " +  str(nextP.Y) + " " +  str(nextP.Z);
        
    #Close the tiangle loop with a repeat of the first Point
    wktLiteral += ", " + str(startP.X) + " " +  str(startP.Y) + " " +  str(startP.Z);
    wktLiteral += ")))"
    
    wktLiteral += "</geo:asWKT>";
    wktLiteral += "</rdf:Description>";
    wktLiteral += "</sf:MultiPolygon>";
    return wktLiteral
    
def polygon2WKT():
    wktLiteral = "<sf:POLYGON>";
    wktLiteral += "<rdf:Description rdf:about='" + exampleInstanceNamespace + str(name) + "'>";
    wktLiteral += "<geo:asWKT rdf:datatype='" + geoSparqlNamespace + "wktLiteral'>";
    wktLiteral += "POLYGON Z((";
    
    points =  geometry
    originP = points[0];
    
    wktLiteral += str(originP.X) + " " +  str(originP.Y) + " " +  str(originP.Z) # start point
    for i in range(1, len(points)):
        wktLiteral += ", " + str(points[i].X) + " " +  str(points[i].Y) + " " +  str(points[i].Z);       
    wktLiteral += ", " + str(originP.X) + " " +  str(originP.Y) + " " +  str(originP.Z); # end point
    wktLiteral += "))"
    
    wktLiteral += "</geo:asWKT>";
    wktLiteral += "</rdf:Description>";
    wktLiteral += "</sf:POLYGON>";
    return wktLiteral

def linestring2WKT():
    wktLiteral = "<sf:LINESTRING>";
    wktLiteral += "<rdf:Description rdf:about='" + exampleInstanceNamespace + str(name) + "'>";
    wktLiteral += "<geo:asWKT rdf:datatype='" + geoSparqlNamespace + "wktLiteral'>";
    wktLiteral += "LINESTRING Z(";
    
    originP = geometry[0];
    endP = geometry[1]
    
    wktLiteral += str(originP.X) + " " +  str(originP.Y) + " " +  str(originP.Z) # start point
    wktLiteral += ", " + str(endP.X) + " " +  str(endP.Y) + " " +  str(endP.Z); # end point
    wktLiteral += ")"
    
    wktLiteral += "</geo:asWKT>";
    wktLiteral += "</rdf:Description>";
    wktLiteral += "</sf:LINESTRING>";
    return wktLiteral

def point2WKT():
    wktLiteral = "<sf:POINT>";
    wktLiteral += "<rdf:Description rdf:about='" + exampleInstanceNamespace + str(name) + "'>";
    wktLiteral += "<geo:asWKT rdf:datatype='" + geoSparqlNamespace + "wktLiteral'>";
    wktLiteral += "POINT (";
  
    wktLiteral += str(geometry.X) + " " +  str(geometry.Y) + " " +  str(geometry.Z)

    wktLiteral += ")"
    
    wktLiteral += "</geo:asWKT>";
    wktLiteral += "</rdf:Description>";
    wktLiteral += "</sf:POINT>";
    return wktLiteral

res = ""
# Weisen Sie Ihre Ausgabe der OUT-Variablen zu.
if(geometryType.upper() == "MULTIPOLYGON"):
    res = multipolygon2WKT()
    
if(geometryType.upper() == "POLYGON"):
    res = polygon2WKT()
    
if(geometryType.upper() == "LINESTRING"):
    res = linestring2WKT()

if(geometryType.upper() == "POINT"):
    res = point2WKT()

OUT = res
# ----------------------------------------
code_block = CodeBlock(a=wkt_converter_python_script, b=wkt_converter_python_script_2, c=wkt_converter_python_script_3, d=wkt_converter_python_script_4, e=wkt_converter_python_script_5) { inserts = [a, b, c, d, e]; }
rdf_wrapper_python_script = Python(IN[0]=rdf_prefixes.namespaces, IN[1]=code_block)  # CPython3
# ---------- rdf_wrapper_python_script.python (35 lines) ----------
# Phython-Standard- und DesignScript-Bibliotheken laden
import sys
import clr
clr.AddReference('ProtoGeometry')
from Autodesk.DesignScript.Geometry import *

# Die Eingaben für diesen Block werden in Form einer Liste in den IN-Variablen gespeichert.
dataEnteringNode = IN

namespaces = dataEnteringNode[0]
inserts = dataEnteringNode[1]

# open RDF header
rdfStr = "<rdf:RDF";

# handle Namespaces
for key in namespaces:
    rdfStr += " xmlns:" + key + "='" + namespaces[key] + "'";

rdfStr += ">";

#add inserts

rdfStr += "<rdf:Description rdf:about='my:" + "RootModel" + "'>";

for insert in inserts:
    rdfStr += insert;

rdfStr += "</rdf:Description>"

# close RDF header
rdfStr += "</rdf:RDF>"

# Weisen Sie Ihre Ausgabe der OUT-Variablen zu.
OUT = rdfStr
# ----------------------------------------

# group: RDF Export
file_path_2 = Filename("..\..\..\..\..\..\..\resources\rdf\example.rdf")
on_off_2 = CodeBlock { on = "True"; off = "False"; }
switcher_2 = CodeBlock(SW=on_off_2.off, data=rdf_wrapper_python_script) { SW == "True"? data : null; }
writeText = FileSystem.WriteText(filePath=file_path_2, text=switcher_2)
watch = Watch(switcher_2)

notes = CodeBlock()
# ---------- notes.designscript (8 lines) ----------
/**
* "F5": Run the script
* "Ctrl + I": Isolate Selected Geometry
*
*
*
*
**/;
# ----------------------------------------
