# Dynamo graph PipelineGenerator.dyn (Dynamo 2.8.0.2471)
# packages: MeshToolkit 3.0.0, TextNoteByPointAndDo 0.0.1

# group: Sphere testing
polygon1_name = Python()  # CPython3; unwired: IN[0], IN[1], IN[2]
# ---------- polygon1_name.python (40 lines) ----------
# Load the Python Standard and DesignScript Libraries
import sys
import clr
clr.AddReference('ProtoGeometry')
from Autodesk.DesignScript.Geometry import *

# The inputs to this node will be stored as a list in the IN variables.
#dataEnteringNode = IN
INDEX_EN = ['A','B','C','D'];
INDEX_NUM = ['1','2','3','4'];
INDEX = [];

if IN[2] == "EN":
    INDEX = INDEX_EN
if IN[2] == "NUM":
    INDEX = INDEX_NUM
"""
# Place your code below this line
def name_concatenation(geo_name:str, geo_number:int, index = INDEX):
    if geo_number > len(index):
        raise ValueError("No more indexes available!")
 
    geo_concat = [geo_name + index[i] for i in range(geo_number)]
    return geo_concat

def name_lst_concatenation(geo_name_lst:list, geo_number:int, index = INDEX):
    if geo_number > len(index):
        raise ValueError("No more indexes available!")
    
    geo_concat = [[geo_name + index[i] for i in range(geo_number)] for geo_name in geo_name_lst]
    return geo_concat


# Assign your output to the OUT variable.
if isinstance(IN[0], str):
    OUT = name_concatenation(IN[0], IN[1])
else:
    OUT = name_lst_concatenation(IN[0], IN[1])
"""
OUT = ""
# ----------------------------------------
code_block = CodeBlock()
# ---------- code_block.designscript (11 lines) ----------
centroid = Point.ByCoordinates(0,0,2);
offset = 2/2;
c_X = 0;
c_Y = 0;
c_Z = 2;

bottom_p1 = Point.ByCoordinates(c_X-offset, c_Y-offset, c_Z-offset);
bottom_p2 = Point.ByCoordinates(c_X-offset, c_Y+offset, c_Z-offset);
bottom_p3 = Point.ByCoordinates(c_X+offset, c_Y+offset, c_Z-offset);
bottom_p4 = Point.ByCoordinates(c_X+offset, c_Y-offset, c_Z-offset);
bottom_face = [bottom_p1, bottom_p2, bottom_p3, bottom_p4];
# ----------------------------------------
code_block_2 = CodeBlock { centroid = Point.ByCoordinates(-7, -3, 6); }
byCenterPointRadius = Sphere.ByCenterPointRadius()  # frozen
byGeometry = Autodesk.Dynamo.MeshToolkit.Mesh.ByGeometry(inputGeometry=byCenterPointRadius)
explode = Autodesk.Dynamo.MeshToolkit.Mesh.Explode(mesh=byGeometry)
watch = Watch(explode)
code_block_3 = CodeBlock(list=watch) { list; pol = list[0]; }
watch_2 = Watch(code_block_3.pol)
vertices = Autodesk.Dynamo.MeshToolkit.Mesh.Vertices(mesh=watch_2)
watch_3 = Watch(vertices)
watch_3d = Watch3D(watch_3)
triangleCentroids = Autodesk.Dynamo.MeshToolkit.Mesh.TriangleCentroids()  # unwired: mesh
code_block_4 = CodeBlock { 3; }
chop = List.Chop(list=triangleCentroids, lengths=code_block_4)

# group: Coordinates
points = CodeBlock()
# ---------- points.designscript (10 lines) ----------
p1 = Point.ByCoordinates(2+6,-1);
p2 = Point.ByCoordinates(5,0);
// Line1
line1S = Point.ByCoordinates(0,0,1.5);
line1E = Point.ByCoordinates(3,0,-1);
line1 = [line1S, line2E];
// Line2
line2S = Point.ByCoordinates(8,-1,0);
line2E = Point.ByCoordinates(0,6,0);
line2 = [line2S, line2E];
# ----------------------------------------
polygonCoordList1 = CodeBlock()
# ---------- polygonCoordList1.designscript (6 lines) ----------
p1 = Point.ByCoordinates(2+6+2,-1,0);
p2 = Point.ByCoordinates(2+6+2,1,0);
p3 = Point.ByCoordinates(0+6+2,1,0);
p4 = Point.ByCoordinates(0+6+2,-1,0);
//p5 = Point.ByCoordinates(2+6,-1,6);
p = [p1,p2,p3,p4];
# ----------------------------------------
polygonCoordList2 = CodeBlock()
# ---------- polygonCoordList2.designscript (6 lines) ----------
p1 = Point.ByCoordinates(4,0,6);
p2 = Point.ByCoordinates(4,4,6);
p3 = Point.ByCoordinates(0,4,6);
p4 = Point.ByCoordinates(0,0,6);
p5 = Point.ByCoordinates(4,0,6);
p = [p1,p2,p3,p4];
# ----------------------------------------
cubecoord_length = CodeBlock { cub_coord1 = Point.ByCoordinates(0,0,0); cub_coord2 = Point.ByCoordinates(6,6,2); len1 = 4; len2 = 2; }

# group: WKT Generator
rdf_prefixes = CodeBlock()
# ---------- rdf_prefixes.designscript (27 lines) ----------
rdf="http://www.w3.org/1999/02/22-rdf-syntax-ns#";
owl="http://www.w3.org/2002/07/owl#";
ogc="http://www.opengis.net/";
my="https://www.inf.bi.ruhr-uni-bochum.de/jena/#";
gml="http://www.opengis.net/ont/gml#";
geo="http://www.opengis.net/ont/geosparql#";
geof="http://www.opengis.net/def/function/geosparql/";
rdfs="http://www.w3.org/2000/01/rdf-schema#";
uom="http://www.opengis.net/def/uom/OGC/1.0/";
sf="http://www.opengis.net/ont/sf#";
xsd="http://www.w3.org/2001/XMLSchema#";
geor="http://www.opengis.net/def/rule/geosparql/";

namespaces = {
	"rdf" : rdf,
	"owl" : owl,
	"ogc" : ogc,
	"my" : my,
	"gml" : gml,
	"geo" : geo,
	"geof": geof,
	"rdfs": rdfs,
	"uom": uom,
	"sf": sf,
	"xsd": xsd,
	"geor": geor
};
# ----------------------------------------
code_block_5 = CodeBlock()
# ---------- code_block_5.designscript (2 lines) ----------
// Number of Geometries to generate
20;
# ----------------------------------------
geometry_generator = Python(IN[0]=code_block_5)  # CPython3
# ---------- geometry_generator.python (243 lines) ----------
# Load the Python Standard and DesignScript Libraries
import sys
import clr
clr.AddReference('ProtoGeometry')
from Autodesk.DesignScript.Geometry import *
clr.AddReference('DSCoreNodes')
from DSCore import *
clr.AddReference('GeometryColor')
from Modifiers import GeometryColor
clr.AddReference('MeshToolkit')
from Autodesk.Dynamo.MeshToolkit import *

# Common Geometry Types
POINT = "POINT";
MULTIPOINT = "MULTIPOINT";
LINESTRING = "LINESTRING";
MULTILINESTRING = "MULTILINESTRING";
POLYGON = "POLYGON";
MULTIPOLYGON = "MULTIPOLYGON"
MULTIPOLYGON_ROTATION = "MULTIPOLYGON_ROTATION"
SPHERE = "MULTIPOLYGON_SPHERE"
GEOMETRYCOLLECTION = "GEOMETRYCOLLECTION";

# The inputs to this node will be stored as a list in the IN variables.
NUM_MULTIPOLYGON = 10
NUM_POLYGON = 10
NUM_LINESTRING = 10
NUM_POINT = 10

# Input 
NUM_MULTIPOLYGON = IN[0]
#NUM_MULTIPOLYGON = 50
#num = IN[1]

# output container
geo_type_lst = []
geo_lst = []

# Point

# LineString
"""
c=1
geo_data = Arc.ByThreePoints( Point.ByCoordinates(20, 20, 2),
                            Point.ByCoordinates(25, 25, 2),
                            Point.ByCoordinates(40, 10, 2))
geo_name = LINESTRING + str(c)
geo_type = LINESTRING
geo_lst.append((geo_data, geo_name, geo_type))
"""

# Polygon

# Multipolygon
"""
i=1
c=1
for i in range(-NUM_MULTIPOLYGON, NUM_MULTIPOLYGON, 4):
    c+=1
    p1 = Point.ByCoordinates(i, i, 0)
    p2 = Point.ByCoordinates(3+i, 3+i, 3)
    
    geo_data = Cuboid.ByCorners(p1, p2)
    geo_name = MULTIPOLYGON + str(c)
    geo_type = MULTIPOLYGON
    geo_lst.append((geo_data, geo_name, geo_type))

i=1
for i in range(-NUM_MULTIPOLYGON, NUM_MULTIPOLYGON, 4):
    c+=1
    j = i + 10
    p1 = Point.ByCoordinates(i, j, 0)
    p2 = Point.ByCoordinates(3+i, 3+j, 3)
    
    geo_data = Cuboid.ByCorners(p1, p2)
    geo_name = MULTIPOLYGON + str(c)
    geo_type = MULTIPOLYGON
    geo_lst.append((geo_data, geo_name, geo_type))
"""
#################################################
# Polygon
p = 1
pt_lst = [Point.ByCoordinates(-4, 6, 0),
          Point.ByCoordinates(-9, 6, 3),  
          Point.ByCoordinates(-7, 6, 6)]
geo_data_p1 = pt_lst
geo_name_p1 = POLYGON + str(p)
geo_type_p1 = POLYGON
geometry_p1 = Surface.ByPerimeterPoints(pt_lst)
geo_lst.append((geo_data_p1, geo_name_p1, geo_type_p1, geometry_p1))


p = 2
pt_lst = [Point.ByCoordinates(-4, 10, 0),
          Point.ByCoordinates(-9, 10, 3),  
          Point.ByCoordinates(-7, 8, 6)]
geo_data_p2 = pt_lst
geo_name_p2 = POLYGON + str(p)
geo_type_p2 = POLYGON
geometry_p2 = Surface.ByPerimeterPoints(pt_lst)
geo_lst.append((geo_data_p2, geo_name_p2, geo_type_p2, geometry_p2))
#################################################
# Cubes
c = 1
p11 = Point.ByCoordinates(0, 0, 0)
p12 = Point.ByCoordinates(3, 3, 3)
geo_data1 = Cuboid.ByCorners(p11, p12)
geo_name1 = MULTIPOLYGON + str(c)
geo_type1 = MULTIPOLYGON
#geo_tag = Tag.CreateTag()
geo_lst.append((geo_data1, geo_name1, geo_type1))

c = 2
p21 = Point.ByCoordinates(3, 3, 3)
p22 = Point.ByCoordinates(6, 6, 6)
geo_data2 = Cuboid.ByCorners(p21, p22)
geo_name2 = MULTIPOLYGON + str(c)
geo_type2 = MULTIPOLYGON
geo_lst.append((geo_data2, geo_name2, geo_type2))

c = 3
p31 = Point.ByCoordinates(6, 6, 3)
p32 = Point.ByCoordinates(9, 9, 6)
geo_data3 = Cuboid.ByCorners(p31, p32)
geo_name3 = MULTIPOLYGON + str(c)
geo_type3 = MULTIPOLYGON
geo_lst.append((geo_data3, geo_name3, geo_type3))

c = 4
p41 = Point.ByCoordinates(-3, 0, 0)
p42 = Point.ByCoordinates(-6, -3, 3)
geo_data4 = Cuboid.ByCorners(p41, p42)
geo_name4 = MULTIPOLYGON + str(c)
geo_type4 = MULTIPOLYGON
geo_lst.append((geo_data4, geo_name4, geo_type4))

c = 5
p51 = Point.ByCoordinates(-4, 0, 0)
p52 = Point.ByCoordinates(-7, -3, 3)
geo_data5 = Cuboid.ByCorners(p51, p52)
geo_name5 = MULTIPOLYGON + str(c)
geo_type5 = MULTIPOLYGON
geo_lst.append((geo_data5, geo_name5, geo_type5))

c = 6
p61 = Point.ByCoordinates(-3, 5, 0)
p62 = Point.ByCoordinates(0, 8, 3)
geo_data6 = Cuboid.ByCorners(p61, p62)
geo_name6 = MULTIPOLYGON + str(c)
geo_type6 = MULTIPOLYGON
geo_lst.append((geo_data6, geo_name6, geo_type6))

c = 7
p71 = Point.ByCoordinates(-8, 5, 0)
p72 = Point.ByCoordinates(-5, 8, 3)
geo_data7 = Cuboid.ByCorners(p71, p72)
geo_name7 = MULTIPOLYGON + str(c)
geo_type7 = MULTIPOLYGON
geo_lst.append((geo_data7, geo_name7, geo_type7))

c = 8
p1 = Point.ByCoordinates(-13, 10, 0)
p2 = Point.ByCoordinates(-10, 3, 3)

cube = Cuboid.ByCorners(p1, p2)
old_cs = CoordinateSystem.Identity()
new_cs = CoordinateSystem.Identity()
new_cs2 = new_cs.Rotate(p1, Vector.ByCoordinates(1,0,3), 25)
geometry = cube.Transform(old_cs, new_cs2)

geo_data = geometry.Faces
geo_name = MULTIPOLYGON + str(c)
geo_type = MULTIPOLYGON_ROTATION
geo_lst.append((geo_data, geo_name, geo_type, geometry))

c = 9
p_s = Point.ByCoordinates(-15, 8, 0)
p_e = Point.ByCoordinates(-20, 3, 5)
geo_data = Cuboid.ByCorners(p_s, p_e)
geo_name = MULTIPOLYGON + str(c)
geo_type = MULTIPOLYGON
geo_lst.append((geo_data, geo_name, geo_type))

#################################################
# Sphere - (c4, c5) 
s = 1
c = 10

centroid_pt = Point.ByCoordinates(-7, -3, 6)
geometry = Sphere.ByCenterPointRadius(centroid_pt, radius=3)

sphere_mesh = Mesh.ByGeometry(geometry)
mesh_lst = Mesh.Explode(sphere_mesh)

mesh_vert_lst = []
for mesh in mesh_lst:
    mesh_vert_lst.append(Mesh.Vertices(mesh))

geo_data = mesh_vert_lst
geo_name = MULTIPOLYGON + str(c)
geo_type = SPHERE
geo_lst.append((geo_data, geo_name, geo_type, geometry))


s = 2
c = 11

centroid_pt = Point.ByCoordinates(-20, 3, 5)
geometry = Sphere.ByCenterPointRadius(centroid_pt, radius=2)

sphere_mesh = Mesh.ByGeometry(geometry)
mesh_lst = Mesh.Explode(sphere_mesh)

mesh_vert_lst = []
for mesh in mesh_lst:
    mesh_vert_lst.append(Mesh.Vertices(mesh))

geo_data = mesh_vert_lst
geo_name = MULTIPOLYGON + str(c)
geo_type = SPHERE

geo_lst.append((geo_data, geo_name, geo_type, geometry))

#################################################
# LineString
l = 1
pt_lst =   [Point.ByCoordinates(10, 10, 0),
            Point.ByCoordinates(5, 5, 0),
            Point.ByCoordinates(5, 3, 0),
            Point.ByCoordinates(-3, 5, 0),
            Point.ByCoordinates(-7, 0, 0),
            Point.ByCoordinates(-12, 6, 0),
            Point.ByCoordinates(-15, 6, 0),
            Point.ByCoordinates(-15, 1, 0)]

geo_data_l1 = pt_lst
geo_name_l1 = LINESTRING + str(l)
geo_type_l1 = LINESTRING
geometry_l1 = PolyCurve.ByPoints(pt_lst, False)
geo_lst.append((geo_data_l1, geo_name_l1, geo_type_l1, geometry_l1))

# output
OUT = geo_lst
# ----------------------------------------
wkt_converter = Python(IN[0]=geometry_generator, IN[1]=rdf_prefixes.my, IN[2]=rdf_prefixes.geo)  # CPython3
# ---------- wkt_converter.python (254 lines) ----------
# Load the Python Standard and DesignScript Libraries
import sys
import clr
clr.AddReference('ProtoGeometry')
from Autodesk.DesignScript.Geometry import *

# The inputs to this node will be stored as a list in the IN variables.
geo_lst = IN[0]
exampleInstanceNamespace = IN[1] # dataEnteringNode[3];
geoSparqlNamespace = IN[2] # dataEnteringNode[4];

def lineString2WKT(geo_data):
    wktLiteral = "<sf:LineString>";
    wktLiteral += "<rdf:Description rdf:about='" + exampleInstanceNamespace + str(name) + "'>";
    wktLiteral += "<geo:asWKT rdf:datatype='" + geoSparqlNamespace + "wktLiteral'>";
    wktLiteral += "LINESTRING Z((";
    
    points =  geo_data
    originP = points[0];
    
    wktLiteral += str(originP.X) + " " +  str(originP.Y) + " " +  str(originP.Z) # start point
    for i in range(1, len(points)):
        wktLiteral += ", " + str(points[i].X) + " " +  str(points[i].Y) + " " +  str(points[i].Z);       
    #wktLiteral += ", " + str(originP.X) + " " +  str(originP.Y) + " " +  str(originP.Z); # end point
    wktLiteral += "))"
    
    wktLiteral += "</geo:asWKT>";
    wktLiteral += "</rdf:Description>";
    wktLiteral += "</sf:LineString>";
    return wktLiteral
"""
def sphere2WKT(surface_lst):
    wktLiteral = "<sf:MultiPolygon>";
    wktLiteral += "<rdf:Description rdf:about='" + exampleInstanceNamespace + str(name) + "'>";
    wktLiteral += "<geo:asWKT rdf:datatype='" + geoSparqlNamespace + "wktLiteral'>";
    
    # for curves/surfaces
    wktLiteral += "MULTIPOLYGON Z(";
    for surface in surface_lst:
        wktLiteral += "((";
        try:
            curves = Surface.PerimeterCurves(surface);
        except:
            raise Exception("something wrong at geometry import!")
        startP = None;
        for curve in curves:
            nextP = curve.StartPoint;
            if(startP != None):
                wktLiteral += ", ";
            else:
                startP = nextP;
            wktLiteral += str(nextP.X) + " " +  str(nextP.Y) + " " +  str(nextP.Z);
        #Close the tiangle loop with a repeat of the first Point         
        wktLiteral += ", " + str(startP.X) + " " +  str(startP.Y) + " " +  str(startP.Z) + "))";
        if(surface != surface_lst[-1]):
            wktLiteral += ", "
    wktLiteral += ")"
    wktLiteral += "</geo:asWKT>";
    wktLiteral += "</rdf:Description>";
    wktLiteral += "</sf:MultiPolygon>";
    return wktLiteral
"""
def sphere2WKT(surface_lst):
    wktLiteral = "<sf:MultiPolygon>";
    wktLiteral += "<rdf:Description rdf:about='" + exampleInstanceNamespace + str(name) + "'>";
    wktLiteral += "<geo:asWKT rdf:datatype='" + geoSparqlNamespace + "wktLiteral'>";
    
    # for curves/surfaces
    face_wkt_lst = ""
    for vert_lst in surface_lst:
        
        vert_wkt_lst = "(("
        for vert in vert_lst:
        
            vert_wkt_lst += str(vert.X) + " " +  str(vert.Y) + " " +  str(vert.Z);
            if vert != vert_lst[-1]:
                vert_wkt_lst += ", "
        
        vert_wkt_lst += ", " + str(vert_lst[0].X) + " " +  str(vert_lst[0].Y) + " " +  str(vert_lst[0].Z) + "))";
        
        face_wkt_lst += vert_wkt_lst
        if vert_lst != surface_lst[-1]:
            face_wkt_lst += ", "          
            
    wktLiteral += "MULTIPOLYGON Z(";
    wktLiteral += face_wkt_lst
    wktLiteral += ")"
    wktLiteral += "</geo:asWKT>";
    wktLiteral += "</rdf:Description>";
    wktLiteral += "</sf:MultiPolygon>";
    return wktLiteral
    
    
def multipolygonInRotation2WKT(face_lst):
    wktLiteral = "<sf:MultiPolygon>";
    wktLiteral += "<rdf:Description rdf:about='" + exampleInstanceNamespace + str(name) + "'>";
    wktLiteral += "<geo:asWKT rdf:datatype='" + geoSparqlNamespace + "wktLiteral'>";
    face_wkt_lst = ""
    
    for face in face_lst:
        
        vertice_lst = face.Vertices
        org_vert_pt = vertice_lst[0].PointGeometry 
        face_wkt = "((" + str(org_vert_pt.X) + " " +  str(org_vert_pt.Y) + " " +  str(org_vert_pt.Z) # start point
    
        for i in range(1, len(vertice_lst)):
            vert_pt = vertice_lst[i].PointGeometry
            face_wkt += ", " + str(vert_pt.X) + " " +  str(vert_pt.Y) + " " +  str(vert_pt.Z)       
        face_wkt += ", " + str(org_vert_pt.X) + " " +  str(org_vert_pt.Y) + " " +  str(org_vert_pt.Z) + "))" # end point
        
        if(face != face_lst[-1]):
            face_wkt += ", "
        face_wkt_lst += face_wkt        
    
    wktLiteral += "MULTIPOLYGON Z("
    wktLiteral += face_wkt_lst
    wktLiteral += ")" 
    wktLiteral += "</geo:asWKT>"
    wktLiteral += "</rdf:Description>"
    wktLiteral += "</sf:MultiPolygon>"
    return wktLiteral
    
def multipolygon2WKT(geo_data):
    wktLiteral = "<sf:MultiPolygon>";
    wktLiteral += "<rdf:Description rdf:about='" + exampleInstanceNamespace + str(name) + "'>";
    wktLiteral += "<geo:asWKT rdf:datatype='" + geoSparqlNamespace + "wktLiteral'>";
    
    """
    # for curves/surfaces
    wktLiteral += "MULTIPOLYGON Z(((";
    try:
        curves = Surface.PerimeterCurves(geometry);
    except:
        raise Exception("something wrong at geometry import!")
    startP = None;
    for curve in curves:
        nextP = curve.StartPoint;
        if(startP != None):
            wktLiteral += ", ";
        else:
            startP = nextP;
        wktLiteral += str(nextP.X) + " " +  str(nextP.Y) + " " +  str(nextP.Z);
        
    #Close the tiangle loop with a repeat of the first Point
    wktLiteral += ", " + str(startP.X) + " " +  str(startP.Y) + " " +  str(startP.Z);
    wktLiteral += ")))"
    """
    # for cuboids with geometry = [centroid, length]
    centroid = Solid.Centroid(geo_data)
    offset = geo_data.Length/2
    c_X = centroid.X
    c_Y = centroid.Y
    c_Z = centroid.Z

    # idea: determine the coordinates of bottom- and top faces
    
    # p1 -- p2
    # |  c   |
    # p3 -- p4           
    # bottom-face
    bottom_p1 = str(c_X-offset) + " " + str(c_Y-offset) + " " + str(c_Z-offset)
    bottom_p2 = str(c_X-offset) + " " + str(c_Y+offset) + " " + str(c_Z-offset) 
    bottom_p3 = str(c_X+offset) + " " + str(c_Y+offset) + " " + str(c_Z-offset)
    bottom_p4 = str(c_X+offset) + " " + str(c_Y-offset) + " " + str(c_Z-offset)
    bottom_face = "((" + bottom_p1 + ", " + bottom_p2 + ", " + bottom_p3 + ", " + bottom_p4 +  ", " + bottom_p1 + "))"
    # top-face
    top_p1 = str(c_X-offset) + " " + str(c_Y-offset) + " " + str(c_Z+offset)
    top_p2 = str(c_X-offset) + " " + str(c_Y+offset) + " " + str(c_Z+offset) 
    top_p3 = str(c_X+offset) + " " + str(c_Y+offset) + " " + str(c_Z+offset)
    top_p4 = str(c_X+offset) + " " + str(c_Y-offset) + " " + str(c_Z+offset)
    top_face = "((" + top_p1 + ", " + top_p2 + ", " + top_p3 + ", " + top_p4 +  ", " + top_p1 + "))"
    # front-face
    front_p1 = str(c_X-offset) + " " + str(c_Y-offset) + " " + str(c_Z-offset)
    front_p2 = str(c_X-offset) + " " + str(c_Y+offset) + " " + str(c_Z-offset) 
    front_p3 = str(c_X-offset) + " " + str(c_Y+offset) + " " + str(c_Z+offset) 
    front_p4 = str(c_X-offset) + " " + str(c_Y-offset) + " " + str(c_Z+offset)
    front_face = "((" + front_p1 + ", " + front_p2 + ", " + front_p3 + ", " + front_p4 + ", " + front_p1 + "))"
    # back-face             
    back_p1 = str(c_X+offset) + " " + str(c_Y-offset) + " " + str(c_Z-offset)
    back_p2 = str(c_X+offset) + " " + str(c_Y+offset) + " " + str(c_Z-offset) 
    back_p3 = str(c_X+offset) + " " + str(c_Y+offset) + " " + str(c_Z+offset) 
    back_p4 = str(c_X+offset) + " " + str(c_Y-offset) + " " + str(c_Z+offset)
    back_face = "((" + back_p1 + ", " + back_p2 + ", " + back_p3 + ", " + back_p4 + ", " + back_p1 + "))"
    # left-face
    left_p1 = str(c_X-offset) + " " + str(c_Y-offset) + " " + str(c_Z-offset)
    left_p2 = str(c_X+offset) + " " + str(c_Y-offset) + " " + str(c_Z-offset)
    left_p3 = str(c_X+offset) + " " + str(c_Y-offset) + " " + str(c_Z+offset)
    left_p4 = str(c_X-offset) + " " + str(c_Y-offset) + " " + str(c_Z+offset)
    left_face = "((" + left_p1 + ", " + left_p2 + ", " + left_p3 + ", " + left_p4 + ", " + left_p1 + "))"            
    # right-face
    right_p1 = str(c_X-offset) + " " + str(c_Y+offset) + " " + str(c_Z-offset)
    right_p2 = str(c_X+offset) + " " + str(c_Y+offset) + " " + str(c_Z-offset)
    right_p3 = str(c_X+offset) + " " + str(c_Y+offset) + " " + str(c_Z+offset)
    right_p4 = str(c_X-offset) + " " + str(c_Y+offset) + " " + str(c_Z+offset)
    right_face = "((" + right_p1 + ", " + right_p2 + ", " + right_p3 + ", " + right_p4 + ", " + right_p1 + "))"
    
    cuboid_face = bottom_face + ", " + top_face + ", " + front_face + ", " + back_face + ", " + left_face + ", " + right_face
    
    wktLiteral += "MULTIPOLYGON Z("
    try:
        wktLiteral += cuboid_face
    except e:
        return e
    print(cuboid_face)
    wktLiteral += ")"
    wktLiteral += "</geo:asWKT>"
    wktLiteral += "</rdf:Description>"
    wktLiteral += "</sf:MultiPolygon>"
    return wktLiteral
    
def polygon2WKT(geo_data):
    wktLiteral = "<sf:POLYGON>";
    wktLiteral += "<rdf:Description rdf:about='" + exampleInstanceNamespace + str(name) + "'>";
    wktLiteral += "<geo:asWKT rdf:datatype='" + geoSparqlNamespace + "wktLiteral'>";
    wktLiteral += "POLYGON Z((";
    
    points =  geo_data
    originP = points[0];
    
    wktLiteral += str(originP.X) + " " +  str(originP.Y) + " " +  str(originP.Z) # start point
    for i in range(1, len(points)):
        wktLiteral += ", " + str(points[i].X) + " " +  str(points[i].Y) + " " +  str(points[i].Z);       
    wktLiteral += ", " + str(originP.X) + " " +  str(originP.Y) + " " +  str(originP.Z); # end point
    wktLiteral += "))"
    
    wktLiteral += "</geo:asWKT>";
    wktLiteral += "</rdf:Description>";
    wktLiteral += "</sf:POLYGON>";
    return wktLiteral

#####
res = []
for geo_obj in geo_lst:
    geo_data = geo_obj[0];
    name = geo_obj[1];
    geometryType = geo_obj[2];
    
    if(geometryType.upper() == "MULTIPOLYGON_ROTATION"):
        res.append(multipolygonInRotation2WKT(geo_data))
        
    if(geometryType.upper() == "MULTIPOLYGON"):
        res.append(multipolygon2WKT(geo_data))
    
    if(geometryType.upper() == "MULTIPOLYGON_SPHERE"):
        res.append(sphere2WKT(geo_data))
    
    if(geometryType.upper() == "POLYGON"):
        res.append(polygon2WKT(geo_data))
    
    if(geometryType.upper() == "LINESTRING"):
        res.append(lineString2WKT(geo_data))

# Assign your output to the OUT variable.
OUT = res
# ----------------------------------------
rdf_wrapper_python_script = Python(IN[0]=rdf_prefixes.namespaces, IN[1]=wkt_converter)  # CPython3
# ---------- rdf_wrapper_python_script.python (35 lines) ----------
# Phython-Standard- und DesignScript-Bibliotheken laden
import sys
import clr
clr.AddReference('ProtoGeometry')
from Autodesk.DesignScript.Geometry import *

# Die Eingaben für diesen Block werden in Form einer Liste in den IN-Variablen gespeichert.
dataEnteringNode = IN

namespaces = dataEnteringNode[0]
inserts = dataEnteringNode[1]

# open RDF header
rdfStr = "<rdf:RDF";

# handle Namespaces
for key in namespaces:
    rdfStr += " xmlns:" + key + "='" + namespaces[key] + "'";

rdfStr += ">";

#add inserts

rdfStr += "<rdf:Description rdf:about='my:" + "RootModel" + "'>";

for insert in inserts:
    rdfStr += insert;

rdfStr += "</rdf:Description>"

# close RDF header
rdfStr += "</rdf:RDF>"

# Weisen Sie Ihre Ausgabe der OUT-Variablen zu.
OUT = rdfStr
# ----------------------------------------
watch_4 = Watch(wkt_converter)

# group: RDF Export
on_off = BoolSelector(false)
file_path = Filename("..\Documents\Developer\Repo\ExtendingJena\src\main\resources\rdf\example.rdf")
switcher = CodeBlock(SW=on_off, path=file_path) { SW == "True"? path : null; }
watch_5 = Watch(switcher)
writeText = FileSystem.WriteText(filePath=watch_5, text=rdf_wrapper_python_script)

notes = CodeBlock()
# ---------- notes.designscript (8 lines) ----------
/**
* "F5": Run the script
* "Ctrl + I": Isolate Selected Geometry
* "Ctrl + P": Drag & Drop
*
*
*
**/;
# ----------------------------------------

# group: XML(query result) Import and Parsing
on_off_2 = BoolSelector(true)
file_path_2 = Filename("..\..\..\..\..\..\..\resources\rdf\query_result.xml")
fileExists = FileSystem.FileExists(path=file_path_2)

watch_6 = Watch(file_path_2)

# group (continued): XML(query result) Import and Parsing
python_script = Python(IN[0]=fileExists, IN[1]=watch_6)  # CPython3
# ---------- python_script.python (88 lines) ----------
# Load the Python Standard and DesignScript Libraries
import sys
import clr
import ctypes
import xml.etree.ElementTree as ET
sys.path.append(r"C:\Users\yhe\AppData\Local\Programs\Python\Python310\Lib\site-packages")

clr.AddReference('ProtoGeometry')
from Autodesk.DesignScript.Geometry import *
from xml.dom.minidom import parse, parseString

#dir = "r'C:\\Users\\nobita_yhe\\Workspace\\ExtendingJena\\src\\main\\resources\\rdf\\query_result.xml'"
#dir = r'C:\Users\nobita_yhe\Workspace\ExtendingJena\src\main\resources\rdf\query_result.xml'
warn_str = 'File or File Path does not exist.'
res = ''
######################################################

def xmlParsing2Uri(path=dir):
    """ it returns the list in structure like [[uri1, uri2],...,[uri1, uri2]]"""
    dom = parse(path)
    data = dom.documentElement
    resList = data.getElementsByTagName('result')
    
    res_lst = []
    for res in resList: # handle the <result>...</result>
        ur_lst = []
        for bi in res.getElementsByTagName('binding'): # handle the <binding>...</binding>
            for ur in bi.getElementsByTagName('uri'):
                ur_lst.append(ur.childNodes[0].nodeValue)
        res_lst.append(ur_lst)
        ur_lst = []
    return res_lst


def xml2GeometryString(path=dir):
    """ it returns the list in structure like [[Geomety1, Geomety2],...,[Geomety1, Geomety2]]"""
    dom = parse(path)
    data = dom.documentElement
    resList = data.getElementsByTagName('result')
    seperator = '#'

    res_lst = []
    for res in resList: # handle the <result>...</result>
        ur_lst = []
        for bi in res.getElementsByTagName('binding'): # handle the <binding>...</binding>
            for ur in bi.getElementsByTagName('uri'):
                uri_str = ur.childNodes[0].nodeValue
                geo_index = uri_str.find(seperator) 
                geo_str = uri_str[geo_index+1:]
                ur_lst.append(geo_str)
        res_lst.append(ur_lst)
        ur_lst = []
    return res_lst

def xml2GeoInDynamo(path=dir):
    #with open(r'C:\Users\nobita_yhe\Workspace\ExtendingJena\src\main\resources\rdf\query_result.xml', 'r', encoding='utf-8') as file:
    with open(path, 'r', encoding='utf-8') as file:
        xml_data = file.read()
        dom = parseString(xml_data)
        #dom = parse(xml_data)
        data = dom.documentElement
        resList = data.getElementsByTagName('result')
        seperator = '#'
        
        res_lst = []
        for res in resList: # handle the <result>...</result>
            ur_lst = []
            for bi in res.getElementsByTagName('binding'): # handle the <binding>...</binding>
                for ur in bi.getElementsByTagName('uri'):
                    uri_str = ur.childNodes[0].nodeValue
                    geo_index = uri_str.find(seperator) 
                    geo_str = uri_str[geo_index+1:]
                    ur_lst.append(geo_str)
            res_lst.append(ur_lst)
            ur_lst = []
    return res_lst
    
######################################################

if IN[0] == True:
    dir = IN[1]
    res = xml2GeoInDynamo(dir)
else:
	ctypes.windll.user32.MessageBoxW(0, warn_str, 'Input Exception',1)
	res = warn_str
######################################################
# Assign your output to the OUT variable.
OUT = res
# ----------------------------------------
switcher_2 = CodeBlock(SW=on_off_2, data=python_script) { SW == "True"? data : null; }
query_result_viewer = Watch(switcher_2)

# group: Highlight of Query Result
on_off_3 = BoolSelector(true)
geometry_highlighter = Python(IN[0]=geometry_generator, IN[1]=query_result_viewer, IN[2]=on_off_3)  # CPython3
# ---------- geometry_highlighter.python (70 lines) ----------
# Load the Python Standard and DesignScript Libraries
import sys
import clr
clr.AddReference('ProtoGeometry')
from Autodesk.DesignScript.Geometry import *
clr.AddReference('DSCoreNodes')
from DSCore import *
clr.AddReference('GeometryColor')
from Modifiers import GeometryColor

###########################################################
def flatten(inp_lst):
# Core: 
#		1. traverse the input list 
#		2. concatenate each two adjacent elements 
#		3. store the concatenation into the output list
#		4. remove the non-list element out of the input list
    out_lst = []
    while True:
        if inp_lst == []:
            break
        for ind, val in enumerate(inp_lst):
            if type(val) == list:
                inp_lst = val + inp_lst[ind+1:]
                break
            else:
                out_lst.append(val)
                inp_lst.pop(ind)
                break
    return out_lst

def inList(res_lst, geo):
    flat_lst = flatten(res_lst)
    res = False
    
    for e in flat_lst:
        if e is None:
            break
        if geo.upper() == e.upper():
            res = True
            break
    return res
############################################################
# Input
geo_lst = IN[0]
res_lst = IN[1]
switch = IN[2]

#################################################
# Highlighter
colored_geo_lst = []
if switch:
    color = Color.ByARGB(255,255,0,0) # red
    
    for geo in geo_lst:
        geo_name = geo[1]
        if inList(res_lst, geo_name):  
            geo_data = geo[0]
            colored_geo = ''
            if (geo[2].upper() == "LINESTRING" 
            or geo[2].upper() == "POLYGON"
            or geo[2].upper() == "MULTIPOLYGON_ROTATION"
            or geo[2].upper() == "MULTIPOLYGON_SPHERE" ):
                colored_geo = GeometryColor.ByGeometryColor(geo[3], color)
            else:
                colored_geo = GeometryColor.ByGeometryColor(geo_data, color)
            colored_geo_lst.append(colored_geo)

#################################################
OUT = colored_geo_lst
# ----------------------------------------
watch_3d_2 = Watch3D(geometry_highlighter)

code_block_6 = CodeBlock {  }

# group: Geometry Selection
selection_board = CodeBlock()
# ---------- selection_board.designscript (11 lines) ----------
POINT = "POINT";
MULTIPOINT = "MULTIPOINT";
LINESTRING = "LINESTRING";
MULTILINESTRING = "MULTILINESTRING";
POLYGON = "POLYGON";
MULTIPOLYGON = "MULTIPOLYGON";
MULTIPOLYGON_ROTATION = "MULTIPOLYGON_ROTATION";
SPHERE = "MULTIPOLYGON-SPHERE";
GEOMETRYCOLLECTION = "GEOMETRYCOLLECTION";
geo_sel_lst=
["MULTIPOLYGON5"];
# ----------------------------------------
on_off_4 = BoolSelector(false)
geometry_selector = Python(IN[0]=geometry_generator, IN[1]=selection_board.geo_sel_lst, IN[2]=on_off_4)  # CPython3
# ---------- geometry_selector.python (45 lines) ----------
# Load the Python Standard and DesignScript Libraries
import sys
import clr
clr.AddReference('ProtoGeometry')
from Autodesk.DesignScript.Geometry import *
clr.AddReference('DSCoreNodes')
from DSCore import *
clr.AddReference('GeometryColor')
from Modifiers import GeometryColor

# Input
geo_lst = IN[0]
geo_sel_lst = IN[1]
switch = IN[2]


def inList(geo_sel_lst, geo):
    res = False
    for geo_sel in geo_sel_lst:
        if geo_sel is None:
            break
        if geo_sel.upper() == geo.upper():
            res = True
            break
    return res
#################################################
# Highlighter
colored_geo_lst = []
if switch:
    color = Color.ByARGB(138,43,226,0) # violet
    for geo in geo_lst:
        geo_name = geo[1]
        if inList(geo_sel_lst, geo_name):  
            geo_data = geo[0]
            colored_geo = ''
            if (geo[2].upper() == "LINESTRING" 
            or geo[2].upper() == "POLYGON" 
            or geo[2].upper() == "MULTIPOLYGON_ROTATION"):
                colored_geo = GeometryColor.ByGeometryColor(geo[3], color)
            else:
                colored_geo = GeometryColor.ByGeometryColor(geo_data, color)
            colored_geo_lst.append(colored_geo)

#################################################
OUT = colored_geo_lst
# ----------------------------------------
watch_3d_3 = Watch3D(geometry_selector)
watch_7 = Watch(watch_3d_3)

code_block_7 = CodeBlock { Point.ByCoordinates(20, 20, 0); "text"; "String"; }
textNoteByPointAndDo = Custom[TextNoteByPointAndDo](point=code_block_7.out0, content=code_block_7.out1, textType=code_block_7.out2)  # package TextNoteByPointAndDo; Places a text note at a given point in the view. View, text type and content can either be a single item for all points or the same length as the number of points. Set track to false if you'd like to place notes on every run. Has Do option; unwired: view

# group: Geometry Validator
on_off_5 = BoolSelector(false)
python_script_2 = Python(IN[0]=on_off_5)  # CPython3
# ---------- python_script_2.python (111 lines) ----------
import sys
import clr
clr.AddReference('ProtoGeometry')
from Autodesk.DesignScript.Geometry import *
clr.AddReference('DSCoreNodes')
from DSCore import *
clr.AddReference('GeometryColor')
from Modifiers import GeometryColor

switch = IN[0]
val_lst = []

################## point ####################
#pt_T1 = [Point.ByCoordinates(-9.9367610954, 10.2776839486, 2.9789203651), Point.ByCoordinates(-10.8388482396, 10.5084124645, 3.0356427683)]
#pt_T2 = [Point.ByCoordinates(-8.8510906952, 10, 2.9106544171), Point.ByCoordinates(-5.3451005024, 9.1032663317, 2.6902010049)]

pt_T1 = [GeometryColor.ByGeometryColor(
        Point.ByCoordinates(-10.0021246192, 3.602549543, 0), 
        Color.ByARGB(255,255,0,0))]
"""
pt_T2 = [GeometryColor.ByGeometryColor(
        Point.ByCoordinates(-8.8510906952, 10, 2.9106544171), 
        Color.ByARGB(0, 0, 255,0)),      
        GeometryColor.ByGeometryColor(
        Point.ByCoordinates(-5.3451005024, 9.1032663317, 2.6902010049), 
        Color.ByARGB(0, 0, 255,0))]
"""         
pt_lst = [pt_T1]
val_lst.append(pt_lst) 

#colored_pt = GeometryColor.ByGeometryColor(pt, Color.ByARGB(255,255,0,0))
#val_lst.append(colored_pt)   
#############################################

################## plane ####################
pl_A = Plane.ByThreePoints(
                            Point.ByCoordinates(-7.362129778782238, 4.457707263472535,           2.120709926260745),
                            Point.ByCoordinates(-10.168645983334033, 10.801861772729085, 3.05621532777801),
                            Point.ByCoordinates(-12.915677008332986, 9.599069113635458, 2.971892336110995)
                            )
                            
pl_B = Plane.ByThreePoints(Point.ByCoordinates(-4.0, 10.0, 0.0),
                            Point.ByCoordinates(-9.0, 10.0, 3.0),
                            Point.ByCoordinates(-7.0, 8.0, 6.0))
                            
#val_lst.append([pl_A, pl_B])                          
#############################################

############### multipolygon ################
"""
pt_face1 = [
(-7.362129778782238, 4.457707263472535, 2.120709926260745),
(-10.168645983334033, 10.801861772729085, 3.05621532777801), 
(-12.915677008332986, 9.599069113635458, 2.971892336110995), 
(-10.109160803781192, 3.254914604378909, 2.03638693459373)]

pt_face2 = [
(-10.252968975001048, 11.202792659093626, 0.08432299166701496),
(-7.446452770449254, 4.858638149837077, -0.8511824098502498),
(-10.193483795448207, 3.6558454907434506, -0.9355054015172648),
(-13.000000000000002, 10.0, 0.0)]
"""
pt_face3 = [
(-10.109160803781192, 3.254914604378909, 2.03638693459373), 
(-10.193483795448207, 3.6558454907434506, -0.9355054015172648), 
(-7.446452770449254, 4.858638149837077, -0.8511824098502498),
(-7.362129778782238, 4.457707263472535, 2.120709926260745)]

pt_face4 = [
(-12.915677008332986, 9.599069113635458, 2.971892336110995), 
(-13.000000000000002, 10.0, 0.0), 
(-10.193483795448207, 3.6558454907434506, -0.9355054015172648), 
(-10.109160803781192, 3.254914604378909, 2.03638693459373)]
"""
pt_face5 = [
(-10.168645983334033, 10.801861772729085, 3.05621532777801), 
(-10.252968975001048, 11.202792659093626, 0.08432299166701496), 
(-13.000000000000002, 10.0, 0.0),
(-12.915677008332986, 9.599069113635458, 2.971892336110995)]

pt_face6 = [
(-7.362129778782238, 4.457707263472535, 2.120709926260745), 
(-7.446452770449254, 4.858638149837077, -0.8511824098502498),
(-10.252968975001048, 11.202792659093626, 0.08432299166701496),
(-10.168645983334033, 10.801861772729085, 3.05621532777801)]
"""
pt_face_lst = [pt_face3, pt_face4]
poly_lst = []

for pt_face in pt_face_lst:
    pol_pt_lst =[]
    for pt in pt_face:
        pol_pt_lst.append(Point.ByCoordinates(pt[0], pt[1], pt[2]))
    poly_lst.append(Surface.ByPerimeterPoints(pol_pt_lst))
        
val_lst.append(poly_lst)     
#############################################

############## linestring ##################
pt_lst =   [Point.ByCoordinates(-7, 0, 0),
            Point.ByCoordinates(-12, 6, 0)]

line_string = PolyCurve.ByPoints(pt_lst, False)
colored_line_string = GeometryColor.ByGeometryColor(line_string, Color.ByARGB(255,255,0,0))
val_lst.append(colored_line_string)  
#############################################

if switch :
    OUT = val_lst
else:
    OUT = []
# ----------------------------------------
watch_3d_4 = Watch3D(python_script_2)
