# Dynamo graph QueryResultViewer.dyn (Dynamo 2.8.0.2471)
# packages: MeshToolkit 3.0.0, TextNoteByPointAndDo 0.0.1

# group: Sphere testing
polygon1_name = Python()  # CPython3; unwired: IN[0], IN[1], IN[2]
# ---------- polygon1_name.python (40 lines) ----------
# Load the Python Standard and DesignScript Libraries
import sys
import clr
clr.AddReference('ProtoGeometry')
from Autodesk.DesignScript.Geometry import *

# The inputs to this node will be stored as a list in the IN variables.
#dataEnteringNode = IN
INDEX_EN = ['A','B','C','D'];
INDEX_NUM = ['1','2','3','4'];
INDEX = [];

if IN[2] == "EN":
    INDEX = INDEX_EN
if IN[2] == "NUM":
    INDEX = INDEX_NUM
"""
# Place your code below this line
def name_concatenation(geo_name:str, geo_number:int, index = INDEX):
    if geo_number > len(index):
        raise ValueError("No more indexes available!")
 
    geo_concat = [geo_name + index[i] for i in range(geo_number)]
    return geo_concat

def name_lst_concatenation(geo_name_lst:list, geo_number:int, index = INDEX):
    if geo_number > len(index):
        raise ValueError("No more indexes available!")
    
    geo_concat = [[geo_name + index[i] for i in range(geo_number)] for geo_name in geo_name_lst]
    return geo_concat


# Assign your output to the OUT variable.
if isinstance(IN[0], str):
    OUT = name_concatenation(IN[0], IN[1])
else:
    OUT = name_lst_concatenation(IN[0], IN[1])
"""
OUT = ""
# ----------------------------------------
code_block = CodeBlock()
# ---------- code_block.designscript (11 lines) ----------
centroid = Point.ByCoordinates(0,0,2);
offset = 2/2;
c_X = 0;
c_Y = 0;
c_Z = 2;

bottom_p1 = Point.ByCoordinates(c_X-offset, c_Y-offset, c_Z-offset);
bottom_p2 = Point.ByCoordinates(c_X-offset, c_Y+offset, c_Z-offset);
bottom_p3 = Point.ByCoordinates(c_X+offset, c_Y+offset, c_Z-offset);
bottom_p4 = Point.ByCoordinates(c_X+offset, c_Y-offset, c_Z-offset);
bottom_face = [bottom_p1, bottom_p2, bottom_p3, bottom_p4];
# ----------------------------------------
code_block_2 = CodeBlock { centroid = Point.ByCoordinates(-7, -3, 6); }
byCenterPointRadius = Sphere.ByCenterPointRadius()  # frozen
byGeometry = Autodesk.Dynamo.MeshToolkit.Mesh.ByGeometry(inputGeometry=byCenterPointRadius)
explode = Autodesk.Dynamo.MeshToolkit.Mesh.Explode(mesh=byGeometry)
watch = Watch(explode)
code_block_3 = CodeBlock(list=watch) { list; pol = list[0]; }
watch_2 = Watch(code_block_3.pol)
vertices = Autodesk.Dynamo.MeshToolkit.Mesh.Vertices(mesh=watch_2)
watch_3 = Watch(vertices)
watch_3d = Watch3D(watch_3)
triangleCentroids = Autodesk.Dynamo.MeshToolkit.Mesh.TriangleCentroids()  # unwired: mesh
code_block_4 = CodeBlock { 3; }
chop = List.Chop(list=triangleCentroids, lengths=code_block_4)

# group: RDF Export
file_path = Filename("..\Documents\Developer\Repo\ExtendingJena\src\main\resources\rdf\example.rdf")
switcher = CodeBlock(path=file_path) { SW == "False"? path : null; }  # unwired: SW
watch_4 = Watch(switcher)
writeText = FileSystem.WriteText(filePath=watch_4)  # unwired: text
on_off = BoolSelector(true)

notes = CodeBlock()
# ---------- notes.designscript (8 lines) ----------
/**
* "F5": Run the script
* "Ctrl + I": Isolate Selected Geometry
* "Ctrl + P": Drag & Drop
*
*
*
**/;
# ----------------------------------------

# group: RDF Import and Parsing
file_path_2 = Filename("..\..\..\..\..\..\..\resources\JSON\xxl3DScene.json")
json_loader = Python(IN[0]=file_path_2)  # CPython3
# ---------- json_loader.python (22 lines) ----------
# Load the Python Standard and DesignScript Libraries
import sys
import clr
import json
import ctypes
clr.AddReference('ProtoGeometry')
from Autodesk.DesignScript.Geometry import *

# The inputs to this node will be stored as a list in the IN variables.
dir = IN[0]

warn_str = 'File or File Path does not exist.'

data = {}
try:
    with open(dir, 'r') as fp:
        data = json.load(fp)
except:
    ctypes.windll.user32.MessageBoxW(0, warn_str, 'Input Exception',1)

# Assign your output to the OUT variable.
OUT = data
# ----------------------------------------
json_viewer = Watch(json_loader)
on_off_loading_json = BoolSelector(true)
geometry_generator = Python(IN[0]=json_viewer, IN[1]=on_off_loading_json)  # CPython3
# ---------- geometry_generator.python (172 lines) ----------
import sys
import clr
import random
clr.AddReference('ProtoGeometry')
from Autodesk.DesignScript.Geometry import *
clr.AddReference('DSCoreNodes')
from DSCore import *
clr.AddReference('GeometryColor')
from Modifiers import GeometryColor
clr.AddReference('MeshToolkit')
from Autodesk.Dynamo.MeshToolkit import *

# Common Geometry Types
POINT = "POINT";
MULTIPOINT = "MULTIPOINT";
LINESTRING = "LINESTRING";
MULTILINESTRING = "MULTILINESTRING";
POLYGON = "POLYGON";
POLYGON_ROTATION = "POLYGON_ROTATION"
MULTIPOLYGON = "MULTIPOLYGON"
MULTIPOLYGON_ROTATION = "MULTIPOLYGON_ROTATION"
SPHERE = "MULTIPOLYGON_SPHERE"
GEOMETRYCOLLECTION = "GEOMETRYCOLLECTION";

# The inputs to this node will be stored as a list in the IN variables.
NUM_MULTIPOLYGON = 10
NUM_POLYGON = 10
NUM_LINESTRING = 10
NUM_POINT = 10

# Input 
json_file = IN[0]
switch_generator = IN[1]

# output container
geo_lst = []

geo_pt_lst = []
geo_li_lst = []
geo_pol_lst = []
geo_mPol_lst = []
geo_sph_lst = []

geo_combi_lst = []


if switch_generator == False:
    OUT = []

for geo_name, geo_data in json_file.items():
    
    if ( geo_name.find('POINT') != -1 or
        geo_name.find('Point') != -1 ):

        pt_data = geo_data
        pt_x = 0.0
        pt_y = 0.0
        pt_z = 0.0
        if (len(pt_data) == 3): # (x, y, z)
            pt_x = pt_data[0]
            pt_y = pt_data[1]
            pt_z = pt_data[2]
            
        if (len(pt_data) == 2): # (x, y)
            pt_x = pt_data[0]
            pt_y = pt_data[1]
            pt_z = 0.0
            
        pt = Point.ByCoordinates(pt_x, pt_y, pt_z)

        geo_data = pt
        geo_name = geo_name.upper()
        geo_type = 'POINT'
        geometry = pt

        geo_pt_obj = (geo_data, geo_name, geo_type, geometry)
        geo_pt_lst.append(geo_pt_obj)
        continue

    if ( geo_name.find('LINESTRING') != -1 or
        geo_name.find('Linestring') != -1 or
        geo_name.find('LINE') != -1 or
        geo_name.find('Line') != -1 ):

        pt_lst = []
        for pt_data in geo_data[0]:
            pt = Point.ByCoordinates(pt_data[0], pt_data[1], pt_data[2])
            pt_lst.append(pt)

        geo_data = pt_lst
        geo_name = geo_name.upper()
        geo_type = 'LINESTRING'
        geometry = PolyCurve.ByPoints(pt_lst, False)

        geo_li_obj = (geo_data, geo_name, geo_type, geometry)
        geo_li_lst.append(geo_li_obj)
        continue

    if ( geo_name.find('SPHERE') != -1 or
        geo_name.find('Sphere') != -1 ):

        face_lst = []
        for face_data in geo_data:

            pt_lst = []
            for vert_data in face_data:
                pt = Point.ByCoordinates(vert_data[0], vert_data[1], vert_data[2])
                pt_lst.append(pt)
            face = Surface.ByPerimeterPoints(pt_lst)
            face_lst.append(face)

        geo_data = face_lst
        geo_name = geo_name.upper()
        geo_type = 'MULTIPOLYGON_SPHERE'
        geometry = face_lst

        geo_sph_obj = (geo_data, geo_name, geo_type, geometry)
        geo_sph_lst.append(geo_sph_obj)
        continue

    if ( geo_name.find('MULTIPOLYGON') != -1 or
        geo_name.find('Multipolygon') != -1  or
        geo_name.find('CUBE') != -1 or
        geo_name.find('Cube') != -1 ):

        face_lst = []
        for face_data in geo_data:

            pt_lst = []
            for vert_data in face_data:
                pt = Point.ByCoordinates(vert_data[0], vert_data[1], vert_data[2])
                pt_lst.append(pt)
                # print()
            face = Surface.ByPerimeterPoints(pt_lst)
            # face = []
            face_lst.append(face)

        geo_data = face_lst
        geo_name = geo_name.upper()
        geo_type = 'MULTIPOLYGON'
        geometry = face_lst

        geo_mPol_obj = (geo_data, geo_name, geo_type, geometry)
        geo_mPol_lst.append(geo_mPol_obj)
        continue

    if ( geo_name.find('POLYGON') != -1 or 
        geo_name.find('Polygon') != -1 ):
        
        pt_lst = []
        for vert_data in geo_data[0]:
            pt = Point.ByCoordinates(vert_data[0], vert_data[1], vert_data[2])
            pt_lst.append(pt)
            # print()
        face = Surface.ByPerimeterPoints(pt_lst)
        face = []

        geo_data = pt_lst
        geo_name = geo_name.upper()
        geo_type = 'POLYGON'
        geometry = Surface.ByPerimeterPoints(pt_lst)
        # geometry = geo_data

        geo_pol_obj = (geo_data, geo_name, geo_type, geometry)
        geo_pol_lst.append(geo_pol_obj)
        continue

    
geo_combi_lst = geo_pt_lst + geo_li_lst + geo_pol_lst + geo_mPol_lst + geo_sph_lst

######################### Output ############################
OUT = geo_combi_lst
# ----------------------------------------
watch_5 = Watch(geometry_generator)
on_off_import = BoolSelector(false)
file_path_3 = Filename("..\..\..\..\..\..\..\resources\rdf\example.rdf")
fileExists = FileSystem.FileExists(path=file_path_3)
watch_6 = Watch(file_path_3)
rdf_parser = Python(IN[0]=fileExists, IN[1]=watch_6)  # CPython3
# ---------- rdf_parser.python (127 lines) ----------
# Load the Python Standard and DesignScript Libraries
import sys
import clr
import ctypes
import xml.etree.ElementTree as ET
sys.path.append(r"C:\Users\yhe\AppData\Local\Programs\Python\Python310\Lib\site-packages")

clr.AddReference('ProtoGeometry')
from Autodesk.DesignScript.Geometry import *
from xml.dom.minidom import parse, parseString

#dir = "r'C:\\Users\\nobita_yhe\\Workspace\\ExtendingJena\\src\\main\\resources\\rdf\\query_result.xml'"
#dir = r'C:\Users\nobita_yhe\Workspace\ExtendingJena\src\main\resources\rdf\query_result.xml'
warn_str = 'File or File Path does not exist.'
res = ''
######################################################

def rdfParsing2GeoData(path=dir):
    """ it returns the json file in structure like { "POLYGON1" : [...], 
                                                     "POLYGON2" : [...], 
                                                     "MULTIPOLYGON1" : [...], ...
                                                    }
    """
    geo_dict = {}
    dom = parse(path)
    data = dom.documentElement
    rdf_desc_lst = data.getElementsByTagName("rdf:Description")
    # geo_in_wkt = data.getElementsByTagName("geo:asWKT")

    for i in range(1, len(rdf_desc_lst)): # first description element (root element) should be removed.
        descr_el = rdf_desc_lst[i]
        geo_name_num = descr_el.attributes._attrs['rdf:about'].nodeValue.split('#')[1]
        geo_wkt_data = ""
        try:
            geo_wkt_data = descr_el.childNodes[0].firstChild.data
        except:
            geo_wkt_data = descr_el.childNodes[1].firstChild.data
        geo_algebra_lst = []

        if ( geo_name_num.find('POINT') != -1 or
            geo_name_num.find('Point') != -1 ):
            
            wkt_data_lst = geo_wkt_data.split("(")[1] # remove title 'POINT'
            vert_str_lst = wkt_data_lst
            vert_str_lst = vert_str_lst.replace( ")", "" ) # remove character ')'

            pt_algebra_lst = []
            pt_str_lst = vert_str_lst.split(" ")

            pt_algebra_lst = [ float(pt_str) for pt_str in pt_str_lst ]
            geo_algebra_lst.append(pt_algebra_lst)
            
        if ( geo_name_num.find('LINESTRING') != -1 or
            geo_name_num.find('Linestring') != -1 or
            geo_name_num.find('LINE') != -1 or
            geo_name_num.find('Line') != -1 ):

            wkt_data_lst = geo_wkt_data.split("((")[1] # remove title 'LINESTRING'
            vert_str_lst = wkt_data_lst
            vert_str_lst = vert_str_lst.replace( ")", "" ) # remove character ')'
            vert_str_lst = vert_str_lst.split(", ")

            line_algebra_lst = []
            for i in range(0, len(vert_str_lst)):

                pt_str_lst = vert_str_lst[i].split(" ")
                line_algebra_lst.append([ float(pt_str) for pt_str in pt_str_lst ])
            geo_algebra_lst.append(line_algebra_lst)

        if ( geo_name_num.find('POLYGON') != -1 or 
            geo_name_num.find('Polygon') != -1 ):

            wkt_data_lst = geo_wkt_data.split("((")[1] # remove title 'POLYGON Z'
            vert_str_lst = wkt_data_lst
            vert_str_lst = vert_str_lst.replace( ")", "" ) # remove character ')'
            vert_str_lst = vert_str_lst.replace( "(", "" ) # remove character '('
            vert_str_lst = vert_str_lst.split(", ")

            face_algebra_lst = []
            for i in range(0, len(vert_str_lst)-1): # last point not included

                pt_str_lst = vert_str_lst[i].split(" ")
                face_algebra_lst.append([ float(pt_str) for pt_str in pt_str_lst ])
            geo_algebra_lst.append(face_algebra_lst)

        if ( geo_name_num.find('MULTIPOLYGON') != -1 or
            geo_name_num.find('Multipolygon') != -1  or
            geo_name_num.find('CUBE') != -1 or
            geo_name_num.find('Cube') != -1 or
            geo_name_num.find('SPHERE') != -1 or
            geo_name_num.find('Sphere') != -1 ):

            wkt_data_lst = geo_wkt_data.split("(((")[1] # remove title 'MULTIPOLYGON Z'
            face_str_lst = wkt_data_lst.split("), ")

            face_algebra_lst = []
            for face_str in face_str_lst:
                vert_str_lst = face_str.replace( ")", "" ) # remove character ')'
                vert_str_lst = vert_str_lst.replace( "(", "" ) # remove character '('
                vert_str_lst = vert_str_lst.split(", ")

                pt_algebra_lst = []
                for i in range(0, len(vert_str_lst)-1): # last point not included

                    pt_str_lst = vert_str_lst[i].split(" ")
                        
                    pt_algebra = [ float(pt_str) for pt_str in pt_str_lst ]
                    pt_algebra_lst.append(pt_algebra)

                face_algebra_lst.append(pt_algebra_lst)
            geo_algebra_lst = face_algebra_lst

        if geo_name_num not in geo_dict.keys():
            geo_dict[geo_name_num] = geo_algebra_lst
    return geo_dict
    
######################################################

if IN[0] == True:
    dir = IN[1]
    json_file = rdfParsing2GeoData(dir)
else:
	ctypes.windll.user32.MessageBoxW(0, warn_str, 'Input Exception',1)
	res = warn_str
######################################################
# Assign your output to the OUT variable.
OUT = json_file
# ----------------------------------------
switcher_2 = CodeBlock(SW=on_off_import, data=rdf_parser) { SW == "True"? data : null; }
json_viewer_2 = Watch(switcher_2)
json_writer = Python(IN[0]=switcher_2, IN[1]=on_off_import)  # CPython3
# ---------- json_writer.python (24 lines) ----------
# Load the Python Standard and DesignScript Libraries
import sys
import clr
import json
clr.AddReference('ProtoGeometry')
from Autodesk.DesignScript.Geometry import *

dir = "C:\\Users\\yhe\\Documents\\Developer\\Repo\\ExtendingJena\\src\\main\\resources\\JSON\\xxl3DScene.json"

json_file = IN[0]
switch_writer = IN[1]

res = True

if switch_writer:
    try: 
        with open(dir, 'w') as fp:
            json.dump(json_file, fp, sort_keys=True, indent=4)
    except:
        res = False
else:
    res = False
    
OUT = res
# ----------------------------------------
watch_7 = Watch(json_writer)

# group: XML(query result) Import and Parsing
on_off_import_2 = BoolSelector(false)
file_path_4 = Filename("..\..\..\..\..\..\..\resources\rdf\query_result.xml")
fileExists_2 = FileSystem.FileExists(path=file_path_4)
watch_8 = Watch(file_path_4)
xml_parser = Python(IN[0]=fileExists_2, IN[1]=watch_8)  # CPython3
# ---------- xml_parser.python (88 lines) ----------
# Load the Python Standard and DesignScript Libraries
import sys
import clr
import ctypes
import xml.etree.ElementTree as ET
sys.path.append(r"C:\Users\yhe\AppData\Local\Programs\Python\Python310\Lib\site-packages")

clr.AddReference('ProtoGeometry')
from Autodesk.DesignScript.Geometry import *
from xml.dom.minidom import parse, parseString

#dir = "r'C:\\Users\\nobita_yhe\\Workspace\\ExtendingJena\\src\\main\\resources\\rdf\\query_result.xml'"
#dir = r'C:\Users\nobita_yhe\Workspace\ExtendingJena\src\main\resources\rdf\query_result.xml'
warn_str = 'File or File Path does not exist.'
res = ''
######################################################

def xmlParsing2Uri(path=dir):
    """ it returns the list in structure like [[uri1, uri2],...,[uri1, uri2]]"""
    dom = parse(path)
    data = dom.documentElement
    resList = data.getElementsByTagName('result')
    
    res_lst = []
    for res in resList: # handle the <result>...</result>
        ur_lst = []
        for bi in res.getElementsByTagName('binding'): # handle the <binding>...</binding>
            for ur in bi.getElementsByTagName('uri'):
                ur_lst.append(ur.childNodes[0].nodeValue)
        res_lst.append(ur_lst)
        ur_lst = []
    return res_lst


def xml2GeometryString(path=dir):
    """ it returns the list in structure like [[Geomety1, Geomety2],...,[Geomety1, Geomety2]]"""
    dom = parse(path)
    data = dom.documentElement
    resList = data.getElementsByTagName('result')
    seperator = '#'

    res_lst = []
    for res in resList: # handle the <result>...</result>
        ur_lst = []
        for bi in res.getElementsByTagName('binding'): # handle the <binding>...</binding>
            for ur in bi.getElementsByTagName('uri'):
                uri_str = ur.childNodes[0].nodeValue
                geo_index = uri_str.find(seperator) 
                geo_str = uri_str[geo_index+1:]
                ur_lst.append(geo_str)
        res_lst.append(ur_lst)
        ur_lst = []
    return res_lst

def xml2GeoInDynamo(path=dir):
    #with open(r'C:\Users\nobita_yhe\Workspace\ExtendingJena\src\main\resources\rdf\query_result.xml', 'r', encoding='utf-8') as file:
    with open(path, 'r', encoding='utf-8') as file:
        xml_data = file.read()
        dom = parseString(xml_data)
        #dom = parse(xml_data)
        data = dom.documentElement
        resList = data.getElementsByTagName('result')
        seperator = '#'
        
        res_lst = []
        for res in resList: # handle the <result>...</result>
            ur_lst = []
            for bi in res.getElementsByTagName('binding'): # handle the <binding>...</binding>
                for ur in bi.getElementsByTagName('uri'):
                    uri_str = ur.childNodes[0].nodeValue
                    geo_index = uri_str.find(seperator) 
                    geo_str = uri_str[geo_index+1:]
                    ur_lst.append(geo_str)
            res_lst.append(ur_lst)
            ur_lst = []
    return res_lst
    
######################################################

if IN[0] == True:
    dir = IN[1]
    res = xml2GeoInDynamo(dir)
else:
	ctypes.windll.user32.MessageBoxW(0, warn_str, 'Input Exception',1)
	res = warn_str
######################################################
# Assign your output to the OUT variable.
OUT = res
# ----------------------------------------
switcher_3 = CodeBlock(SW=on_off_import_2, data=xml_parser) { SW == "True"? data : null; }
query_result_viewer = Watch(switcher_3)

code_block_5 = CodeBlock {  }

# group: Geometry Selection
selection_board = CodeBlock()
# ---------- selection_board.designscript (11 lines) ----------
POINT = "POINT";
MULTIPOINT = "MULTIPOINT";
LINESTRING = "LINESTRING";
MULTILINESTRING = "MULTILINESTRING";
POLYGON = "POLYGON";
MULTIPOLYGON = "MULTIPOLYGON";
MULTIPOLYGON_ROTATION = "MULTIPOLYGON_ROTATION";
SPHERE = "MULTIPOLYGON-SPHERE";
GEOMETRYCOLLECTION = "GEOMETRYCOLLECTION";
geo_sel_lst=
["MULTIPOLYGON5"];
# ----------------------------------------
on_off_2 = BoolSelector(false)
geometry_selector = Python(IN[1]=selection_board.geo_sel_lst, IN[2]=on_off_2)  # CPython3; unwired: IN[0]
# ---------- geometry_selector.python (45 lines) ----------
# Load the Python Standard and DesignScript Libraries
import sys
import clr
clr.AddReference('ProtoGeometry')
from Autodesk.DesignScript.Geometry import *
clr.AddReference('DSCoreNodes')
from DSCore import *
clr.AddReference('GeometryColor')
from Modifiers import GeometryColor

# Input
geo_lst = IN[0]
geo_sel_lst = IN[1]
switch = IN[2]


def inList(geo_sel_lst, geo):
    res = False
    for geo_sel in geo_sel_lst:
        if geo_sel is None:
            break
        if geo_sel.upper() == geo.upper():
            res = True
            break
    return res
#################################################
# Highlighter
colored_geo_lst = []
if switch:
    color = Color.ByARGB(138,43,226,0) # violet
    for geo in geo_lst:
        geo_name = geo[1]
        if inList(geo_sel_lst, geo_name):  
            geo_data = geo[0]
            colored_geo = ''
            if (geo[2].upper() == "LINESTRING" 
            or geo[2].upper() == "POLYGON" 
            or geo[2].upper() == "MULTIPOLYGON_ROTATION"):
                colored_geo = GeometryColor.ByGeometryColor(geo[3], color)
            else:
                colored_geo = GeometryColor.ByGeometryColor(geo_data, color)
            colored_geo_lst.append(colored_geo)

#################################################
OUT = colored_geo_lst
# ----------------------------------------
watch_3d_2 = Watch3D(geometry_selector)
watch_9 = Watch(watch_3d_2)

code_block_6 = CodeBlock { Point.ByCoordinates(20, 20, 0); "text"; "String"; }
textNoteByPointAndDo = Custom[TextNoteByPointAndDo](point=code_block_6.out0, content=code_block_6.out1, textType=code_block_6.out2)  # package TextNoteByPointAndDo; Places a text note at a given point in the view. View, text type and content can either be a single item for all points or the same length as the number of points. Set track to false if you'd like to place notes on every run. Has Do option; unwired: view

# group: Geometry Validator
on_off_3 = BoolSelector(false)
python_script = Python(IN[0]=on_off_3)  # CPython3
# ---------- python_script.python (111 lines) ----------
import sys
import clr
clr.AddReference('ProtoGeometry')
from Autodesk.DesignScript.Geometry import *
clr.AddReference('DSCoreNodes')
from DSCore import *
clr.AddReference('GeometryColor')
from Modifiers import GeometryColor

switch = IN[0]
val_lst = []

################## point ####################
#pt_T1 = [Point.ByCoordinates(-9.9367610954, 10.2776839486, 2.9789203651), Point.ByCoordinates(-10.8388482396, 10.5084124645, 3.0356427683)]
#pt_T2 = [Point.ByCoordinates(-8.8510906952, 10, 2.9106544171), Point.ByCoordinates(-5.3451005024, 9.1032663317, 2.6902010049)]

pt_T1 = [GeometryColor.ByGeometryColor(
        Point.ByCoordinates(-10.0021246192, 3.602549543, 0), 
        Color.ByARGB(255,255,0,0))]
"""
pt_T2 = [GeometryColor.ByGeometryColor(
        Point.ByCoordinates(-8.8510906952, 10, 2.9106544171), 
        Color.ByARGB(0, 0, 255,0)),      
        GeometryColor.ByGeometryColor(
        Point.ByCoordinates(-5.3451005024, 9.1032663317, 2.6902010049), 
        Color.ByARGB(0, 0, 255,0))]
"""         
pt_lst = [pt_T1]
val_lst.append(pt_lst) 

#colored_pt = GeometryColor.ByGeometryColor(pt, Color.ByARGB(255,255,0,0))
#val_lst.append(colored_pt)   
#############################################

################## plane ####################
pl_A = Plane.ByThreePoints(
                            Point.ByCoordinates(-7.362129778782238, 4.457707263472535,           2.120709926260745),
                            Point.ByCoordinates(-10.168645983334033, 10.801861772729085, 3.05621532777801),
                            Point.ByCoordinates(-12.915677008332986, 9.599069113635458, 2.971892336110995)
                            )
                            
pl_B = Plane.ByThreePoints(Point.ByCoordinates(-4.0, 10.0, 0.0),
                            Point.ByCoordinates(-9.0, 10.0, 3.0),
                            Point.ByCoordinates(-7.0, 8.0, 6.0))
                            
#val_lst.append([pl_A, pl_B])                          
#############################################

############### multipolygon ################
"""
pt_face1 = [
(-7.362129778782238, 4.457707263472535, 2.120709926260745),
(-10.168645983334033, 10.801861772729085, 3.05621532777801), 
(-12.915677008332986, 9.599069113635458, 2.971892336110995), 
(-10.109160803781192, 3.254914604378909, 2.03638693459373)]

pt_face2 = [
(-10.252968975001048, 11.202792659093626, 0.08432299166701496),
(-7.446452770449254, 4.858638149837077, -0.8511824098502498),
(-10.193483795448207, 3.6558454907434506, -0.9355054015172648),
(-13.000000000000002, 10.0, 0.0)]
"""
pt_face3 = [
(-10.109160803781192, 3.254914604378909, 2.03638693459373), 
(-10.193483795448207, 3.6558454907434506, -0.9355054015172648), 
(-7.446452770449254, 4.858638149837077, -0.8511824098502498),
(-7.362129778782238, 4.457707263472535, 2.120709926260745)]

pt_face4 = [
(-12.915677008332986, 9.599069113635458, 2.971892336110995), 
(-13.000000000000002, 10.0, 0.0), 
(-10.193483795448207, 3.6558454907434506, -0.9355054015172648), 
(-10.109160803781192, 3.254914604378909, 2.03638693459373)]
"""
pt_face5 = [
(-10.168645983334033, 10.801861772729085, 3.05621532777801), 
(-10.252968975001048, 11.202792659093626, 0.08432299166701496), 
(-13.000000000000002, 10.0, 0.0),
(-12.915677008332986, 9.599069113635458, 2.971892336110995)]

pt_face6 = [
(-7.362129778782238, 4.457707263472535, 2.120709926260745), 
(-7.446452770449254, 4.858638149837077, -0.8511824098502498),
(-10.252968975001048, 11.202792659093626, 0.08432299166701496),
(-10.168645983334033, 10.801861772729085, 3.05621532777801)]
"""
pt_face_lst = [pt_face3, pt_face4]
poly_lst = []

for pt_face in pt_face_lst:
    pol_pt_lst =[]
    for pt in pt_face:
        pol_pt_lst.append(Point.ByCoordinates(pt[0], pt[1], pt[2]))
    poly_lst.append(Surface.ByPerimeterPoints(pol_pt_lst))
        
val_lst.append(poly_lst)     
#############################################

############## linestring ##################
pt_lst =   [Point.ByCoordinates(-7, 0, 0),
            Point.ByCoordinates(-12, 6, 0)]

line_string = PolyCurve.ByPoints(pt_lst, False)
colored_line_string = GeometryColor.ByGeometryColor(line_string, Color.ByARGB(255,255,0,0))
val_lst.append(colored_line_string)  
#############################################

if switch :
    OUT = val_lst
else:
    OUT = []
# ----------------------------------------
watch_3d_3 = Watch3D(python_script)

on_off_groundtruth = BoolSelector(false)

# group: Highlight of Query Result + Groundtruth
on_off_query_result = BoolSelector(true)
geometry_highlighter = Python(IN[0]=watch_5, IN[1]=query_result_viewer, IN[2]=on_off_query_result)  # CPython3
# ---------- geometry_highlighter.python (62 lines) ----------
# Load the Python Standard and DesignScript Libraries
import sys
import clr
clr.AddReference('ProtoGeometry')
from Autodesk.DesignScript.Geometry import *
clr.AddReference('DSCoreNodes')
from DSCore import *
clr.AddReference('GeometryColor')
from Modifiers import GeometryColor

###########################################################
def flatten(inp_lst):
# Core: 
#		1. traverse the input list 
#		2. concatenate each two adjacent elements 
#		3. store the concatenation into the output list
#		4. remove the non-list element out of the input list
    out_lst = []
    while True:
        if inp_lst == []:
            break
        for ind, val in enumerate(inp_lst):
            if type(val) == list:
                inp_lst = val + inp_lst[ind+1:]
                break
            else:
                out_lst.append(val)
                inp_lst.pop(ind)
                break
    return out_lst

def inList(res_lst, geo):
    flat_lst = flatten(res_lst)
    res = False
    
    for e in flat_lst:
        if e is None:
            break
        if geo.upper() == e.upper():
            res = True
            break
    return res
############################################################
# Input
geo_lst = IN[0]
res_lst = IN[1]
switch = IN[2]

#################################################
# Highlighter
colored_geo_lst = []
if switch:
    color = Color.ByARGB(255,255,0,0) # red
    
    for geo in geo_lst:
        geo_name = geo[1]
        if inList(res_lst, geo_name):  
            colored_geo = GeometryColor.ByGeometryColor(geo[3], color)
            colored_geo_lst.append(colored_geo)

#################################################
OUT = colored_geo_lst
# ----------------------------------------
watch_3d_4 = Watch3D(geometry_highlighter)
groundtruth = Python(IN[0]=watch_5, IN[1]=on_off_groundtruth)  # CPython3
# ---------- groundtruth.python (75 lines) ----------
import sys
import clr
import itertools
clr.AddReference('ProtoGeometry')
from Autodesk.DesignScript.Geometry import *
clr.AddReference('DSCoreNodes')
from DSCore import *
clr.AddReference('GeometryColor')
from Modifiers import GeometryColor

#================= Help Function ====================
def getGeometry(geo_obj):
    return geo_obj[3]

#================= Input ====================
geo_lst = IN[0]
switch = IN[1]

#================= Body ====================
inter_geo_lst = []

"""
comparison algorithnm:

geo_obj_1 in lst start from 0 to n-1
    geo_obj_2 in lst start from 1 to n
lst remove geo_obj_1
"""
color = Color.ByARGB(230,230,250,0)
for i in range(0, len(geo_lst)-1):
    geo_obj_1 = geo_lst[i]
    geometry_1 = getGeometry(geo_obj_1)
    temp_lst = []

    geo_obj_1_has_intersection = False
    for j in range(1, len(geo_lst)):
        geo_obj_2 = geo_lst[j]
        geometry_2 = getGeometry(geo_obj_2)

        if Geometry.DoesIntersect(geometry_1, geometry_2):
            geo_obj_1_has_intersection = True
            
            colored_geometry_2 = GeometryColor.ByGeometryColor(geometry_2, color)
            temp_lst.append(colored_geometry_2)
    
    if geo_obj_1_has_intersection:
        colored_geometry_1 = GeometryColor.ByGeometryColor(geometry_1, color)
        temp_lst.append(colored_geometry_1)
    
    inter_geo_lst.append(temp_lst)

# remove duplicated from list 
output_lst = [] 
for geometry in inter_geo_lst: 
    if geometry not in output_lst: 
        output_lst.append(geometry) 
        
#output_lst = itertools.groupby(inter_geo_lst) # remove the duplicate(s)
#output_lst = inter_geo_lst

#================= Coloring ====================
"""
color = Color.ByARGB(230,230,250,0)
colored_output_lst = []

for geometry_lst in output_lst:
    temp_lst
    for geometry in geometry_lst:
        
        colored_geo = GeometryColor.ByGeometryColor(geometry, color)
        temp_lst
    colored_output_lst.append(colored_geo)
"""
#================= Output ====================
OUT = output_lst
# ----------------------------------------
watch_3d_5 = Watch3D(groundtruth)
