# Dynamo graph 100PipelineXXLGenerator.dyn (Dynamo 2.8.0.2471)

# group: Geometric Data Generation
rdf_prefixes = CodeBlock()
# ---------- rdf_prefixes.designscript (27 lines) ----------
rdf="http://www.w3.org/1999/02/22-rdf-syntax-ns#";
owl="http://www.w3.org/2002/07/owl#";
ogc="http://www.opengis.net/";
my="https://www.inf.bi.ruhr-uni-bochum.de/jena/#";
gml="http://www.opengis.net/ont/gml#";
geo="http://www.opengis.net/ont/geosparql#";
geof="http://www.opengis.net/def/function/geosparql/";
rdfs="http://www.w3.org/2000/01/rdf-schema#";
uom="http://www.opengis.net/def/uom/OGC/1.0/";
sf="http://www.opengis.net/ont/sf#";
xsd="http://www.w3.org/2001/XMLSchema#";
geor="http://www.opengis.net/def/rule/geosparql/";

namespaces = {
	"rdf" : rdf,
	"owl" : owl,
	"ogc" : ogc,
	"my" : my,
	"gml" : gml,
	"geo" : geo,
	"geof": geof,
	"rdfs": rdfs,
	"uom": uom,
	"sf": sf,
	"xsd": xsd,
	"geor": geor
};
# ----------------------------------------
number_of_standard_geometry = CodeBlock { num_lineString = 10; num_polygon = 30; num_multipolygon = 30; }
random_geometry_generator = Python(IN[0]=number_of_standard_geometry.num_lineString, IN[1]=number_of_standard_geometry.num_polygon, IN[2]=number_of_standard_geometry.num_multipolygon)  # CPython3
# ---------- random_geometry_generator.python (239 lines) ----------
# Load the Python Standard and DesignScript Libraries
import sys
import clr
import random
import pickle
clr.AddReference('ProtoGeometry')
from Autodesk.DesignScript.Geometry import *
clr.AddReference('DSCoreNodes')
from DSCore import *
clr.AddReference('GeometryColor')
from Modifiers import GeometryColor
clr.AddReference('MeshToolkit')
from Autodesk.Dynamo.MeshToolkit import *

# Common Geometry Types
POINT = "POINT";
MULTIPOINT = "MULTIPOINT";
LINESTRING = "LINESTRING";
MULTILINESTRING = "MULTILINESTRING";
POLYGON = "POLYGON";
POLYGON_ROTATION = "POLYGON_ROTATION"
MULTIPOLYGON = "MULTIPOLYGON"
MULTIPOLYGON_ROTATION = "MULTIPOLYGON_ROTATION"
SPHERE = "MULTIPOLYGON_SPHERE"
GEOMETRYCOLLECTION = "GEOMETRYCOLLECTION";

# The inputs to this node will be stored as a list in the IN variables.
NUM_MULTIPOLYGON = 10
NUM_POLYGON = 10
NUM_LINESTRING = 10
NUM_POINT = 10

# Input 
NUM_POINT = 0
NUM_LINESTRING = IN[0]
NUM_POLYGON = IN[1]
NUM_MULTIPOLYGON = IN[2]
NUM_SPHERE = 0
# output container
geo_lst = []

geo_pt_lst = []
geo_li_lst = []
geo_pol_lst = []
geo_mPol_lst = []
geo_sph_lst = []

geo_combi_lst = []
    
################### Polygon #######################
NUM_TRIANGLE = 1
NUM_RECTANGLE = 1
pol_index = 1

if NUM_POLYGON >= 3:
   # NUM_TRIANGLE = round(NUM_POLYGON/2)
    NUM_TRIANGLE = NUM_POLYGON
    NUM_RECTANGLE = NUM_POLYGON - NUM_TRIANGLE

# random triangle(s)
for i in range(0, NUM_TRIANGLE):
    pt_lst = []
    
    x_axis_lst = random.sample(range(-10, 10, 2), 3)
    y_axis_lst = random.sample(range(-10, 10, 2), 3)
    z_axis_lst = random.sample(range(-10, 10, 2), 3)
    
    offset_lst = random.sample(range(-50, 50, 2), 3)
    
    pt_lst = [Point.ByCoordinates(x_axis_lst[0] + offset_lst[0], y_axis_lst[0] + offset_lst[1], z_axis_lst[0] + offset_lst[2]),
              Point.ByCoordinates(x_axis_lst[1] + offset_lst[0], y_axis_lst[1] + offset_lst[1], z_axis_lst[1] + offset_lst[2]), 
              Point.ByCoordinates(x_axis_lst[2] + offset_lst[0], y_axis_lst[2] + offset_lst[1], z_axis_lst[2] + offset_lst[2])]

    geo_data = pt_lst
    geo_name = POLYGON + str(pol_index)
    geo_type = POLYGON
    geometry = Surface.ByPerimeterPoints(pt_lst)

    geo_obj_pol = (geo_data, geo_name, geo_type, geometry)
    
    geo_pol_lst.append(geo_obj_pol)
    pol_index += 1

# random rectangle(s)
"""
for i in range(0, NUM_RECTANGLE):
    pt_lst = []
    
    x_axis_lst = random.sample(range(-10, 10, 2), 4)
    y_axis_lst = random.sample(range(-10, 10, 2), 4)
    z_axis_lst = random.sample(range(-10, 10, 2), 4)
    
    offset_lst = random.sample(range(-50, 50, 2), 3)
    
    pt_lst = [Point.ByCoordinates(x_axis_lst[0] + offset_lst[0], y_axis_lst[0] + offset_lst[1], z_axis_lst[0] + offset_lst[2]),
              Point.ByCoordinates(x_axis_lst[1] + offset_lst[0], y_axis_lst[1] + offset_lst[1], z_axis_lst[1] + offset_lst[2]), 
              Point.ByCoordinates(x_axis_lst[2] + offset_lst[0], y_axis_lst[2] + offset_lst[1], z_axis_lst[2] + offset_lst[2]),
              Point.ByCoordinates(x_axis_lst[3] + offset_lst[0], y_axis_lst[3] + offset_lst[1], z_axis_lst[3] + offset_lst[2])]

    geo_data = pt_lst
    geo_name = POLYGON + str(pol_index)
    geo_type = POLYGON
    geometry = Surface.ByPerimeterPoints(pt_lst)
    
    geo_obj_pol = (geo_data, geo_name, geo_type, geometry)

    geo_pol_lst.append(geo_obj_pol)
    pol_index += 1
"""
###################### Multi-Polygon ##########################
mPol_index = 1

# random cube(s)
for i in range(0, NUM_MULTIPOLYGON):
    """
    corner pt 1 : (x, y, z)
    corner pt 2 : (x+l, y+l, z+l)
    """
    pt_lst = []
    is_rotated = random.randint(0,1)
    x_axis = random.randint(-10, 10)
    y_axis = random.randint(-10, 10)
    z_axis = random.randint(-10, 10)
    l = random.randint(1, 8)
    
    offset_lst = random.sample(range(-50, 50, 2), 3)
    p1 = Point.ByCoordinates(x_axis + offset_lst[0], 
                             y_axis + offset_lst[1], 
                             z_axis + offset_lst[2])
                             
    p2 = Point.ByCoordinates(x_axis + l + offset_lst[0], 
                             y_axis + l + offset_lst[1], 
                             z_axis + l + offset_lst[2])
    
    geometry = Cuboid.ByCorners(p1, p2)
    geo_data = geometry
    geo_name = MULTIPOLYGON + str(mPol_index)
    geo_type = MULTIPOLYGON
    
    if is_rotated == 0:
        old_cs = CoordinateSystem.Identity()
        new_cs = CoordinateSystem.Identity()
        new_cs2 = new_cs.Rotate(Point.ByCoordinates(random.randint(-10, 10), random.randint(-10, 10), random.randint(-10, 10)),
                                Vector.ByCoordinates(random.randint(-10, 10), random.randint(-10, 10), random.randint(-10, 10)), 
                                random.randint(0, 360))
        geometry = geometry.Transform(old_cs, new_cs2)
        
        geo_data = geometry.Faces
        geo_name = MULTIPOLYGON + str(mPol_index)
        geo_type = MULTIPOLYGON_ROTATION
    
    geo_obj_mPol = (geo_data, geo_name, geo_type, geometry)
    geo_mPol_lst.append(geo_obj_mPol)
    mPol_index += 1
    
    
# random sphere(s)
for i in range(0, NUM_SPHERE):
    
    x_axis = random.randint(-10, 10)
    y_axis = random.randint(-10, 10)
    z_axis = random.randint(-10, 10)
    offset_lst = random.sample(range(-50, 50, 2), 3)    
    
    centroid_pt = Point.ByCoordinates(x_axis + offset_lst[0], 
                                     y_axis + offset_lst[1], 
                                     z_axis + offset_lst[2])
    
    rand_radius = random.randint(1, 7)
    
    geometry = Sphere.ByCenterPointRadius(centroid_pt, radius = rand_radius)

    sphere_mesh = Mesh.ByGeometry(geometry)
    mesh_lst = Mesh.Explode(sphere_mesh)
    mesh_vert_lst = []
    for mesh in mesh_lst:
        mesh_vert_lst.append(Mesh.Vertices(mesh))
    
    # testing
    geo_data = mesh_vert_lst
    #geo_data = ""
    geo_name = MULTIPOLYGON + str(mPol_index)
    geo_type = SPHERE
    geo_obj_sph = (geo_data, geo_name, geo_type, geometry)
    geo_sph_lst.append(geo_obj_sph)
    mPol_index += 1
###################### LineString ###########################
li_index = 1

# random LineString(s)
pt_lst= []
for i in range(0, NUM_LINESTRING): # random number of line strings

    rand_length = random.randint(1,3) # random length of line strings
    for j in range(0, rand_length):
        x_axis = random.randint(-50, 50)
        y_axis = random.randint(-50, 50)
        z_axis = random.randint(-50, 50)
        l = random.randint(1, 2)
        offset_lst = random.sample(range(-20, 20, 2), 3)
        
        pt_s = Point.ByCoordinates(x_axis + offset_lst[0], 
                                 y_axis + offset_lst[1], 
                                 z_axis + offset_lst[2])
        pt_e = Point.ByCoordinates(x_axis + l + offset_lst[0], 
                                 y_axis + l + offset_lst[1], 
                                 z_axis + l + offset_lst[2])
        pt_lst.append(pt_s)
        pt_lst.append(pt_e)

geo_data = pt_lst
geo_name = LINESTRING + str(li_index)
geo_type = LINESTRING
geometry = PolyCurve.ByPoints(pt_lst, False)
geo_obj_li = (geo_data, geo_name, geo_type, geometry)
geo_li_lst.append(geo_obj_li)
li_index += 1

#################### Case Study #############################

# (Multi)polygon <==> (Multi)polygon (incl. rotation)
case_mp_mp = []

# (Multi)polygon <==> LingString (incl. rotation)
case_mp_ls = []

# (Multi)polygon <==> Sphere (incl. rotation)
case_mp_sp = []

# Sphere <==> LingString
case_sp_ls = []

geo_combi_lst = geo_pt_lst + geo_li_lst + geo_pol_lst + geo_mPol_lst + geo_sph_lst

#with open("C:\\Users\\yhe\\Documents\\Developer\\Repo\\ExtendingJena\\src\\main\\resources\\JSON\\geo_combi_lst.pickle", "w", encoding='utf-8') as fp:
    #pickle.dump(geo_combi_lst, fp)

######################### Output ############################
OUT = geo_combi_lst
# ----------------------------------------
wkt_converter = Python(IN[0]=random_geometry_generator, IN[1]=rdf_prefixes.my, IN[2]=rdf_prefixes.geo)  # CPython3
# ---------- wkt_converter.python (265 lines) ----------
# Load the Python Standard and DesignScript Libraries
import sys
import clr
clr.AddReference('ProtoGeometry')
from Autodesk.DesignScript.Geometry import *

# The inputs to this node will be stored as a list in the IN variables.
geo_lst = IN[0]
exampleInstanceNamespace = IN[1] # dataEnteringNode[3];
geoSparqlNamespace = IN[2] # dataEnteringNode[4];

def lineString2WKT(geo_data):
    wktLiteral = "<sf:LineString>";
    wktLiteral += "<rdf:Description rdf:about='" + exampleInstanceNamespace + str(name) + "'>";
    wktLiteral += "<geo:asWKT rdf:datatype='" + geoSparqlNamespace + "wktLiteral'>";
    wktLiteral += "LINESTRING Z((";
    
    points =  geo_data
    originP = points[0];
    
    wktLiteral += str(originP.X) + " " +  str(originP.Y) + " " +  str(originP.Z) # start point
    for i in range(1, len(points)):
        wktLiteral += ", " + str(points[i].X) + " " +  str(points[i].Y) + " " +  str(points[i].Z);       
    #wktLiteral += ", " + str(originP.X) + " " +  str(originP.Y) + " " +  str(originP.Z); # end point
    wktLiteral += "))"
    
    wktLiteral += "</geo:asWKT>";
    wktLiteral += "</rdf:Description>";
    wktLiteral += "</sf:LineString>";
    return wktLiteral
"""
def sphere2WKT(surface_lst):
    wktLiteral = "<sf:MultiPolygon>";
    wktLiteral += "<rdf:Description rdf:about='" + exampleInstanceNamespace + str(name) + "'>";
    wktLiteral += "<geo:asWKT rdf:datatype='" + geoSparqlNamespace + "wktLiteral'>";
    
    # for curves/surfaces
    wktLiteral += "MULTIPOLYGON Z(";
    for surface in surface_lst:
        wktLiteral += "((";
        try:
            curves = Surface.PerimeterCurves(surface);
        except:
            raise Exception("something wrong at geometry import!")
        startP = None;
        for curve in curves:
            nextP = curve.StartPoint;
            if(startP != None):
                wktLiteral += ", ";
            else:
                startP = nextP;
            wktLiteral += str(nextP.X) + " " +  str(nextP.Y) + " " +  str(nextP.Z);
        #Close the tiangle loop with a repeat of the first Point         
        wktLiteral += ", " + str(startP.X) + " " +  str(startP.Y) + " " +  str(startP.Z) + "))";
        if(surface != surface_lst[-1]):
            wktLiteral += ", "
    wktLiteral += ")"
    wktLiteral += "</geo:asWKT>";
    wktLiteral += "</rdf:Description>";
    wktLiteral += "</sf:MultiPolygon>";
    return wktLiteral
"""
def sphere2WKT(surface_lst):
    wktLiteral = "<sf:MultiPolygon>";
    wktLiteral += "<rdf:Description rdf:about='" + exampleInstanceNamespace + str(name) + "'>";
    wktLiteral += "<geo:asWKT rdf:datatype='" + geoSparqlNamespace + "wktLiteral'>";
    
    # for curves/surfaces
    face_wkt_lst = ""
    for vert_lst in surface_lst:
        
        vert_wkt_lst = "(("
        for vert in vert_lst:
        
            vert_wkt_lst += str(vert.X) + " " +  str(vert.Y) + " " +  str(vert.Z);
            if vert != vert_lst[-1]:
                vert_wkt_lst += ", "
        
        vert_wkt_lst += ", " + str(vert_lst[0].X) + " " +  str(vert_lst[0].Y) + " " +  str(vert_lst[0].Z) + "))";
        
        face_wkt_lst += vert_wkt_lst
        if vert_lst != surface_lst[-1]:
            face_wkt_lst += ", "          
            
    wktLiteral += "MULTIPOLYGON Z(";
    wktLiteral += face_wkt_lst
    wktLiteral += ")"
    wktLiteral += "</geo:asWKT>";
    wktLiteral += "</rdf:Description>";
    wktLiteral += "</sf:MultiPolygon>";
    return wktLiteral
    
    
def multipolygonInRotation2WKT(face_lst):
    wktLiteral = "<sf:MultiPolygon>";
    wktLiteral += "<rdf:Description rdf:about='" + exampleInstanceNamespace + str(name) + "'>";
    wktLiteral += "<geo:asWKT rdf:datatype='" + geoSparqlNamespace + "wktLiteral'>";
    face_wkt_lst = ""
    
    for face in face_lst:
        
        vertice_lst = face.Vertices
        org_vert_pt = vertice_lst[0].PointGeometry 
        face_wkt = "((" + str(org_vert_pt.X) + " " +  str(org_vert_pt.Y) + " " +  str(org_vert_pt.Z) # start point
    
        for i in range(1, len(vertice_lst)):
            vert_pt = vertice_lst[i].PointGeometry
            face_wkt += ", " + str(vert_pt.X) + " " +  str(vert_pt.Y) + " " +  str(vert_pt.Z)       
        face_wkt += ", " + str(org_vert_pt.X) + " " +  str(org_vert_pt.Y) + " " +  str(org_vert_pt.Z) + "))" # end point
        
        if(face != face_lst[-1]):
            face_wkt += ", "
        face_wkt_lst += face_wkt        
    
    wktLiteral += "MULTIPOLYGON Z("
    wktLiteral += face_wkt_lst
    wktLiteral += ")" 
    wktLiteral += "</geo:asWKT>"
    wktLiteral += "</rdf:Description>"
    wktLiteral += "</sf:MultiPolygon>"
    return wktLiteral
    
    
def multipolygon2WKT(geo_data):
    wktLiteral = "<sf:MultiPolygon>";
    wktLiteral += "<rdf:Description rdf:about='" + exampleInstanceNamespace + str(name) + "'>";
    wktLiteral += "<geo:asWKT rdf:datatype='" + geoSparqlNamespace + "wktLiteral'>";
    
    """
    # for curves/surfaces
    wktLiteral += "MULTIPOLYGON Z(((";
    try:
        curves = Surface.PerimeterCurves(geometry);
    except:
        raise Exception("something wrong at geometry import!")
    startP = None;
    for curve in curves:
        nextP = curve.StartPoint;
        if(startP != None):
            wktLiteral += ", ";
        else:
            startP = nextP;
        wktLiteral += str(nextP.X) + " " +  str(nextP.Y) + " " +  str(nextP.Z);
        
    #Close the tiangle loop with a repeat of the first Point
    wktLiteral += ", " + str(startP.X) + " " +  str(startP.Y) + " " +  str(startP.Z);
    wktLiteral += ")))"
    """
    # for cuboids with geometry = [centroid, length]
    centroid = Solid.Centroid(geo_data)
    offset = geo_data.Length/2
    c_X = centroid.X
    c_Y = centroid.Y
    c_Z = centroid.Z

    # idea: determine the coordinates of bottom- and top faces
    
    # p1 -- p2
    # |  c   |
    # p3 -- p4           
    # bottom-face
    bottom_p1 = str(c_X-offset) + " " + str(c_Y-offset) + " " + str(c_Z-offset)
    bottom_p2 = str(c_X-offset) + " " + str(c_Y+offset) + " " + str(c_Z-offset) 
    bottom_p3 = str(c_X+offset) + " " + str(c_Y+offset) + " " + str(c_Z-offset)
    bottom_p4 = str(c_X+offset) + " " + str(c_Y-offset) + " " + str(c_Z-offset)
    bottom_face = "((" + bottom_p1 + ", " + bottom_p2 + ", " + bottom_p3 + ", " + bottom_p4 +  ", " + bottom_p1 + "))"
    # top-face
    top_p1 = str(c_X-offset) + " " + str(c_Y-offset) + " " + str(c_Z+offset)
    top_p2 = str(c_X-offset) + " " + str(c_Y+offset) + " " + str(c_Z+offset) 
    top_p3 = str(c_X+offset) + " " + str(c_Y+offset) + " " + str(c_Z+offset)
    top_p4 = str(c_X+offset) + " " + str(c_Y-offset) + " " + str(c_Z+offset)
    top_face = "((" + top_p1 + ", " + top_p2 + ", " + top_p3 + ", " + top_p4 +  ", " + top_p1 + "))"
    # front-face
    front_p1 = str(c_X-offset) + " " + str(c_Y-offset) + " " + str(c_Z-offset)
    front_p2 = str(c_X-offset) + " " + str(c_Y+offset) + " " + str(c_Z-offset) 
    front_p3 = str(c_X-offset) + " " + str(c_Y+offset) + " " + str(c_Z+offset) 
    front_p4 = str(c_X-offset) + " " + str(c_Y-offset) + " " + str(c_Z+offset)
    front_face = "((" + front_p1 + ", " + front_p2 + ", " + front_p3 + ", " + front_p4 + ", " + front_p1 + "))"
    # back-face             
    back_p1 = str(c_X+offset) + " " + str(c_Y-offset) + " " + str(c_Z-offset)
    back_p2 = str(c_X+offset) + " " + str(c_Y+offset) + " " + str(c_Z-offset) 
    back_p3 = str(c_X+offset) + " " + str(c_Y+offset) + " " + str(c_Z+offset) 
    back_p4 = str(c_X+offset) + " " + str(c_Y-offset) + " " + str(c_Z+offset)
    back_face = "((" + back_p1 + ", " + back_p2 + ", " + back_p3 + ", " + back_p4 + ", " + back_p1 + "))"
    # left-face
    left_p1 = str(c_X-offset) + " " + str(c_Y-offset) + " " + str(c_Z-offset)
    left_p2 = str(c_X+offset) + " " + str(c_Y-offset) + " " + str(c_Z-offset)
    left_p3 = str(c_X+offset) + " " + str(c_Y-offset) + " " + str(c_Z+offset)
    left_p4 = str(c_X-offset) + " " + str(c_Y-offset) + " " + str(c_Z+offset)
    left_face = "((" + left_p1 + ", " + left_p2 + ", " + left_p3 + ", " + left_p4 + ", " + left_p1 + "))"            
    # right-face
    right_p1 = str(c_X-offset) + " " + str(c_Y+offset) + " " + str(c_Z-offset)
    right_p2 = str(c_X+offset) + " " + str(c_Y+offset) + " " + str(c_Z-offset)
    right_p3 = str(c_X+offset) + " " + str(c_Y+offset) + " " + str(c_Z+offset)
    right_p4 = str(c_X-offset) + " " + str(c_Y+offset) + " " + str(c_Z+offset)
    right_face = "((" + right_p1 + ", " + right_p2 + ", " + right_p3 + ", " + right_p4 + ", " + right_p1 + "))"
    
    cuboid_face = bottom_face + ", " + top_face + ", " + front_face + ", " + back_face + ", " + left_face + ", " + right_face
    
    wktLiteral += "MULTIPOLYGON Z("
    try:
        wktLiteral += cuboid_face
    except e:
        return e
    print(cuboid_face)
    wktLiteral += ")"
    wktLiteral += "</geo:asWKT>"
    wktLiteral += "</rdf:Description>"
    wktLiteral += "</sf:MultiPolygon>"
    return wktLiteral
    
    
def polygon2WKT(geo_data):
    wktLiteral = "<sf:POLYGON>";
    wktLiteral += "<rdf:Description rdf:about='" + exampleInstanceNamespace + str(name) + "'>";
    wktLiteral += "<geo:asWKT rdf:datatype='" + geoSparqlNamespace + "wktLiteral'>";
    wktLiteral += "POLYGON Z((";
    
    points =  geo_data
    originP = points[0];
    
    wktLiteral += str(originP.X) + " " +  str(originP.Y) + " " +  str(originP.Z) # start point
    for i in range(1, len(points)):
        wktLiteral += ", " + str(points[i].X) + " " +  str(points[i].Y) + " " +  str(points[i].Z);       
    wktLiteral += ", " + str(originP.X) + " " +  str(originP.Y) + " " +  str(originP.Z); # end point
    wktLiteral += "))"
    
    wktLiteral += "</geo:asWKT>";
    wktLiteral += "</rdf:Description>";
    wktLiteral += "</sf:POLYGON>";
    return wktLiteral

#####
res = []
for geo_obj in geo_lst:
    geo_data = geo_obj[0];
    name = geo_obj[1];
    geometryType = geo_obj[2];
    
    if(geometryType.upper() == "MULTIPOLYGON_ROTATION"):
        res.append(multipolygonInRotation2WKT(geo_data))
        continue
    
    if(geometryType.upper() == "MULTIPOLYGON_SPHERE"):
        res.append(sphere2WKT(geo_data))    
        continue
     
    if(geometryType.upper() == "MULTIPOLYGON"):
        res.append(multipolygon2WKT(geo_data))
        continue
        
    if(geometryType.upper() == "POLYGON_ROTATION"):
        res.append(polygon2WKT(geo_data))
        continue
        
    if(geometryType.upper() == "POLYGON"):
        res.append(polygon2WKT(geo_data))
        continue
        
    if(geometryType.upper() == "LINESTRING"):
        res.append(lineString2WKT(geo_data))
        continue
        
# Assign your output to the OUT variable.
OUT = res
# ----------------------------------------
rdf_wrapper = Python(IN[0]=rdf_prefixes.namespaces, IN[1]=wkt_converter)  # CPython3
# ---------- rdf_wrapper.python (35 lines) ----------
# Phython-Standard- und DesignScript-Bibliotheken laden
import sys
import clr
clr.AddReference('ProtoGeometry')
from Autodesk.DesignScript.Geometry import *

# Die Eingaben für diesen Block werden in Form einer Liste in den IN-Variablen gespeichert.
dataEnteringNode = IN

namespaces = dataEnteringNode[0]
inserts = dataEnteringNode[1]

# open RDF header
rdfStr = "<rdf:RDF";

# handle Namespaces
for key in namespaces:
    rdfStr += " xmlns:" + key + "='" + namespaces[key] + "'";

rdfStr += ">";

#add inserts

rdfStr += "<rdf:Description rdf:about='my:" + "RootModel" + "'>";

for insert in inserts:
    rdfStr += insert;

rdfStr += "</rdf:Description>"

# close RDF header
rdfStr += "</rdf:RDF>"

# Weisen Sie Ihre Ausgabe der OUT-Variablen zu.
OUT = rdfStr
# ----------------------------------------
groundtruth_generator = Python(IN[0]=random_geometry_generator)  # CPython3
# ---------- groundtruth_generator.python (54 lines) ----------
# Load the Python Standard and DesignScript Libraries
import sys
import clr
clr.AddReference('ProtoGeometry')
from Autodesk.DesignScript.Geometry import *

#================= Help Function ====================
def getGeometry(geo_obj):
    return geo_obj[3]

def getGeoType(geo_obj):
    return geo_obj[2]
    
def getGeoName(geo_obj):
    return geo_obj[1]
#================= Input ====================
geo_lst = IN[0]

#================= Body ====================
inter_geo_dict = {} # {inter_geo_name1: "", inter_geo_name2: "", ...}

"""
comparison algorithnm:

geo_obj_1 in lst start from 0 to n-1
    geo_obj_2 in lst start from 1 to n
lst remove geo_obj_1
"""
for i in range(0, len(geo_lst)-1):
    geo_obj_1 = geo_lst[i]
    geometry_1 = getGeometry(geo_obj_1)

    geo_obj_1_has_intersection = False
    for j in range(1, len(geo_lst)):
        geo_obj_2 = geo_lst[j]
        geometry_2 = getGeometry(geo_obj_2)
        
        if getGeoName(geo_obj_1) != getGeoName(geo_obj_2):
            temp_bool = False
            try:
                temp_bool = Geometry.DoesIntersect(geometry_1, geometry_2)
            except Exception as err:
                print(f"Unexpected {err=}, {type(err)=}")
            if temp_bool:
                geo_obj_1_has_intersection = True
                inter_geo_dict[getGeoName(geo_obj_2)] = getGeoType(geo_obj_2)
                
    if geo_obj_1_has_intersection:
        inter_geo_dict[getGeoName(geo_obj_1)] = getGeoType(geo_obj_1)    
#================= Output ====================
if inter_geo_dict is None:
    inter_geo_dict = {}
    
OUT = inter_geo_dict
# ----------------------------------------
json_writer = Python(IN[0]=groundtruth_generator)  # CPython3
# ---------- json_writer.python (22 lines) ----------
# Load the Python Standard and DesignScript Libraries
import sys
import clr
import json
clr.AddReference('ProtoGeometry')
from Autodesk.DesignScript.Geometry import *

dir = "C:\\Users\\yhe\\Documents\\Developer\\Repo\\ExtendingJena\\src\\main\\resources\\JSON\\groundTruth.json"

json_file = IN[0]

res = True
if json_file is None:
    json_file = {}

try: 
    with open(dir, 'w') as fp:
        json.dump(json_file, fp, sort_keys=True, indent=4)
except:
    res = False
    
OUT = res
# ----------------------------------------

notes = CodeBlock()
# ---------- notes.designscript (8 lines) ----------
/**
* "F5": Run the script
* "Ctrl + I": Isolate Selected Geometry
* "Ctrl + P": Drag & Drop
*
*
*
**/;
# ----------------------------------------

# group: RDF-to-JSON Export
str_rdf_json_converter = Python()  # CPython3; unwired: IN[0]
# ---------- str_rdf_json_converter.python (125 lines) ----------
# Load the Python Standard and DesignScript Libraries
import io
import sys
import clr
import ctypes
import xml.etree.ElementTree as ET
sys.path.append(r"C:\Users\yhe\AppData\Local\Programs\Python\Python310\Lib\site-packages")

clr.AddReference('ProtoGeometry')
from Autodesk.DesignScript.Geometry import *
from xml.dom.minidom import parse, parseString

###################### Body ###########################

def rdfParsing2GeoData(str):
    """ it returns the json file in structure like { "POLYGON1" : [...], 
                                                     "POLYGON2" : [...], 
                                                     "MULTIPOLYGON1" : [...], ...
                                                    }
    """
    #dom = parse(path)
    #tree = ET.ElementTree(ET.fromstring(str))
    geo_dict = {}
    tree = io.StringIO(str)
    dom = parse(tree)
    data = dom.documentElement
    rdf_desc_lst = data.getElementsByTagName("rdf:Description")
    # geo_in_wkt = data.getElementsByTagName("geo:asWKT")

    for i in range(1, len(rdf_desc_lst)): # first description element (root element) should be removed.
        descr_el = rdf_desc_lst[i]
        geo_name_num = descr_el.attributes._attrs['rdf:about'].nodeValue.split('#')[1]
        geo_wkt_data = ""
        try:
            geo_wkt_data = descr_el.childNodes[0].firstChild.data
        except:
            geo_wkt_data = descr_el.childNodes[1].firstChild.data
        geo_algebra_lst = []

        if ( geo_name_num.find('POINT') != -1 or
            geo_name_num.find('Point') != -1 ):
            
            wkt_data_lst = geo_wkt_data.split("(")[1] # remove title 'POINT'
            vert_str_lst = wkt_data_lst
            vert_str_lst = vert_str_lst.replace( ")", "" ) # remove character ')'

            pt_algebra_lst = []
            pt_str_lst = vert_str_lst.split(" ")

            pt_algebra_lst = [ float(pt_str) for pt_str in pt_str_lst ]
            geo_algebra_lst.append(pt_algebra_lst)
            
        if ( geo_name_num.find('LINESTRING') != -1 or
            geo_name_num.find('Linestring') != -1 or
            geo_name_num.find('LINE') != -1 or
            geo_name_num.find('Line') != -1 ):

            wkt_data_lst = geo_wkt_data.split("((")[1] # remove title 'LINESTRING'
            vert_str_lst = wkt_data_lst
            vert_str_lst = vert_str_lst.replace( ")", "" ) # remove character ')'
            vert_str_lst = vert_str_lst.split(", ")

            line_algebra_lst = []
            for i in range(0, len(vert_str_lst)):

                pt_str_lst = vert_str_lst[i].split(" ")
                line_algebra_lst.append([ float(pt_str) for pt_str in pt_str_lst ])
            geo_algebra_lst.append(line_algebra_lst)

        if ( geo_name_num.find('POLYGON') != -1 or 
            geo_name_num.find('Polygon') != -1 ):

            wkt_data_lst = geo_wkt_data.split("((")[1] # remove title 'POLYGON Z'
            vert_str_lst = wkt_data_lst
            vert_str_lst = vert_str_lst.replace( ")", "" ) # remove character ')'
            vert_str_lst = vert_str_lst.replace( "(", "" ) # remove character '('
            vert_str_lst = vert_str_lst.split(", ")

            face_algebra_lst = []
            for i in range(0, len(vert_str_lst)-1): # last point not included

                pt_str_lst = vert_str_lst[i].split(" ")
                face_algebra_lst.append([ float(pt_str) for pt_str in pt_str_lst ])
            geo_algebra_lst.append(face_algebra_lst)

        if ( geo_name_num.find('MULTIPOLYGON') != -1 or
            geo_name_num.find('Multipolygon') != -1  or
            geo_name_num.find('CUBE') != -1 or
            geo_name_num.find('Cube') != -1 or
            geo_name_num.find('SPHERE') != -1 or
            geo_name_num.find('Sphere') != -1 ):

            wkt_data_lst = geo_wkt_data.split("(((")[1] # remove title 'MULTIPOLYGON Z'
            face_str_lst = wkt_data_lst.split("), ")

            face_algebra_lst = []
            for face_str in face_str_lst:
                vert_str_lst = face_str.replace( ")", "" ) # remove character ')'
                vert_str_lst = vert_str_lst.replace( "(", "" ) # remove character '('
                vert_str_lst = vert_str_lst.split(", ")

                pt_algebra_lst = []
                for i in range(0, len(vert_str_lst)-1): # last point not included

                    pt_str_lst = vert_str_lst[i].split(" ")
                        
                    pt_algebra = [ float(pt_str) for pt_str in pt_str_lst ]
                    pt_algebra_lst.append(pt_algebra)

                face_algebra_lst.append(pt_algebra_lst)
            geo_algebra_lst = face_algebra_lst

        if geo_name_num not in geo_dict.keys():
            geo_dict[geo_name_num] = geo_algebra_lst
    return geo_dict
    
######################################################
json_file = {}


#dir = "C:\\Users\\yhe\\Documents\\Developer\\Repo\\ExtendingJena\\src\\main\\resources\\rdf\\xxl3DScene.rdf"
json_file = rdfParsing2GeoData(IN[0])

######################### Output ##########################
OUT = json_file
# ----------------------------------------
file_path = Filename("..\..\..\..\..\..\..\..\resources\JSON\Level2_groundTruth.json")
json_writer_2 = Python(IN[0]=str_rdf_json_converter, IN[1]=file_path)  # CPython3
# ---------- json_writer_2.python (23 lines) ----------
# Load the Python Standard and DesignScript Libraries
import sys
import clr
import json
clr.AddReference('ProtoGeometry')
from Autodesk.DesignScript.Geometry import *

#dir = "C:\\Users\\yhe\\Documents\\Developer\\Repo\\ExtendingJena\\src\\main\\resources\\JSON\\Level1_groundTruth.json"
warn_str = '<.json> File or File Path does not exist.'


json_file = IN[0]
dir = IN[1]

res = False
try: 
    with open(dir, 'w') as fp:
        json.dump(json_file, fp, sort_keys=True, indent=4)
    res = True
except:
    ctypes.windll.user32.MessageBoxW(0, warn_str, 'Input Exception',1)
    
OUT = res
# ----------------------------------------
json_viewer = Watch(json_writer_2)

# group: RDF Export
file_path_2 = Filename("..\..\..\..\..\..\..\..\resources\rdf\3DScenario.rdf")
writeText = FileSystem.WriteText(filePath=file_path_2)  # unwired: text

on_off = BoolSelector(true)
python_script = Python()  # CPython3; unwired: IN[0]
# ---------- python_script.python (616 lines) ----------
# Load the Python Standard and DesignScript Libraries
import sys
import clr
import json
import os
import random
import pickle
clr.AddReference('ProtoGeometry')
from Autodesk.DesignScript.Geometry import *
clr.AddReference('DSCoreNodes')
from DSCore import *
clr.AddReference('GeometryColor')
from Modifiers import GeometryColor
clr.AddReference('MeshToolkit')
from Autodesk.Dynamo.MeshToolkit import *

############## Random Geometry Generator ###############

def random_geo_generator(factor):
    NUM_POINT = 0
    NUM_MULTIPOLYGON = 10 + factor*2
    NUM_POLYGON = 10 + factor*3
    NUM_LINESTRING = 10 + factor*4
    NUM_POINT = 10
    NUM_SPHERE = 0
    
    # output container
    geo_lst = []
    
    geo_pt_lst = []
    geo_li_lst = []
    geo_pol_lst = []
    geo_mPol_lst = []
    geo_sph_lst = []
    
    geo_combi_lst = []
    
    ################### Polygon #######################
    # random triangle(s)
    for i in range(0, NUM_POLYGON):
        pt_lst = []
        
        x_axis_lst = random.sample(range(-10, 10, 2), 3)
        y_axis_lst = random.sample(range(-10, 10, 2), 3)
        z_axis_lst = random.sample(range(-10, 10, 2), 3)
        
        offset_lst = random.sample(range(-50, 50, 2), 3)
        
        pt_lst = [Point.ByCoordinates(x_axis_lst[0] + offset_lst[0], y_axis_lst[0] + offset_lst[1], z_axis_lst[0] + offset_lst[2]),
                  Point.ByCoordinates(x_axis_lst[1] + offset_lst[0], y_axis_lst[1] + offset_lst[1], z_axis_lst[1] + offset_lst[2]), 
                  Point.ByCoordinates(x_axis_lst[2] + offset_lst[0], y_axis_lst[2] + offset_lst[1], z_axis_lst[2] + offset_lst[2])]
    
        geo_data = pt_lst
        geo_name = POLYGON + str(i+1)
        geo_type = POLYGON
        geometry = Surface.ByPerimeterPoints(pt_lst)
    
        geo_obj_pol = (geo_data, geo_name, geo_type, geometry)
        
        geo_pol_lst.append(geo_obj_pol)
        pol_index += 1
    
    ###################### Multi-Polygon ##########################
    # random cube(s)
    for i in range(0, NUM_MULTIPOLYGON):
        """
        corner pt 1 : (x, y, z)
        corner pt 2 : (x+l, y+l, z+l)
        """
        pt_lst = []
        is_rotated = random.randint(0,1)
        x_axis = random.randint(-10, 10)
        y_axis = random.randint(-10, 10)
        z_axis = random.randint(-10, 10)
        l = random.randint(1, 8)
        
        offset_lst = random.sample(range(-50, 50, 2), 3)
        p1 = Point.ByCoordinates(x_axis + offset_lst[0], 
                                 y_axis + offset_lst[1], 
                                 z_axis + offset_lst[2])
                                 
        p2 = Point.ByCoordinates(x_axis + l + offset_lst[0], 
                                 y_axis + l + offset_lst[1], 
                                 z_axis + l + offset_lst[2])
        
        geometry = Cuboid.ByCorners(p1, p2)
        geo_data = geometry
        geo_name = MULTIPOLYGON + str(i+1)
        geo_type = MULTIPOLYGON
        
        if is_rotated == 0:
            old_cs = CoordinateSystem.Identity()
            new_cs = CoordinateSystem.Identity()
            new_cs2 = new_cs.Rotate(Point.ByCoordinates(random.randint(-10, 10), random.randint(-10, 10), random.randint(-10, 10)),
                                    Vector.ByCoordinates(random.randint(-10, 10), random.randint(-10, 10), random.randint(-10, 10)), 
                                    random.randint(0, 360))
            geometry = geometry.Transform(old_cs, new_cs2)
            
            geo_data = geometry.Faces
            geo_name = MULTIPOLYGON + str(mPol_index)
            geo_type = MULTIPOLYGON_ROTATION
        
        geo_obj_mPol = (geo_data, geo_name, geo_type, geometry)
        geo_mPol_lst.append(geo_obj_mPol)
        mPol_index += 1
    
    ###################### LineString ###########################
    
    # random LineString(s)
    pt_lst= []
    for i in range(0, NUM_LINESTRING): # random number of line strings
    
        rand_length = random.randint(1,3) # random length of line strings
        for j in range(0, rand_length):
            x_axis = random.randint(-50, 50)
            y_axis = random.randint(-50, 50)
            z_axis = random.randint(-50, 50)
            l = random.randint(1, 2)
            offset_lst = random.sample(range(-20, 20, 2), 3)
            
            pt_s = Point.ByCoordinates(x_axis + offset_lst[0], 
                                     y_axis + offset_lst[1], 
                                     z_axis + offset_lst[2])
            pt_e = Point.ByCoordinates(x_axis + l + offset_lst[0], 
                                     y_axis + l + offset_lst[1], 
                                     z_axis + l + offset_lst[2])
            pt_lst.append(pt_s)
            pt_lst.append(pt_e)
    
    geo_data = pt_lst
    geo_name = LINESTRING + str(i+1)
    geo_type = LINESTRING
    geometry = PolyCurve.ByPoints(pt_lst, False)
    geo_obj_li = (geo_data, geo_name, geo_type, geometry)
    geo_li_lst.append(geo_obj_li)
    li_index += 1
    
    #################### Case Study #############################
    
    # (Multi)polygon <==> (Multi)polygon (incl. rotation)
    case_mp_mp = []
    
    # (Multi)polygon <==> LingString (incl. rotation)
    case_mp_ls = []
    
    # (Multi)polygon <==> Sphere (incl. rotation)
    case_mp_sp = []
    
    # Sphere <==> LingString
    case_sp_ls = []
    
    geo_combi_lst = geo_pt_lst + geo_li_lst + geo_pol_lst + geo_mPol_lst + geo_sph_lst
    return geo_combi_lst

#################### WKT Converter #############################
def lineString2WKT(geo_data):
    wktLiteral = "<sf:LineString>";
    wktLiteral += "<rdf:Description rdf:about='" + exampleInstanceNamespace + str(name) + "'>";
    wktLiteral += "<geo:asWKT rdf:datatype='" + geoSparqlNamespace + "wktLiteral'>";
    wktLiteral += "LINESTRING Z((";
    
    points =  geo_data
    originP = points[0];
    
    wktLiteral += str(originP.X) + " " +  str(originP.Y) + " " +  str(originP.Z) # start point
    for i in range(1, len(points)):
        wktLiteral += ", " + str(points[i].X) + " " +  str(points[i].Y) + " " +  str(points[i].Z);       
    #wktLiteral += ", " + str(originP.X) + " " +  str(originP.Y) + " " +  str(originP.Z); # end point
    wktLiteral += "))"
    
    wktLiteral += "</geo:asWKT>";
    wktLiteral += "</rdf:Description>";
    wktLiteral += "</sf:LineString>";
    return wktLiteral

def sphere2WKT(surface_lst):
    wktLiteral = "<sf:MultiPolygon>";
    wktLiteral += "<rdf:Description rdf:about='" + exampleInstanceNamespace + str(name) + "'>";
    wktLiteral += "<geo:asWKT rdf:datatype='" + geoSparqlNamespace + "wktLiteral'>";
    
    # for curves/surfaces
    face_wkt_lst = ""
    for vert_lst in surface_lst:
        
        vert_wkt_lst = "(("
        for vert in vert_lst:
        
            vert_wkt_lst += str(vert.X) + " " +  str(vert.Y) + " " +  str(vert.Z);
            if vert != vert_lst[-1]:
                vert_wkt_lst += ", "
        
        vert_wkt_lst += ", " + str(vert_lst[0].X) + " " +  str(vert_lst[0].Y) + " " +  str(vert_lst[0].Z) + "))";
        
        face_wkt_lst += vert_wkt_lst
        if vert_lst != surface_lst[-1]:
            face_wkt_lst += ", "          
            
    wktLiteral += "MULTIPOLYGON Z(";
    wktLiteral += face_wkt_lst
    wktLiteral += ")"
    wktLiteral += "</geo:asWKT>";
    wktLiteral += "</rdf:Description>";
    wktLiteral += "</sf:MultiPolygon>";
    return wktLiteral
    
    
def multipolygonInRotation2WKT(face_lst):
    wktLiteral = "<sf:MultiPolygon>";
    wktLiteral += "<rdf:Description rdf:about='" + exampleInstanceNamespace + str(name) + "'>";
    wktLiteral += "<geo:asWKT rdf:datatype='" + geoSparqlNamespace + "wktLiteral'>";
    face_wkt_lst = ""
    
    for face in face_lst:
        
        vertice_lst = face.Vertices
        org_vert_pt = vertice_lst[0].PointGeometry 
        face_wkt = "((" + str(org_vert_pt.X) + " " +  str(org_vert_pt.Y) + " " +  str(org_vert_pt.Z) # start point
    
        for i in range(1, len(vertice_lst)):
            vert_pt = vertice_lst[i].PointGeometry
            face_wkt += ", " + str(vert_pt.X) + " " +  str(vert_pt.Y) + " " +  str(vert_pt.Z)       
        face_wkt += ", " + str(org_vert_pt.X) + " " +  str(org_vert_pt.Y) + " " +  str(org_vert_pt.Z) + "))" # end point
        
        if(face != face_lst[-1]):
            face_wkt += ", "
        face_wkt_lst += face_wkt        
    
    wktLiteral += "MULTIPOLYGON Z("
    wktLiteral += face_wkt_lst
    wktLiteral += ")" 
    wktLiteral += "</geo:asWKT>"
    wktLiteral += "</rdf:Description>"
    wktLiteral += "</sf:MultiPolygon>"
    return wktLiteral
    
    
def multipolygon2WKT(geo_data):
    wktLiteral = "<sf:MultiPolygon>";
    wktLiteral += "<rdf:Description rdf:about='" + exampleInstanceNamespace + str(name) + "'>";
    wktLiteral += "<geo:asWKT rdf:datatype='" + geoSparqlNamespace + "wktLiteral'>";
    
    # for cuboids with geometry = [centroid, length]
    centroid = Solid.Centroid(geo_data)
    offset = geo_data.Length/2
    c_X = centroid.X
    c_Y = centroid.Y
    c_Z = centroid.Z

    # idea: determine the coordinates of bottom- and top faces
    
    # p1 -- p2
    # |  c   |
    # p3 -- p4           
    # bottom-face
    bottom_p1 = str(c_X-offset) + " " + str(c_Y-offset) + " " + str(c_Z-offset)
    bottom_p2 = str(c_X-offset) + " " + str(c_Y+offset) + " " + str(c_Z-offset) 
    bottom_p3 = str(c_X+offset) + " " + str(c_Y+offset) + " " + str(c_Z-offset)
    bottom_p4 = str(c_X+offset) + " " + str(c_Y-offset) + " " + str(c_Z-offset)
    bottom_face = "((" + bottom_p1 + ", " + bottom_p2 + ", " + bottom_p3 + ", " + bottom_p4 +  ", " + bottom_p1 + "))"
    # top-face
    top_p1 = str(c_X-offset) + " " + str(c_Y-offset) + " " + str(c_Z+offset)
    top_p2 = str(c_X-offset) + " " + str(c_Y+offset) + " " + str(c_Z+offset) 
    top_p3 = str(c_X+offset) + " " + str(c_Y+offset) + " " + str(c_Z+offset)
    top_p4 = str(c_X+offset) + " " + str(c_Y-offset) + " " + str(c_Z+offset)
    top_face = "((" + top_p1 + ", " + top_p2 + ", " + top_p3 + ", " + top_p4 +  ", " + top_p1 + "))"
    # front-face
    front_p1 = str(c_X-offset) + " " + str(c_Y-offset) + " " + str(c_Z-offset)
    front_p2 = str(c_X-offset) + " " + str(c_Y+offset) + " " + str(c_Z-offset) 
    front_p3 = str(c_X-offset) + " " + str(c_Y+offset) + " " + str(c_Z+offset) 
    front_p4 = str(c_X-offset) + " " + str(c_Y-offset) + " " + str(c_Z+offset)
    front_face = "((" + front_p1 + ", " + front_p2 + ", " + front_p3 + ", " + front_p4 + ", " + front_p1 + "))"
    # back-face             
    back_p1 = str(c_X+offset) + " " + str(c_Y-offset) + " " + str(c_Z-offset)
    back_p2 = str(c_X+offset) + " " + str(c_Y+offset) + " " + str(c_Z-offset) 
    back_p3 = str(c_X+offset) + " " + str(c_Y+offset) + " " + str(c_Z+offset) 
    back_p4 = str(c_X+offset) + " " + str(c_Y-offset) + " " + str(c_Z+offset)
    back_face = "((" + back_p1 + ", " + back_p2 + ", " + back_p3 + ", " + back_p4 + ", " + back_p1 + "))"
    # left-face
    left_p1 = str(c_X-offset) + " " + str(c_Y-offset) + " " + str(c_Z-offset)
    left_p2 = str(c_X+offset) + " " + str(c_Y-offset) + " " + str(c_Z-offset)
    left_p3 = str(c_X+offset) + " " + str(c_Y-offset) + " " + str(c_Z+offset)
    left_p4 = str(c_X-offset) + " " + str(c_Y-offset) + " " + str(c_Z+offset)
    left_face = "((" + left_p1 + ", " + left_p2 + ", " + left_p3 + ", " + left_p4 + ", " + left_p1 + "))"            
    # right-face
    right_p1 = str(c_X-offset) + " " + str(c_Y+offset) + " " + str(c_Z-offset)
    right_p2 = str(c_X+offset) + " " + str(c_Y+offset) + " " + str(c_Z-offset)
    right_p3 = str(c_X+offset) + " " + str(c_Y+offset) + " " + str(c_Z+offset)
    right_p4 = str(c_X-offset) + " " + str(c_Y+offset) + " " + str(c_Z+offset)
    right_face = "((" + right_p1 + ", " + right_p2 + ", " + right_p3 + ", " + right_p4 + ", " + right_p1 + "))"
    
    cuboid_face = bottom_face + ", " + top_face + ", " + front_face + ", " + back_face + ", " + left_face + ", " + right_face
    
    wktLiteral += "MULTIPOLYGON Z("
    try:
        wktLiteral += cuboid_face
    except e:
        return e
    print(cuboid_face)
    wktLiteral += ")"
    wktLiteral += "</geo:asWKT>"
    wktLiteral += "</rdf:Description>"
    wktLiteral += "</sf:MultiPolygon>"
    return wktLiteral
    
    
def polygon2WKT(geo_data):
    wktLiteral = "<sf:POLYGON>";
    wktLiteral += "<rdf:Description rdf:about='" + exampleInstanceNamespace + str(name) + "'>";
    wktLiteral += "<geo:asWKT rdf:datatype='" + geoSparqlNamespace + "wktLiteral'>";
    wktLiteral += "POLYGON Z((";
    
    points =  geo_data
    originP = points[0];
    
    wktLiteral += str(originP.X) + " " +  str(originP.Y) + " " +  str(originP.Z) # start point
    for i in range(1, len(points)):
        wktLiteral += ", " + str(points[i].X) + " " +  str(points[i].Y) + " " +  str(points[i].Z);       
    wktLiteral += ", " + str(originP.X) + " " +  str(originP.Y) + " " +  str(originP.Z); # end point
    wktLiteral += "))"
    
    wktLiteral += "</geo:asWKT>";
    wktLiteral += "</rdf:Description>";
    wktLiteral += "</sf:POLYGON>";
    return wktLiteral

#####
def wkt_Converter(geometry_lst):
# The inputs to this node will be stored as a list in the IN variables.
    geo_lst = geometry_lst
    exampleInstanceNamespace = "http://www.opengis.net/ont/geosparql#"
    geoSparqlNamespace = "https://www.inf.bi.ruhr-uni-bochum.de/jena/#"
    
    res = []
    for geo_obj in geo_lst:
        geo_data = geo_obj[0];
        name = geo_obj[1];
        geometryType = geo_obj[2];
        
        if(geometryType.upper() == "MULTIPOLYGON_ROTATION"):
            res.append(multipolygonInRotation2WKT(geo_data))
            continue
        
        if(geometryType.upper() == "MULTIPOLYGON_SPHERE"):
            res.append(sphere2WKT(geo_data))    
            continue
         
        if(geometryType.upper() == "MULTIPOLYGON"):
            res.append(multipolygon2WKT(geo_data))
            continue
            
        if(geometryType.upper() == "POLYGON_ROTATION"):
            res.append(polygon2WKT(geo_data))
            continue
            
        if(geometryType.upper() == "POLYGON"):
            res.append(polygon2WKT(geo_data))
            continue
            
        if(geometryType.upper() == "LINESTRING"):
            res.append(lineString2WKT(geo_data))
            continue
    return res

############## RDF Wrapper ###############
def RDF_Wrapper(WKT_res):
    namespaces = {
                	"rdf" : rdf,
                	"owl" : owl,
                	"ogc" : ogc,
                	"my" : my,
                	"gml" : gml,
                	"geo" : geo,
                	"geof": geof,
                	"rdfs": rdfs,
                	"uom": uom,
                	"sf": sf,
                	"xsd": xsd,
                	"geor": geor
                }
    inserts = WKT_res
    
    # open RDF header
    rdfStr = "<rdf:RDF";
    
    # handle Namespaces
    for key in namespaces:
        rdfStr += " xmlns:" + key + "='" + namespaces[key] + "'";
    
    rdfStr += ">";
    
    #add inserts
    
    rdfStr += "<rdf:Description rdf:about='my:" + "RootModel" + "'>";
    
    for insert in inserts:
        rdfStr += insert;
    
    rdfStr += "</rdf:Description>"
    
    # close RDF header
    rdfStr += "</rdf:RDF>"
    
    # Weisen Sie Ihre Ausgabe der OUT-Variablen zu.
    return rdfStr

############## Ground Truth Generator ###############
def getGeometry(geo_obj):
    return geo_obj[3]

def getGeoType(geo_obj):
    return geo_obj[2]
    
def getGeoName(geo_obj):
    return geo_obj[1]
    
def ground_truth_generator(geometry_lst):
    geo_lst = geometry_lst
    inter_geo_dict = {}
    for i in range(0, len(geo_lst)-1):
        geo_obj_1 = geo_lst[i]
        geometry_1 = getGeometry(geo_obj_1)
    
        geo_obj_1_has_intersection = False
        for j in range(1, len(geo_lst)):
            geo_obj_2 = geo_lst[j]
            geometry_2 = getGeometry(geo_obj_2)
            
            if getGeoName(geo_obj_1) != getGeoName(geo_obj_2):
                temp_bool = False
                try:
                    temp_bool = Geometry.DoesIntersect(geometry_1, geometry_2)
                except Exception as err:
                    print(f"Unexpected {err=}, {type(err)=}")
                if temp_bool:
                    geo_obj_1_has_intersection = True
                    inter_geo_dict[getGeoName(geo_obj_2)] = getGeoType(geo_obj_2)
                    
        if geo_obj_1_has_intersection:
            inter_geo_dict[getGeoName(geo_obj_1)] = getGeoType(geo_obj_1)    
    #================= Output ====================
    if inter_geo_dict is None:
        inter_geo_dict = {}
    return inter_geo_dict
    
############## RDF 2 JSON ###############
def rdfParsing2GeoData(str):
    """ it returns the json file in structure like { "POLYGON1" : [...], 
                                                     "POLYGON2" : [...], 
                                                     "MULTIPOLYGON1" : [...], ...
                                                    }
    """
    #dom = parse(path)
    #tree = ET.ElementTree(ET.fromstring(str))
    geo_dict = {}
    tree = io.StringIO(str)
    dom = parse(tree)
    data = dom.documentElement
    rdf_desc_lst = data.getElementsByTagName("rdf:Description")
    # geo_in_wkt = data.getElementsByTagName("geo:asWKT")

    for i in range(1, len(rdf_desc_lst)): # first description element (root element) should be removed.
        descr_el = rdf_desc_lst[i]
        geo_name_num = descr_el.attributes._attrs['rdf:about'].nodeValue.split('#')[1]
        geo_wkt_data = ""
        try:
            geo_wkt_data = descr_el.childNodes[0].firstChild.data
        except:
            geo_wkt_data = descr_el.childNodes[1].firstChild.data
        geo_algebra_lst = []

        if ( geo_name_num.find('POINT') != -1 or
            geo_name_num.find('Point') != -1 ):
            
            wkt_data_lst = geo_wkt_data.split("(")[1] # remove title 'POINT'
            vert_str_lst = wkt_data_lst
            vert_str_lst = vert_str_lst.replace( ")", "" ) # remove character ')'

            pt_algebra_lst = []
            pt_str_lst = vert_str_lst.split(" ")

            pt_algebra_lst = [ float(pt_str) for pt_str in pt_str_lst ]
            geo_algebra_lst.append(pt_algebra_lst)
            
        if ( geo_name_num.find('LINESTRING') != -1 or
            geo_name_num.find('Linestring') != -1 or
            geo_name_num.find('LINE') != -1 or
            geo_name_num.find('Line') != -1 ):

            wkt_data_lst = geo_wkt_data.split("((")[1] # remove title 'LINESTRING'
            vert_str_lst = wkt_data_lst
            vert_str_lst = vert_str_lst.replace( ")", "" ) # remove character ')'
            vert_str_lst = vert_str_lst.split(", ")

            line_algebra_lst = []
            for i in range(0, len(vert_str_lst)):

                pt_str_lst = vert_str_lst[i].split(" ")
                line_algebra_lst.append([ float(pt_str) for pt_str in pt_str_lst ])
            geo_algebra_lst.append(line_algebra_lst)

        if ( geo_name_num.find('POLYGON') != -1 or 
            geo_name_num.find('Polygon') != -1 ):

            wkt_data_lst = geo_wkt_data.split("((")[1] # remove title 'POLYGON Z'
            vert_str_lst = wkt_data_lst
            vert_str_lst = vert_str_lst.replace( ")", "" ) # remove character ')'
            vert_str_lst = vert_str_lst.replace( "(", "" ) # remove character '('
            vert_str_lst = vert_str_lst.split(", ")

            face_algebra_lst = []
            for i in range(0, len(vert_str_lst)-1): # last point not included

                pt_str_lst = vert_str_lst[i].split(" ")
                face_algebra_lst.append([ float(pt_str) for pt_str in pt_str_lst ])
            geo_algebra_lst.append(face_algebra_lst)

        if ( geo_name_num.find('MULTIPOLYGON') != -1 or
            geo_name_num.find('Multipolygon') != -1  or
            geo_name_num.find('CUBE') != -1 or
            geo_name_num.find('Cube') != -1 or
            geo_name_num.find('SPHERE') != -1 or
            geo_name_num.find('Sphere') != -1 ):

            wkt_data_lst = geo_wkt_data.split("(((")[1] # remove title 'MULTIPOLYGON Z'
            face_str_lst = wkt_data_lst.split("), ")

            face_algebra_lst = []
            for face_str in face_str_lst:
                vert_str_lst = face_str.replace( ")", "" ) # remove character ')'
                vert_str_lst = vert_str_lst.replace( "(", "" ) # remove character '('
                vert_str_lst = vert_str_lst.split(", ")

                pt_algebra_lst = []
                for i in range(0, len(vert_str_lst)-1): # last point not included

                    pt_str_lst = vert_str_lst[i].split(" ")
                        
                    pt_algebra = [ float(pt_str) for pt_str in pt_str_lst ]
                    pt_algebra_lst.append(pt_algebra)

                face_algebra_lst.append(pt_algebra_lst)
            geo_algebra_lst = face_algebra_lst

        if geo_name_num not in geo_dict.keys():
            geo_dict[geo_name_num] = geo_algebra_lst
    return geo_dict
    
######################################################
############## RDF File Configuration ###############
rdf_case_study_file_path = "C:\\Users\\yhe\\Documents\\Developer\\Repo\\ExtendingJena\\src\\main\\resources\\rdf\\case_study\\"
rdf_file_name = "RDFcaseStudy.rdf"
rdf_file_index = ""
rdf_file_contents = ""

############## JSON File Configuration ###############
json_case_study_file_path = "C:\\Users\\yhe\\Documents\\Developer\\Repo\\ExtendingJena\\src\\main\\resources\\JSON\\case_study\\"
json_ground_truth_file_path = "C:\\Users\\yhe\\Documents\\Developer\\Repo\\ExtendingJena\\src\\main\\resources\\JSON\\ground_truth\\"
json_file_name = "JSONcaseStudy.json"
json_file_index = ""
json_file_contents = {"test":""}

########## JSON Export #############
def JSON_export(json_file_path, json_file_name, json_file_index, json_file_contents):
    
    tmp_json_file_name = json_file_index + json_file_name
    tmp_json_file_path = json_file_path + tmp_json_file_name
    try:
        with open(tmp_json_file_path, "x") as f:
            json.dump(json_file_contents, f, sort_keys=True, indent=4)
            #f.write(json_file_contents)
    except FileExistsError:
        print(f"File '{json_file_path}' already exists.")

########## RDF Export #############
def rdf_export(rdf_file_path, rdf_file_name, rdf_file_index, rdf_file_contents):

    tmp_rdf_file_name = rdf_file_index + rdf_file_name
    tmp_rdf_file_path = rdf_file_path + tmp_rdf_file_name
    try:
        with open(tmp_rdf_file_path, "x") as f:
            f.write(rdf_file_contents)
    except FileExistsError:
        print(f"File '{rdf_file_path}' already exists.")
        
        
############## Contents (RDF, JSON) Generation ###############
for i in range(1, 10):
    # create geometries randomly
    tmp_geo_lst = random_geo_generator(i)
    # create ground truth values and store it locally
    inter_geo_dict = ground_truth_generator(tmp_geo_lst)
    JSON_export(json_ground_truth_file_path, "groundTruth.json", str(i), inter_geo_dict)
    # convert geos to WKT
    wkt_res = wkt_Converter(tmp_geo_lst)
    # wrapp WKT with RDF labels
    rdf_contents = RDF_Wrapper(wkt_res)
    # store RDF file locally
    rdf_export(rdf_case_study_file_path, "caseStudy.rdf", str(i), rdf_contents)
    # convert RDF file to JSON file and store it locally
    rdf_2_json_contents = rdfParsing2GeoData(rdf_contents)
    JSON_export(json_case_study_file_path, "caseStudy.json", str(i), rdf_2_json_contents)
    
"""    
# RDF for-loops
for i in range(1, 10):
    rdf_file_contents += str(i)
    index = str(i)
    rdf_export(rdf_file_path, rdf_file_name, index, rdf_file_contents)
# JSON for-loops
for j in range(1, 10):
    json_file_contents["test"]=str(j)
    index = str(j)
    JSON_export(json_file_path, json_file_name, index, json_file_contents)
"""
#====================================
OUT = 0
# ----------------------------------------
