# Dynamo graph ComplexGeometryGenerator.dyn (Dynamo 2.8.0.2471)

# group: Cylinder
cylinder_generator = Python()  # CPython3; frozen; unwired: IN[0]
# ---------- cylinder_generator.python (19 lines) ----------
import clr
import Autodesk.DesignScript.Geometry
clr.AddReference('ProtoGeometry')
from Autodesk.DesignScript.Geometry import *

#create a cuboid with specified lengths
cs = CoordinateSystem.Identity();
cub = Cuboid.ByLengths(cs, 5, 15, 2);
#create several cones
p1 = Point.ByCoordinates(0, 0, 10);
p2 = Point.ByCoordinates(0, 0, 20);
p3 = Point.ByCoordinates(0, 0, 30);
cone1 = Cone.ByPointsRadii(p1, p2, 10, 6);
cone2 = Cone.ByPointsRadii(p2, p3, 6, 0);
#make a cylinder
cylCS = cs.Translate(10, 0, 0);
cyl = Cylinder.ByRadiusHeight(cylCS, 3, 10);

OUT = cyl
# ----------------------------------------

watch_3d = Watch3D()  # unwired: arg0
code_block = CodeBlock()  # frozen
# ---------- code_block.designscript (5 lines) ----------
p=Point.ByCoordinates([0,7,20],[0,11,3]);
a=Arc.ByThreePoints(p[0],p[1],p[2]);
vec_Y=Vector.YAxis();
c=Circle.ByCenterPointRadiusNormal(p[0],1,vec_Y);
c.SweepAsSolid(a);
# ----------------------------------------

# group: Donut
code_block_2 = CodeBlock()  # frozen
# ---------- code_block_2.designscript (5 lines) ----------
pt=Point.ByCoordinates([0,5,5,0],[0,0,5,5]);
pt_lst=[pt[0],pt[1],pt[2],pt[3]];
is_close=true;
center_pt=pt[0];
radius=1;
# ----------------------------------------
YAxis = Vector.YAxis()
byCenterPointRadiusNormal = Circle.ByCenterPointRadiusNormal(centerPoint=code_block_2.center_pt, radius=code_block_2.radius, normal=YAxis)  # frozen
byPoints = NurbsCurve.ByPoints(points=code_block_2.pt_lst, closeCurve=code_block_2.is_close)  # frozen
code_block_3 = CodeBlock(circle=byCenterPointRadiusNormal, curve=byPoints) { solid=circle.SweepAsSolid(curve); }
code_block_4 = CodeBlock()  # frozen
# ---------- code_block_4.designscript (5 lines) ----------
pt=Point.ByCoordinates([-2.5, 0, 2, 0],[2.5, 2.5, 2.5, 2.5],[0, -2.5, 0, 2.5]);
pt_lst=[pt[0],pt[1],pt[2],pt[3]];
is_close=true;
center_pt=pt[0];
radius=1;
# ----------------------------------------
ZAxis = Vector.ZAxis()
byCenterPointRadiusNormal_2 = Circle.ByCenterPointRadiusNormal(centerPoint=code_block_4.center_pt, radius=code_block_4.radius, normal=ZAxis)  # frozen
byPoints_2 = NurbsCurve.ByPoints(points=code_block_4.pt_lst, closeCurve=code_block_4.is_close)  # frozen
code_block_5 = CodeBlock(circle=byCenterPointRadiusNormal_2, curve=byPoints_2) { solid=circle.SweepAsSolid(curve); }

# group: Constructive Solid Geometry (Union, Intersection, Difference)
code_block_6 = CodeBlock()
# ---------- code_block_6.designscript (5 lines) ----------
c_pt=Point.ByCoordinates(10,15,2.5);
radius=3;

min_pt=Point.ByCoordinates(8,17,0.5);
max_pt=Point.ByCoordinates(12,13,4.5);
# ----------------------------------------
byCenterPointRadius = Sphere.ByCenterPointRadius(centerPoint=code_block_6.c_pt, radius=code_block_6.radius)
byCorners = Cuboid.ByCorners(lowPoint=code_block_6.min_pt, highPoint=code_block_6.max_pt)
intersect = Geometry.Intersect(geometry=byCenterPointRadius, other=byCorners)
code_block_7 = CodeBlock { pt=Point.ByCoordinates([10,10],[15,15],[-1,6]); pt_lst=[pt[0],pt[1]]; is_close=false; center_pt=pt[0]; radius=1; }
ZAxis_2 = Vector.ZAxis()
byCenterPointRadiusNormal_3 = Circle.ByCenterPointRadiusNormal(centerPoint=code_block_7.center_pt, radius=code_block_7.radius, normal=ZAxis_2)
byPoints_3 = NurbsCurve.ByPoints(points=code_block_7.pt, closeCurve=code_block_7.is_close)
code_block_8 = CodeBlock(circle=byCenterPointRadiusNormal_3, curve=byPoints_3) { solid=circle.SweepAsSolid(curve); }
code_block_9 = CodeBlock { pt=Point.ByCoordinates([6,14],[15,15],[2.5,2.5]); pt_lst=[pt[0],pt[1]]; is_close=false; center_pt=pt[0]; radius=1; }
XAxis = Vector.XAxis()
byCenterPointRadiusNormal_4 = Circle.ByCenterPointRadiusNormal(centerPoint=code_block_9.center_pt, radius=code_block_9.radius, normal=XAxis)
byPoints_4 = NurbsCurve.ByPoints(points=code_block_9.pt, closeCurve=code_block_9.is_close)
code_block_10 = CodeBlock(circle=byCenterPointRadiusNormal_4, curve=byPoints_4) { solid=circle.SweepAsSolid(curve); }
union = Solid.Union(solid=code_block_8, solid_2=code_block_10)
code_block_11 = CodeBlock { pt=Point.ByCoordinates([10,10],[11,19],[2.5,2.5]); pt_lst=[pt[0],pt[1]]; is_close=false; center_pt=pt[0]; radius=1; }
YAxis_2 = Vector.YAxis()
byCenterPointRadiusNormal_5 = Circle.ByCenterPointRadiusNormal(centerPoint=code_block_11.center_pt, radius=code_block_11.radius, normal=YAxis_2)
byPoints_5 = NurbsCurve.ByPoints(points=code_block_11.pt, closeCurve=code_block_11.is_close)
code_block_12 = CodeBlock(circle=byCenterPointRadiusNormal_5, curve=byPoints_5) { solid=circle.SweepAsSolid(curve); }
union_2 = Solid.Union(solid=union, solid_2=code_block_12)
difference = Solid.Difference(solid=intersect, other=union_2)
watch_3d_2 = Watch3D(difference)
watch_3d_3 = Watch3D(intersect)
watch_3d_4 = Watch3D(union_2)
