# Dynamo graph QueryResultViewer.dyn (Dynamo 2.8.0.2471)
# packages: MeshToolkit 3.0.0

# group: Sphere testing
polygon1_name = Python()  # CPython3; unwired: IN[0], IN[1], IN[2]
# ---------- polygon1_name.python (40 lines) ----------
# Load the Python Standard and DesignScript Libraries
import sys
import clr
clr.AddReference('ProtoGeometry')
from Autodesk.DesignScript.Geometry import *

# The inputs to this node will be stored as a list in the IN variables.
#dataEnteringNode = IN
INDEX_EN = ['A','B','C','D'];
INDEX_NUM = ['1','2','3','4'];
INDEX = [];

if IN[2] == "EN":
    INDEX = INDEX_EN
if IN[2] == "NUM":
    INDEX = INDEX_NUM
"""
# Place your code below this line
def name_concatenation(geo_name:str, geo_number:int, index = INDEX):
    if geo_number > len(index):
        raise ValueError("No more indexes available!")
 
    geo_concat = [geo_name + index[i] for i in range(geo_number)]
    return geo_concat

def name_lst_concatenation(geo_name_lst:list, geo_number:int, index = INDEX):
    if geo_number > len(index):
        raise ValueError("No more indexes available!")
    
    geo_concat = [[geo_name + index[i] for i in range(geo_number)] for geo_name in geo_name_lst]
    return geo_concat


# Assign your output to the OUT variable.
if isinstance(IN[0], str):
    OUT = name_concatenation(IN[0], IN[1])
else:
    OUT = name_lst_concatenation(IN[0], IN[1])
"""
OUT = ""
# ----------------------------------------
code_block = CodeBlock()
# ---------- code_block.designscript (11 lines) ----------
centroid = Point.ByCoordinates(0,0,2);
offset = 2/2;
c_X = 0;
c_Y = 0;
c_Z = 2;

bottom_p1 = Point.ByCoordinates(c_X-offset, c_Y-offset, c_Z-offset);
bottom_p2 = Point.ByCoordinates(c_X-offset, c_Y+offset, c_Z-offset);
bottom_p3 = Point.ByCoordinates(c_X+offset, c_Y+offset, c_Z-offset);
bottom_p4 = Point.ByCoordinates(c_X+offset, c_Y-offset, c_Z-offset);
bottom_face = [bottom_p1, bottom_p2, bottom_p3, bottom_p4];
# ----------------------------------------
code_block_2 = CodeBlock { centroid = Point.ByCoordinates(-7, -3, 6); }
byCenterPointRadius = Sphere.ByCenterPointRadius()  # frozen
byGeometry = Autodesk.Dynamo.MeshToolkit.Mesh.ByGeometry(inputGeometry=byCenterPointRadius)
explode = Autodesk.Dynamo.MeshToolkit.Mesh.Explode(mesh=byGeometry)
watch = Watch(explode)
code_block_3 = CodeBlock(list=watch) { list; pol = list[0]; }
watch_2 = Watch(code_block_3.pol)
vertices = Autodesk.Dynamo.MeshToolkit.Mesh.Vertices(mesh=watch_2)
watch_3 = Watch(vertices)
watch_3d = Watch3D(watch_3)
triangleCentroids = Autodesk.Dynamo.MeshToolkit.Mesh.TriangleCentroids()  # unwired: mesh
code_block_4 = CodeBlock { 3; }
chop = List.Chop(list=triangleCentroids, lengths=code_block_4)

notes = CodeBlock()
# ---------- notes.designscript (8 lines) ----------
/**
* "F5": Run the script
* "Ctrl + I": Isolate Selected Geometry
* "Ctrl + P": Drag & Drop
*
*
*
**/;
# ----------------------------------------

# group: Geometry Selection
selection_board = CodeBlock()
# ---------- selection_board.designscript (11 lines) ----------
POINT = "POINT";
MULTIPOINT = "MULTIPOINT";
LINESTRING = "LINESTRING";
MULTILINESTRING = "MULTILINESTRING";
POLYGON = "POLYGON";
MULTIPOLYGON = "MULTIPOLYGON";
MULTIPOLYGON_ROTATION = "MULTIPOLYGON_ROTATION";
SPHERE = "MULTIPOLYGON-SPHERE";
GEOMETRYCOLLECTION = "GEOMETRYCOLLECTION";
geo_sel_lst=
["MULTIPOLYGON5"];
# ----------------------------------------
on_off = BoolSelector(false)
geometry_selector = Python(IN[1]=selection_board.geo_sel_lst, IN[2]=on_off)  # CPython3; unwired: IN[0]
# ---------- geometry_selector.python (45 lines) ----------
# Load the Python Standard and DesignScript Libraries
import sys
import clr
clr.AddReference('ProtoGeometry')
from Autodesk.DesignScript.Geometry import *
clr.AddReference('DSCoreNodes')
from DSCore import *
clr.AddReference('GeometryColor')
from Modifiers import GeometryColor

# Input
geo_lst = IN[0]
geo_sel_lst = IN[1]
switch = IN[2]


def inList(geo_sel_lst, geo):
    res = False
    for geo_sel in geo_sel_lst:
        if geo_sel is None:
            break
        if geo_sel.upper() == geo.upper():
            res = True
            break
    return res
#################################################
# Highlighter
colored_geo_lst = []
if switch:
    color = Color.ByARGB(138,43,226,0) # violet
    for geo in geo_lst:
        geo_name = geo[1]
        if inList(geo_sel_lst, geo_name):  
            geo_data = geo[0]
            colored_geo = ''
            if (geo[2].upper() == "LINESTRING" 
            or geo[2].upper() == "POLYGON" 
            or geo[2].upper() == "MULTIPOLYGON_ROTATION"):
                colored_geo = GeometryColor.ByGeometryColor(geo[3], color)
            else:
                colored_geo = GeometryColor.ByGeometryColor(geo_data, color)
            colored_geo_lst.append(colored_geo)

#################################################
OUT = colored_geo_lst
# ----------------------------------------
watch_3d_2 = Watch3D(geometry_selector)
watch_4 = Watch(watch_3d_2)

# group: XML(query result) Import and Parsing
on_off_import = BoolSelector(true)
file_path = Filename("..\..\..\..\..\..\..\resources\rdf\query_result.xml")
fileExists = FileSystem.FileExists(path=file_path)
watch_5 = Watch(file_path)
xml_parser = Python(IN[0]=fileExists, IN[1]=watch_5)  # CPython3
# ---------- xml_parser.python (88 lines) ----------
# Load the Python Standard and DesignScript Libraries
import sys
import clr
import ctypes
import xml.etree.ElementTree as ET
sys.path.append(r"C:\Users\yhe\AppData\Local\Programs\Python\Python310\Lib\site-packages")

clr.AddReference('ProtoGeometry')
from Autodesk.DesignScript.Geometry import *
from xml.dom.minidom import parse, parseString

#dir = "r'C:\\Users\\nobita_yhe\\Workspace\\ExtendingJena\\src\\main\\resources\\rdf\\query_result.xml'"
#dir = r'C:\Users\nobita_yhe\Workspace\ExtendingJena\src\main\resources\rdf\query_result.xml'
warn_str = '(XML) File or File Path does not exist.'
res = ''
######################################################

def xmlParsing2Uri(path=dir):
    """ it returns the list in structure like [[uri1, uri2],...,[uri1, uri2]]"""
    dom = parse(path)
    data = dom.documentElement
    resList = data.getElementsByTagName('result')
    
    res_lst = []
    for res in resList: # handle the <result>...</result>
        ur_lst = []
        for bi in res.getElementsByTagName('binding'): # handle the <binding>...</binding>
            for ur in bi.getElementsByTagName('uri'):
                ur_lst.append(ur.childNodes[0].nodeValue)
        res_lst.append(ur_lst)
        ur_lst = []
    return res_lst


def xml2GeometryString(path=dir):
    """ it returns the list in structure like [[Geomety1, Geomety2],...,[Geomety1, Geomety2]]"""
    dom = parse(path)
    data = dom.documentElement
    resList = data.getElementsByTagName('result')
    seperator = '#'

    res_lst = []
    for res in resList: # handle the <result>...</result>
        ur_lst = []
        for bi in res.getElementsByTagName('binding'): # handle the <binding>...</binding>
            for ur in bi.getElementsByTagName('uri'):
                uri_str = ur.childNodes[0].nodeValue
                geo_index = uri_str.find(seperator) 
                geo_str = uri_str[geo_index+1:]
                ur_lst.append(geo_str)
        res_lst.append(ur_lst)
        ur_lst = []
    return res_lst

def xml2GeoInDynamo(path=dir):
    #with open(r'C:\Users\nobita_yhe\Workspace\ExtendingJena\src\main\resources\rdf\query_result.xml', 'r', encoding='utf-8') as file:
    with open(path, 'r', encoding='utf-8') as file:
        xml_data = file.read()
        dom = parseString(xml_data)
        #dom = parse(xml_data)
        data = dom.documentElement
        resList = data.getElementsByTagName('result')
        seperator = '#'
        
        res_lst = []
        for res in resList: # handle the <result>...</result>
            ur_lst = []
            for bi in res.getElementsByTagName('binding'): # handle the <binding>...</binding>
                for ur in bi.getElementsByTagName('uri'):
                    uri_str = ur.childNodes[0].nodeValue
                    geo_index = uri_str.find(seperator) 
                    geo_str = uri_str[geo_index+1:]
                    ur_lst.append(geo_str)
            res_lst.append(ur_lst)
            ur_lst = []
    return res_lst
    
######################################################

if IN[0] == True:
    dir = IN[1]
    res = xml2GeoInDynamo(dir)
else:
	ctypes.windll.user32.MessageBoxW(0, warn_str, 'Input Exception',1)
	res = warn_str
######################################################
# Assign your output to the OUT variable.
OUT = res
# ----------------------------------------
switcher = CodeBlock(SW=on_off_import, data=xml_parser) { SW == "True"? data : null; }
list_viewer = Watch(switcher)
list_to_dict = Python(IN[0]=list_viewer)  # CPython3
# ---------- list_to_dict.python (34 lines) ----------
# Load the Python Standard and DesignScript Libraries
import sys
import clr
clr.AddReference('ProtoGeometry')
from Autodesk.DesignScript.Geometry import *

def flatten(inp_lst):
# Core: 
#		1. traverse the input list 
#		2. concatenate each two adjacent elements 
#		3. store the concatenation into the output list
#		4. remove the non-list element out of the input list
    out_lst = []
    while True:
        if inp_lst == []:
            break
        for ind, val in enumerate(inp_lst):
            if type(val) == list:
                inp_lst = val + inp_lst[ind+1:]
                break
            else:
                out_lst.append(val)
                inp_lst.pop(ind)
                break
    return out_lst
    
###################################################
res_lst = flatten(IN[0])

res_dict = {}
for res in res_lst:
    res_dict[res] = res

OUT = res_dict
# ----------------------------------------
json_viewer = Watch(list_to_dict)

# group: JSON Import and Parsing
file_path_2 = Filename("..\..\..\..\..\..\..\resources\JSON\xxl3DScene.json")
json_loader = Python(IN[0]=file_path_2)  # CPython3
# ---------- json_loader.python (22 lines) ----------
# Load the Python Standard and DesignScript Libraries
import sys
import clr
import json
import ctypes
clr.AddReference('ProtoGeometry')
from Autodesk.DesignScript.Geometry import *

# The inputs to this node will be stored as a list in the IN variables.
dir = IN[0]

warn_str = '(Base) File or File Path does not exist.'

data = {}
try:
    with open(dir, 'r') as fp:
        data = json.load(fp)
except:
    ctypes.windll.user32.MessageBoxW(0, warn_str, 'Input Exception',1)

# Assign your output to the OUT variable.
OUT = data
# ----------------------------------------
json_base_viewer = Watch(json_loader)
file_path_3 = Filename("..\..\..\..\..\..\..\resources\JSON\groundTruth.json")
json_loader_2 = Python(IN[0]=file_path_3)  # CPython3
# ---------- json_loader_2.python (24 lines) ----------
# Load the Python Standard and DesignScript Libraries
import sys
import clr
import json
import ctypes
clr.AddReference('ProtoGeometry')
from Autodesk.DesignScript.Geometry import *

# The inputs to this node will be stored as a list in the IN variables.
dir = IN[0]

warn_str = '<GroundTruth> File or File Path does not exist.'

data = {}
try:
    with open(dir, 'r') as fp:
        data = json.load(fp)
except:
    ctypes.windll.user32.MessageBoxW(0, warn_str, 'Input Exception',1)

# Assign your output to the OUT variable.
if data is None:
    data = {}
OUT = data
# ----------------------------------------
json_groundtruth_viewer = Watch(json_loader_2)
on_off_loading_json = BoolSelector(true)
on_off_ground_truth = BoolSelector(true)
on_off_query_result = BoolSelector(true)
json_parser = Python(IN[0]=json_base_viewer, IN[1]=json_viewer, IN[2]=json_groundtruth_viewer, IN[3]=on_off_loading_json, IN[4]=on_off_ground_truth, IN[5]=on_off_query_result)  # CPython3
# ---------- json_parser.python (228 lines) ----------
import sys
import clr
import random
clr.AddReference('ProtoGeometry')
from Autodesk.DesignScript.Geometry import *
clr.AddReference('DSCoreNodes')
from DSCore import *
clr.AddReference('GeometryColor')
from Modifiers import GeometryColor
clr.AddReference('MeshToolkit')
from Autodesk.Dynamo.MeshToolkit import *

############# Common Geometry Types ##################
POINT = "POINT";
MULTIPOINT = "MULTIPOINT";
LINESTRING = "LINESTRING";
MULTILINESTRING = "MULTILINESTRING";
POLYGON = "POLYGON";
POLYGON_ROTATION = "POLYGON_ROTATION"
MULTIPOLYGON = "MULTIPOLYGON"
MULTIPOLYGON_ROTATION = "MULTIPOLYGON_ROTATION"
SPHERE = "MULTIPOLYGON_SPHERE"
GEOMETRYCOLLECTION = "GEOMETRYCOLLECTION";

"""
NUM_MULTIPOLYGON = 10
NUM_POLYGON = 10
NUM_LINESTRING = 10
NUM_POINT = 10
"""
###################### Input ######################### 
json_file = IN[0]
res_dict = IN[1]
ground_truth_dict = IN[2]
switch_generator = IN[3]
switch_ground_truth = IN[4]
switch_query_result = IN[5]

################# Container ####################
geo_lst = []

geo_pt_lst = []
geo_li_lst = []
geo_pol_lst = []
geo_mPol_lst = []
geo_sph_lst = []

geo_combi_lst = []

################# Color & Filter #####################
color_green_ground_truth = Color.ByARGB(230,230,250,0)
color_red_query_result = Color.ByARGB(255,255,0,0)

"""
color = ""
filter_dict = json_file
switch_coloring = False

if switch_ground_truth and not switch_query_result:
    switch_coloring = True
    color = color_green_ground_truth
    filter_dict = ground_truth_dict
    
if not switch_ground_truth and switch_query_result:
    switch_coloring = True
    color = color_red_query_result
    filter_dict = res_dict
    
if switch_ground_truth and switch_query_result:
    switch_coloring = False
    color = ""
    filter_dict = json_file
    
def coloring(geometry, geo_name):
    if switch_coloring:
        
        if geo_name in filter_dict.keys():
            return GeometryColor.ByGeometryColor(geometry, color)
            
    return geometry
"""
def coloring(geometry, geo_name):
    if switch_ground_truth and not switch_query_result:
        if geo_name in ground_truth_dict.keys():
            return GeometryColor.ByGeometryColor(geometry, color_green_ground_truth)
    
    if not switch_ground_truth and switch_query_result:
        if geo_name in res_dict.keys():
            return GeometryColor.ByGeometryColor(geometry, color_red_query_result)
    
    if switch_ground_truth and switch_query_result:
        temp_geometry = geometry
        if geo_name in ground_truth_dict.keys():
            temp_geometry = GeometryColor.ByGeometryColor(geometry, color_green_ground_truth)
        if geo_name in res_dict.keys():
            temp_geometry = GeometryColor.ByGeometryColor(geometry, color_red_query_result)
        return temp_geometry
        
    return geometry 
######################## Body #######################

if switch_generator == False:
    OUT = []
    sys.exit(0)
    
for geo_name, geo_data in json_file.items():
   
    if ( geo_name.find('POINT') != -1 or
        geo_name.find('Point') != -1 ):

        pt_data = geo_data
        pt_x = 0.0
        pt_y = 0.0
        pt_z = 0.0
        if (len(pt_data) == 3): # (x, y, z)
            pt_x = pt_data[0]
            pt_y = pt_data[1]
            pt_z = pt_data[2]
            
        if (len(pt_data) == 2): # (x, y)
            pt_x = pt_data[0]
            pt_y = pt_data[1]
            pt_z = 0.0
            
        pt = Point.ByCoordinates(pt_x, pt_y, pt_z)

        geo_data = pt
        geo_name = geo_name.upper()
        geo_type = 'POINT'
        geometry = coloring(pt, geo_name.upper())

        geo_pt_obj = (geo_data, geo_name, geo_type, geometry)
        geo_pt_lst.append(geo_pt_obj)
        continue

    if ( geo_name.find('LINESTRING') != -1 or
        geo_name.find('Linestring') != -1 or
        geo_name.find('LINE') != -1 or
        geo_name.find('Line') != -1 ):

        pt_lst = []
        for pt_data in geo_data[0]:
            pt = Point.ByCoordinates(pt_data[0], pt_data[1], pt_data[2])
            pt_lst.append(pt)

        geo_data = pt_lst
        geo_name = geo_name.upper()
        geo_type = 'LINESTRING'
        geometry = coloring(PolyCurve.ByPoints(pt_lst, False), geo_name.upper())

        geo_li_obj = (geo_data, geo_name, geo_type, geometry)
        geo_li_lst.append(geo_li_obj)
        continue

    if ( geo_name.find('SPHERE') != -1 or
        geo_name.find('Sphere') != -1 ):

        face_lst = []
        for face_data in geo_data:

            pt_lst = []
            for vert_data in face_data:
                pt = Point.ByCoordinates(vert_data[0], vert_data[1], vert_data[2])
                pt_lst.append(pt)
            face = coloring(Surface.ByPerimeterPoints(pt_lst), geo_name.upper())
            face_lst.append(face)

        geo_data = face_lst
        geo_name = geo_name.upper()
        geo_type = 'MULTIPOLYGON_SPHERE'
        geometry = face_lst

        geo_sph_obj = (geo_data, geo_name, geo_type, geometry)
        geo_sph_lst.append(geo_sph_obj)
        continue

    if ( geo_name.find('MULTIPOLYGON') != -1 or
        geo_name.find('Multipolygon') != -1  or
        geo_name.find('CUBE') != -1 or
        geo_name.find('Cube') != -1 ):

        face_lst = []
        for face_data in geo_data:

            pt_lst = []
            for vert_data in face_data:
                pt = Point.ByCoordinates(vert_data[0], vert_data[1], vert_data[2])
                pt_lst.append(pt)
                # print()
            face = coloring(Surface.ByPerimeterPoints(pt_lst), geo_name.upper())
            # face = []
            face_lst.append(face)

        geo_data = face_lst
        geo_name = geo_name.upper()
        geo_type = 'MULTIPOLYGON'
        geometry = face_lst

        geo_mPol_obj = (geo_data, geo_name, geo_type, geometry)
        geo_mPol_lst.append(geo_mPol_obj)
        continue

    if ( geo_name.find('POLYGON') != -1 or 
        geo_name.find('Polygon') != -1 ):
        
        pt_lst = []
        for vert_data in geo_data[0]:
            pt = Point.ByCoordinates(vert_data[0], vert_data[1], vert_data[2])
            pt_lst.append(pt)
            # print()
        face = Surface.ByPerimeterPoints(pt_lst)
        #face = []

        geo_data = pt_lst
        geo_name = geo_name.upper()
        geo_type = 'POLYGON'
        geometry = coloring(face, geo_name.upper())
        # geometry = geo_data

        geo_pol_obj = (geo_data, geo_name, geo_type, geometry)
        geo_pol_lst.append(geo_pol_obj)
        continue

    
geo_combi_lst = geo_pt_lst + geo_li_lst + geo_pol_lst + geo_mPol_lst + geo_sph_lst

######################### Output ############################
OUT = geo_combi_lst
# ----------------------------------------
watch_6 = Watch(json_parser)
watch_3d_3 = Watch3D(json_parser)

# group: Accuracy Calculation
accuracy_calculator = Python(IN[0]=list_to_dict, IN[1]=json_loader_2)  # CPython3
# ---------- accuracy_calculator.python (27 lines) ----------
# Load the Python Standard and DesignScript Libraries
import sys
import clr
clr.AddReference('ProtoGeometry')
from Autodesk.DesignScript.Geometry import *

################# Input #######################
res_dict = IN[0]
ground_truth_dict = IN[1]

################## Body ####################
res = ""
if not (res_dict is None) and not (ground_truth_dict is None):
    
    count = 0
    for res_key in res_dict.keys():
    
        if res_key in ground_truth_dict.keys():
            count += 1
            
    ac = count/len(ground_truth_dict)
    if ac <= 1.0:
        res = f"Num of geometries in Query Result: {len(res_dict)},\nNum of geometries in Ground Truth: {len(ground_truth_dict)},\nAccuracy: {ac*100}%"
    else:
        res = "Exception in the calculation."
################## Output ###################
OUT = res
# ----------------------------------------
watch_7 = Watch(accuracy_calculator)
foreigner_selector = Python(IN[0]=list_to_dict, IN[1]=json_loader_2)  # CPython3
# ---------- foreigner_selector.python (18 lines) ----------
# Load the Python Standard and DesignScript Libraries
import sys
import clr
clr.AddReference('ProtoGeometry')
from Autodesk.DesignScript.Geometry import *

################# Input #######################
res_dict = IN[0]
ground_truth_dict = IN[1]

################## Body ####################
foreigner_lst = []
if not (res_dict is None) and not (ground_truth_dict is None):
    
    foreigner_lst = [ res_key for res_key in res_dict.keys() if res_key not in ground_truth_dict.keys() ]   
    
################## Output ###################
OUT = foreigner_lst
# ----------------------------------------
watch_8 = Watch(foreigner_selector)

# group: RDF-to-JSON
on_off_2 = BoolSelector(false)
rdf_json_converter = Python(IN[0]=on_off_2)  # CPython3
# ---------- rdf_json_converter.python (125 lines) ----------
# Load the Python Standard and DesignScript Libraries
import sys
import clr
import ctypes
import xml.etree.ElementTree as ET
sys.path.append(r"C:\Users\yhe\AppData\Local\Programs\Python\Python310\Lib\site-packages")

clr.AddReference('ProtoGeometry')
from Autodesk.DesignScript.Geometry import *
from xml.dom.minidom import parse, parseString

warn_str = '<.dyn> File or File Path does not exist.'
res = ''
######################################################

def rdfParsing2GeoData(path=dir):
    """ it returns the json file in structure like { "POLYGON1" : [...], 
                                                     "POLYGON2" : [...], 
                                                     "MULTIPOLYGON1" : [...], ...
                                                    }
    """
    geo_dict = {}
    dom = parse(path)
    data = dom.documentElement
    rdf_desc_lst = data.getElementsByTagName("rdf:Description")
    # geo_in_wkt = data.getElementsByTagName("geo:asWKT")

    for i in range(1, len(rdf_desc_lst)): # first description element (root element) should be removed.
        descr_el = rdf_desc_lst[i]
        geo_name_num = descr_el.attributes._attrs['rdf:about'].nodeValue.split('#')[1]
        geo_wkt_data = ""
        try:
            geo_wkt_data = descr_el.childNodes[0].firstChild.data
        except:
            geo_wkt_data = descr_el.childNodes[1].firstChild.data
        geo_algebra_lst = []

        if ( geo_name_num.find('POINT') != -1 or
            geo_name_num.find('Point') != -1 ):
            
            wkt_data_lst = geo_wkt_data.split("(")[1] # remove title 'POINT'
            vert_str_lst = wkt_data_lst
            vert_str_lst = vert_str_lst.replace( ")", "" ) # remove character ')'

            pt_algebra_lst = []
            pt_str_lst = vert_str_lst.split(" ")

            pt_algebra_lst = [ float(pt_str) for pt_str in pt_str_lst ]
            geo_algebra_lst.append(pt_algebra_lst)
            
        if ( geo_name_num.find('LINESTRING') != -1 or
            geo_name_num.find('Linestring') != -1 or
            geo_name_num.find('LINE') != -1 or
            geo_name_num.find('Line') != -1 ):

            wkt_data_lst = geo_wkt_data.split("((")[1] # remove title 'LINESTRING'
            vert_str_lst = wkt_data_lst
            vert_str_lst = vert_str_lst.replace( ")", "" ) # remove character ')'
            vert_str_lst = vert_str_lst.split(", ")

            line_algebra_lst = []
            for i in range(0, len(vert_str_lst)):

                pt_str_lst = vert_str_lst[i].split(" ")
                line_algebra_lst.append([ float(pt_str) for pt_str in pt_str_lst ])
            geo_algebra_lst.append(line_algebra_lst)

        if ( geo_name_num.find('POLYGON') != -1 or 
            geo_name_num.find('Polygon') != -1 ):

            wkt_data_lst = geo_wkt_data.split("((")[1] # remove title 'POLYGON Z'
            vert_str_lst = wkt_data_lst
            vert_str_lst = vert_str_lst.replace( ")", "" ) # remove character ')'
            vert_str_lst = vert_str_lst.replace( "(", "" ) # remove character '('
            vert_str_lst = vert_str_lst.split(", ")

            face_algebra_lst = []
            for i in range(0, len(vert_str_lst)-1): # last point not included

                pt_str_lst = vert_str_lst[i].split(" ")
                face_algebra_lst.append([ float(pt_str) for pt_str in pt_str_lst ])
            geo_algebra_lst.append(face_algebra_lst)

        if ( geo_name_num.find('MULTIPOLYGON') != -1 or
            geo_name_num.find('Multipolygon') != -1  or
            geo_name_num.find('CUBE') != -1 or
            geo_name_num.find('Cube') != -1 or
            geo_name_num.find('SPHERE') != -1 or
            geo_name_num.find('Sphere') != -1 ):

            wkt_data_lst = geo_wkt_data.split("(((")[1] # remove title 'MULTIPOLYGON Z'
            face_str_lst = wkt_data_lst.split("), ")

            face_algebra_lst = []
            for face_str in face_str_lst:
                vert_str_lst = face_str.replace( ")", "" ) # remove character ')'
                vert_str_lst = vert_str_lst.replace( "(", "" ) # remove character '('
                vert_str_lst = vert_str_lst.split(", ")

                pt_algebra_lst = []
                for i in range(0, len(vert_str_lst)-1): # last point not included

                    pt_str_lst = vert_str_lst[i].split(" ")
                        
                    pt_algebra = [ float(pt_str) for pt_str in pt_str_lst ]
                    pt_algebra_lst.append(pt_algebra)

                face_algebra_lst.append(pt_algebra_lst)
            geo_algebra_lst = face_algebra_lst

        if geo_name_num not in geo_dict.keys():
            geo_dict[geo_name_num] = geo_algebra_lst
    return geo_dict
    
######################################################
json_file = {}
if IN[0]:
    try:
        dir = "C:\\Users\\yhe\\Documents\\Developer\\Repo\\ExtendingJena\\src\\main\\resources\\rdf\\xxl3DScene.rdf"
        json_file = rdfParsing2GeoData(dir)
    except:
        ctypes.windll.user32.MessageBoxW(0, warn_str, 'Input Exception',1)

######################### Output ##########################
OUT = json_file
# ----------------------------------------
json_writer = Python(IN[0]=rdf_json_converter, IN[1]=on_off_2)  # CPython3
# ---------- json_writer.python (24 lines) ----------
# Load the Python Standard and DesignScript Libraries
import sys
import clr
import json
clr.AddReference('ProtoGeometry')
from Autodesk.DesignScript.Geometry import *

dir = "C:\\Users\\yhe\\Documents\\Developer\\Repo\\ExtendingJena\\src\\main\\resources\\JSON\\xxl3DScene.json"
warn_str = '<.json> File or File Path does not exist.'


json_file = IN[0]
switch_writer = IN[1]

res = False

if switch_writer:
    try: 
        with open(dir, 'w') as fp:
            json.dump(json_file, fp, sort_keys=True, indent=4)
        res = True
    except:
        ctypes.windll.user32.MessageBoxW(0, warn_str, 'Input Exception',1)
OUT = res
# ----------------------------------------
json_viewer_2 = Watch(json_writer)
