# Dynamo graph VoxelModelGenerator.dyn (Dynamo 2.8.0.2471)
# packages: MeshToolkit 3.0.0

# group: Complex Geometry Generator
cylinder_generator = Python()  # CPython3; unwired: IN[0]
# ---------- cylinder_generator.python (19 lines) ----------
import clr
import Autodesk.DesignScript.Geometry
clr.AddReference('ProtoGeometry')
from Autodesk.DesignScript.Geometry import *

#create a cuboid with specified lengths
cs = CoordinateSystem.Identity();
cub = Cuboid.ByLengths(cs, 5, 15, 2);
#create several cones
p1 = Point.ByCoordinates(0, 0, 10);
p2 = Point.ByCoordinates(0, 0, 20);
p3 = Point.ByCoordinates(0, 0, 30);
cone1 = Cone.ByPointsRadii(p1, p2, 10, 6);
cone2 = Cone.ByPointsRadii(p2, p3, 6, 0);
#make a cylinder
cylCS = cs.Translate(10, 0, 0);
cyl = Cylinder.ByRadiusHeight(cylCS, 3, 10);

OUT = cyl
# ----------------------------------------
watch = Watch(cylinder_generator)
watch_3d = Watch3D(watch)

# group: Cuboid Vertices
code_block = CodeBlock { 50; 50; 50; 5; }
byLengths = Cuboid.ByLengths(width=code_block.out0, length=code_block.out1, height=code_block.out2)
vertices = Topology.Vertices(topology=byLengths)
python_script = Python(IN[0]=vertices)  # CPython3
# ---------- python_script.python (30 lines) ----------
# Load the Python Standard and DesignScript Libraries
import sys
import clr
clr.AddReference('ProtoGeometry')


#from Autodesk.DesignScript.Geometry import Vertex
from Autodesk.DesignScript.Geometry import *

# The inputs to this node will be stored as a list in the IN variables.
vert_lst = IN[0]

pt_lst = []

for vert in vert_lst:
    offset = 2
    pt = vert.PointGeometry
    pt_lst.append(pt)
    """
    for i in range(1,4):
        new_X = pt.X + offset * i
        new_Y = pt.Y + offset * i
        new_Z = pt.Z + offset * i
        new_pt = Point.ByCoordinates(new_X, new_Y, new_Z)
        pt_lst.append(new_pt)
    """


# Assign your output to the OUT variable.
OUT = pt_lst
# ----------------------------------------

# group: XYZ File Loader
file_path = Filename("..\..\..\..\..\..\..\..\resources\gridPoints\sample_grid_points.xyz")
readText = FileSystem.ReadText()  # unwired: file
string_Parser = Python(IN[0]=readText)  # IronPython2
# ---------- string_Parser.python (24 lines) ----------
# Phython-Standard- und DesignScript-Bibliotheken laden
import sys
import clr
import StringIO
clr.AddReference('ProtoGeometry')
from Autodesk.DesignScript.Geometry import *

# Die Eingaben für diesen Block werden in Form einer Liste in den IN-Variablen gespeichert.
dataEnteringNode = IN
pointsText = dataEnteringNode[0]


# Code unterhalb dieser Linie platzieren
result = []
buf = StringIO.StringIO(pointsText)
l = buf.readline()
while(l):
	ls = l.split(" ")
	p = Point.ByCoordinates(float(ls[0]),float(ls[2]),float(ls[1]))
	result.append(p)
	l = buf.readline()

# Weisen Sie Ihre Ausgabe der OUT-Variablen zu.
OUT = result
# ----------------------------------------
grids_Parser = Python(IN[0]=string_Parser)  # CPython3
# ---------- grids_Parser.python (29 lines) ----------
# Load the Python Standard and DesignScript Libraries
import sys
import clr
clr.AddReference('ProtoGeometry')
from Autodesk.DesignScript.Geometry import *

# The inputs to this node will be stored as a list in the IN variables.
gridPoints = IN[0]

# Generate the bounding boxes for each grid point
boundingBoxes = []
for i in range(1,len(gridPoints)+1):
    bb = BoundingBox.ByCorners(gridPoints[i-1], gridPoints[i])
    boundingBoxes.append(bb)

# Convert the bounding boxes to cuboids
voxels = []
"""
for boundingBox in boundingBoxes:
    min_pt = boundingBox.MinPoint
    max_pt = Point.ByCoordinates(
    boundingBox.MaxPoint.X-boundingBox.MinPoint.X, 
    boundingBox.MaxPoint.Y-boundingBox.MinPoint.Y, 
    boundingBox.MaxPoint.Z-boundingBox.MinPoint.Z)
    cuboid = Cuboid.ByLengths(min_pt, max_pt)
    voxels.append(cuboid)
    """
# Assign your output to the OUT variable.
OUT = boundingBoxes
# ----------------------------------------

# group: [Template] Tunnel Model
tunnel_model_alignment = CodeBlock()  # unwired: inp_lst
# ---------- tunnel_model_alignment.designscript (7 lines) ----------
pt_lst=inp_lst;
p=Point.ByCoordinates([0,7,20],[0,11,3],[0,2,3]);
a=Arc.ByThreePoints(p[0],p[1],p[2]);
curve=NurbsCurve.ByControlPoints(pt_lst);
vec_Y=Vector.YAxis();
c=Circle.ByCenterPointRadiusNormal(pt_lst[0],1,vec_Y);
c.SweepAsSolid(curve);
# ----------------------------------------
template_tunnel_model_alignment = CodeBlock()
# ---------- template_tunnel_model_alignment.designscript (5 lines) ----------
p=Point.ByCoordinates([0,7,20],[0,11,3],[0,2,3]);
a=Arc.ByThreePoints(p[0],p[1],p[2]);
vec_Y=Vector.YAxis();
c=Circle.ByCenterPointRadiusNormal(p[0],1,vec_Y);
c.SweepAsSolid(a);
# ----------------------------------------

# group: Voxel Model
code_block_2 = CodeBlock { x_range=10; y_range=30; z_range=5; step_size=1; }
grid_points_layer1 = Python(IN[0]=code_block_2.x_range, IN[1]=code_block_2.y_range, IN[2]=code_block_2.z_range, IN[3]=code_block_2.step_size)  # CPython3
# ---------- grid_points_layer1.python (43 lines) ----------
# Load the Python Standard and DesignScript Libraries
import sys
import clr
clr.AddReference('ProtoGeometry')
from Autodesk.DesignScript.Geometry import *

# The inputs to this node will be stored as a list in the IN variables.
x_range = IN[0]
y_range = IN[1]
z_range = IN[2]
step_size = IN[3]


def generate_corner_grid(x_range, y_range, z_range, step_size=1):
    # grid_size = 50
    std_min_pt = Point.ByCoordinates(0,0,0)
    std_max_pt = Point.ByCoordinates(step_size,step_size,step_size)
    std_pt_set = (std_min_pt, std_max_pt)

    # Initialize the grid points list
    grid_pt_set = []
    for i in range(0, x_range):
        mod_x_min_pt = Point.ByCoordinates(std_pt_set[0].X+i*step_size, std_pt_set[0].Y, std_pt_set[0].Z)
        mod_x_max_pt = Point.ByCoordinates(std_pt_set[1].X+i*step_size, std_pt_set[1].Y, std_pt_set[1].Z)
        x_mod_pt_set = (mod_x_min_pt, mod_x_max_pt)
        grid_pt_set.append(x_mod_pt_set)

        for j in range(1, y_range):
            mod_y_min_pt = Point.ByCoordinates(x_mod_pt_set[0].X, x_mod_pt_set[0].Y+j*step_size, x_mod_pt_set[0].Z)
            mod_y_max_pt = Point.ByCoordinates(x_mod_pt_set[1].X, x_mod_pt_set[1].Y+j*step_size, x_mod_pt_set[1].Z)
            y_mod_pt_set = (mod_y_min_pt, mod_y_max_pt)
            grid_pt_set.append(y_mod_pt_set)

            for k in range(1, z_range):
                mod_z_min_pt = Point.ByCoordinates(y_mod_pt_set[0].X, y_mod_pt_set[0].Y, y_mod_pt_set[0].Z+k*step_size)
                mod_z_max_pt = Point.ByCoordinates(y_mod_pt_set[1].X, y_mod_pt_set[1].Y, y_mod_pt_set[1].Z+k*step_size)
                z_mod_pt_set = (mod_z_min_pt, mod_z_max_pt)
                grid_pt_set.append(z_mod_pt_set)
    
    return grid_pt_set

grid_pt_set = generate_corner_grid(x_range, y_range, z_range, step_size)
OUT = grid_pt_set
# ----------------------------------------
bounding_boxes_layer1 = Python(IN[0]=grid_points_layer1)  # IronPython2
# ---------- bounding_boxes_layer1.python (34 lines) ----------
# Load the Python Standard and DesignScript Libraries
import sys
import clr
clr.AddReference('ProtoGeometry')
from Autodesk.DesignScript.Geometry import *
clr.AddReference('DSCoreNodes')
from DSCore import *
clr.AddReference('GeometryColor')
from Modifiers import GeometryColor
clr.AddReference('MeshToolkit')
from Autodesk.Dynamo.MeshToolkit import *

# The inputs to this node will be stored as a list in the IN variables.
Grid_pt_sets = IN[0]
color_green = Color.ByARGB(230,230,250,0)
color_red = Color.ByARGB(255,255,0,0)

def coloring(geometry, color):
	display = GeometryColor.ByGeometryColor(geometry, color)
	return display

bb_cuboid_lst = []
for min_pt, max_pt in Grid_pt_sets:
    b_box = BoundingBox.ByCorners(min_pt, max_pt)
    bb_cuboid = BoundingBox.ToCuboid(b_box)
    
    geo_data = (min_pt, max_pt)
    geo_name = "MULTIPOLYGON-Voxel"
    geo_type = "MULTIPOLYGON"
    geometry = coloring(bb_cuboid, color_red)
    
    bb_cuboid_lst.append((geo_data, geo_name, geo_type, geometry))    

OUT = bb_cuboid_lst
# ----------------------------------------
grid_points_layer2 = Python(IN[0]=code_block_2.x_range, IN[1]=code_block_2.y_range, IN[2]=code_block_2.z_range, IN[3]=code_block_2.step_size)  # CPython3
# ---------- grid_points_layer2.python (43 lines) ----------
# Load the Python Standard and DesignScript Libraries
import sys
import clr
clr.AddReference('ProtoGeometry')
from Autodesk.DesignScript.Geometry import *

# The inputs to this node will be stored as a list in the IN variables.
x_range = IN[0]
y_range = IN[1]
z_range = IN[2]
step_size = IN[3]


def generate_corner_grid(x_range, y_range, z_range, step_size=1):
    # grid_size = 50
    std_min_pt = Point.ByCoordinates(0, 0, z_range)
    std_max_pt = Point.ByCoordinates(step_size,step_size,step_size+z_range)
    std_pt_set = (std_min_pt, std_max_pt)

    # Initialize the grid points list
    grid_pt_set = []
    for i in range(0, x_range):
        mod_x_min_pt = Point.ByCoordinates(std_pt_set[0].X+i*step_size, std_pt_set[0].Y, std_pt_set[0].Z)
        mod_x_max_pt = Point.ByCoordinates(std_pt_set[1].X+i*step_size, std_pt_set[1].Y, std_pt_set[1].Z)
        x_mod_pt_set = (mod_x_min_pt, mod_x_max_pt)
        grid_pt_set.append(x_mod_pt_set)

        for j in range(1, y_range):
            mod_y_min_pt = Point.ByCoordinates(x_mod_pt_set[0].X, x_mod_pt_set[0].Y+j*step_size, x_mod_pt_set[0].Z)
            mod_y_max_pt = Point.ByCoordinates(x_mod_pt_set[1].X, x_mod_pt_set[1].Y+j*step_size, x_mod_pt_set[1].Z)
            y_mod_pt_set = (mod_y_min_pt, mod_y_max_pt)
            grid_pt_set.append(y_mod_pt_set)

            for k in range(1, z_range):
                mod_z_min_pt = Point.ByCoordinates(y_mod_pt_set[0].X, y_mod_pt_set[0].Y, y_mod_pt_set[0].Z+k*step_size)
                mod_z_max_pt = Point.ByCoordinates(y_mod_pt_set[1].X, y_mod_pt_set[1].Y, y_mod_pt_set[1].Z+k*step_size)
                z_mod_pt_set = (mod_z_min_pt, mod_z_max_pt)
                grid_pt_set.append(z_mod_pt_set)
    
    return grid_pt_set

grid_pt_set = generate_corner_grid(x_range, y_range, z_range, step_size)
OUT = grid_pt_set
# ----------------------------------------
bounding_boxes_layer2 = Python(IN[0]=grid_points_layer2)  # IronPython2
# ---------- bounding_boxes_layer2.python (34 lines) ----------
# Load the Python Standard and DesignScript Libraries
import sys
import clr
clr.AddReference('ProtoGeometry')
from Autodesk.DesignScript.Geometry import *
clr.AddReference('DSCoreNodes')
from DSCore import *
clr.AddReference('GeometryColor')
from Modifiers import GeometryColor
clr.AddReference('MeshToolkit')
from Autodesk.Dynamo.MeshToolkit import *

# The inputs to this node will be stored as a list in the IN variables.
Grid_pt_sets = IN[0]
color_green = Color.ByARGB(230,230,250,0)
color_red = Color.ByARGB(255,255,0,0)

def coloring(geometry, color):
	display = GeometryColor.ByGeometryColor(geometry, color)
	return display

bb_cuboid_lst = []
for min_pt, max_pt in Grid_pt_sets:
    b_box = BoundingBox.ByCorners(min_pt, max_pt)
    bb_cuboid = BoundingBox.ToCuboid(b_box)
    
    geo_data = (min_pt, max_pt)
    geo_name = "MULTIPOLYGON-Voxel"
    geo_type = "MULTIPOLYGON"
    geometry = coloring(bb_cuboid, color_green)
    
    bb_cuboid_lst.append((geo_data, geo_name, geo_type, geometry))   

OUT = bb_cuboid_lst
# ----------------------------------------
grid_points_layer3 = Python(IN[0]=code_block_2.x_range, IN[1]=code_block_2.y_range, IN[2]=code_block_2.z_range, IN[3]=code_block_2.step_size)  # CPython3
# ---------- grid_points_layer3.python (43 lines) ----------
# Load the Python Standard and DesignScript Libraries
import sys
import clr
clr.AddReference('ProtoGeometry')
from Autodesk.DesignScript.Geometry import *

# The inputs to this node will be stored as a list in the IN variables.
x_range = IN[0]
y_range = IN[1]
z_range = IN[2]
step_size = IN[3]


def generate_corner_grid(x_range, y_range, z_range, step_size=1):
    # grid_size = 50
    std_min_pt = Point.ByCoordinates(0, 0, z_range*2)
    std_max_pt = Point.ByCoordinates(step_size,step_size,step_size+z_range*2)
    std_pt_set = (std_min_pt, std_max_pt)

    # Initialize the grid points list
    grid_pt_set = []
    for i in range(0, x_range):
        mod_x_min_pt = Point.ByCoordinates(std_pt_set[0].X+i*step_size, std_pt_set[0].Y, std_pt_set[0].Z)
        mod_x_max_pt = Point.ByCoordinates(std_pt_set[1].X+i*step_size, std_pt_set[1].Y, std_pt_set[1].Z)
        x_mod_pt_set = (mod_x_min_pt, mod_x_max_pt)
        grid_pt_set.append(x_mod_pt_set)

        for j in range(1, y_range):
            mod_y_min_pt = Point.ByCoordinates(x_mod_pt_set[0].X, x_mod_pt_set[0].Y+j*step_size, x_mod_pt_set[0].Z)
            mod_y_max_pt = Point.ByCoordinates(x_mod_pt_set[1].X, x_mod_pt_set[1].Y+j*step_size, x_mod_pt_set[1].Z)
            y_mod_pt_set = (mod_y_min_pt, mod_y_max_pt)
            grid_pt_set.append(y_mod_pt_set)

            for k in range(1, z_range):
                mod_z_min_pt = Point.ByCoordinates(y_mod_pt_set[0].X, y_mod_pt_set[0].Y, y_mod_pt_set[0].Z+k*step_size)
                mod_z_max_pt = Point.ByCoordinates(y_mod_pt_set[1].X, y_mod_pt_set[1].Y, y_mod_pt_set[1].Z+k*step_size)
                z_mod_pt_set = (mod_z_min_pt, mod_z_max_pt)
                grid_pt_set.append(z_mod_pt_set)
    
    return grid_pt_set

grid_pt_set = generate_corner_grid(x_range, y_range, z_range, step_size)
OUT = grid_pt_set
# ----------------------------------------
bounding_boxes_layer3 = Python(IN[0]=grid_points_layer3)  # IronPython2
# ---------- bounding_boxes_layer3.python (34 lines) ----------
# Load the Python Standard and DesignScript Libraries
import sys
import clr
clr.AddReference('ProtoGeometry')
from Autodesk.DesignScript.Geometry import *
clr.AddReference('DSCoreNodes')
from DSCore import *
clr.AddReference('GeometryColor')
from Modifiers import GeometryColor
clr.AddReference('MeshToolkit')
from Autodesk.Dynamo.MeshToolkit import *

# The inputs to this node will be stored as a list in the IN variables.
Grid_pt_sets = IN[0]
color_green = Color.ByARGB(230,230,250,0)
color_red = Color.ByARGB(255,255,0,0)

def coloring(geometry, color):
	display = GeometryColor.ByGeometryColor(geometry, color)
	return display

bb_cuboid_lst = []
for min_pt, max_pt in Grid_pt_sets:
    b_box = BoundingBox.ByCorners(min_pt, max_pt)
    bb_cuboid = BoundingBox.ToCuboid(b_box)
    
    geo_data = (min_pt, max_pt)
    geo_name = "MULTIPOLYGON-Voxel"
    geo_type = "MULTIPOLYGON"
    geometry = coloring(bb_cuboid, color_red)
    
    bb_cuboid_lst.append((geo_data, geo_name, geo_type, geometry))      

OUT = bb_cuboid_lst
# ----------------------------------------

join = List.Join(list0=bounding_boxes_layer1, list1=bounding_boxes_layer2, list2=bounding_boxes_layer3)

# group: Tunnel Model
points = CodeBlock()
# ---------- points.designscript (5 lines) ----------
start_point=Point.ByCoordinates(-5, 0, 6);
control_point_1=Point.ByCoordinates(8, 10, 8);
control_point_2=Point.ByCoordinates(9, 12, 10);
end_point=Point.ByCoordinates(15, 20, 13);
pt_lst=[start_point, control_point_1, control_point_2, end_point];
# ----------------------------------------
radius = CodeBlock { r=1; }
YAxis = Vector.YAxis()
byCenterPointRadiusNormal = Circle.ByCenterPointRadiusNormal(centerPoint=points.start_point, radius=radius, normal=YAxis)
byControlPoints = NurbsCurve.ByControlPoints(points=points.pt_lst)
solid_by_sweep = CodeBlock(circle=byCenterPointRadiusNormal, curve=byControlPoints) { solid=circle.SweepAsSolid(curve); }

# group: Mesh Decomposition
byGeometry = Autodesk.Dynamo.MeshToolkit.Mesh.ByGeometry(inputGeometry=solid_by_sweep)
explode = Autodesk.Dynamo.MeshToolkit.Mesh.Explode(mesh=byGeometry)

prefix = CodeBlock { geo_name="MULTIPOLYGON"; geo_type="MULTIPOLYGON"; }
mesh_objects = Python(IN[0]=explode, IN[1]=prefix.geo_name, IN[2]=prefix.geo_type, IN[3]=byGeometry)  # CPython3
# ---------- mesh_objects.python (22 lines) ----------
# Load the Python Standard and DesignScript Libraries
import sys
import clr
clr.AddReference('ProtoGeometry')
from Autodesk.DesignScript.Geometry import *
clr.AddReference('MeshToolkit')
from Autodesk.Dynamo.MeshToolkit import *

# The inputs to this node will be stored as a list in the IN variables.
mesh_lst = IN[0]
geo_name = IN[1]
geo_type = IN[2]
geometry = IN[3]

geo_lst = []
geo_data = []
for mesh in mesh_lst:
    geo_data.append(Mesh.Vertices(mesh))
    
geo_lst.append((geo_data, geo_name, geo_type, geometry))
# Assign your output to the OUT variable.
OUT = geo_lst
# ----------------------------------------
ground_truth_generator = Python(IN[0]=join, IN[1]=mesh_objects)  # CPython3
# ---------- ground_truth_generator.python (54 lines) ----------
# Load the Python Standard and DesignScript Libraries
import sys
import clr
clr.AddReference('ProtoGeometry')
from Autodesk.DesignScript.Geometry import *

#================= Help Function ====================
def getGeometry(geo_obj):
    return geo_obj[3]

def getGeoType(geo_obj):
    return geo_obj[2]
    
def getGeoName(geo_obj):
    return geo_obj[1]
#================= Input ====================
geo_lst = IN[0]

#================= Body ====================
inter_geo_dict = {} # {inter_geo_name1: "", inter_geo_name2: "", ...}

"""
comparison algorithnm:

geo_obj_1 in lst start from 0 to n-1
    geo_obj_2 in lst start from 1 to n
lst remove geo_obj_1
"""
for i in range(0, len(geo_lst)-1):
    geo_obj_1 = geo_lst[i]
    geometry_1 = getGeometry(geo_obj_1)

    geo_obj_1_has_intersection = False
    for j in range(1, len(geo_lst)):
        geo_obj_2 = geo_lst[j]
        geometry_2 = getGeometry(geo_obj_2)
        
        if getGeoName(geo_obj_1) != getGeoName(geo_obj_2):
            temp_bool = False
            try:
                temp_bool = Geometry.DoesIntersect(geometry_1, geometry_2)
            except Exception as err:
                print(f"Unexpected {err=}, {type(err)=}")
            if temp_bool:
                geo_obj_1_has_intersection = True
                inter_geo_dict[getGeoName(geo_obj_2)] = getGeoType(geo_obj_2)
                
    if geo_obj_1_has_intersection:
        inter_geo_dict[getGeoName(geo_obj_1)] = getGeoType(geo_obj_1)    
#================= Output ====================
if inter_geo_dict is None:
    inter_geo_dict = {}
    
OUT = inter_geo_dict
# ----------------------------------------
