# Dynamo graph [CaseStudy2][TubeAndDice]HasNoIntersection.dyn (Dynamo 2.8.0.2471)
# packages: MeshToolkit 3.0.0

# group: Cylinder
cylinder_generator = Python()  # CPython3; unwired: IN[0]
# ---------- cylinder_generator.python (19 lines) ----------
import clr
import Autodesk.DesignScript.Geometry
clr.AddReference('ProtoGeometry')
from Autodesk.DesignScript.Geometry import *

#create a cuboid with specified lengths
cs = CoordinateSystem.Identity();
cub = Cuboid.ByLengths(cs, 5, 15, 2);
#create several cones
p1 = Point.ByCoordinates(0, 0, 10);
p2 = Point.ByCoordinates(0, 0, 20);
p3 = Point.ByCoordinates(0, 0, 30);
cone1 = Cone.ByPointsRadii(p1, p2, 10, 6);
cone2 = Cone.ByPointsRadii(p2, p3, 6, 0);
#make a cylinder
cylCS = cs.Translate(10, 0, 0);
cyl = Cylinder.ByRadiusHeight(cylCS, 3, 10);

OUT = cyl
# ----------------------------------------

watch_3d = Watch3D()  # unwired: arg0
code_block = CodeBlock()  # frozen
# ---------- code_block.designscript (5 lines) ----------
p=Point.ByCoordinates([0,7,20],[0,11,3]);
a=Arc.ByThreePoints(p[0],p[1],p[2]);
vec_Y=Vector.YAxis();
c=Circle.ByCenterPointRadiusNormal(p[0],1,vec_Y);
c.SweepAsSolid(a);
# ----------------------------------------

# group: Donut
code_block_2 = CodeBlock()
# ---------- code_block_2.designscript (5 lines) ----------
pt=Point.ByCoordinates([0,5,5,0],[0,0,5,5]);
pt_lst=[pt[0],pt[1],pt[2],pt[3]];
is_close=true;
center_pt=pt[0];
radius=1.5;
# ----------------------------------------
YAxis = Vector.YAxis()
byCenterPointRadiusNormal = Circle.ByCenterPointRadiusNormal(centerPoint=code_block_2.center_pt, radius=code_block_2.radius, normal=YAxis)
byPoints = NurbsCurve.ByPoints(points=code_block_2.pt_lst, closeCurve=code_block_2.is_close)
code_block_3 = CodeBlock(circle=byCenterPointRadiusNormal, curve=byPoints) { solid=circle.SweepAsSolid(curve); }
code_block_4 = CodeBlock()
# ---------- code_block_4.designscript (5 lines) ----------
pt=Point.ByCoordinates([-2.5, 0, 2, 0],[2.5, 2.5, 2.5, 2.5],[0, -2.5, 0, 2.5]);
pt_lst=[pt[0],pt[1],pt[2],pt[3]];
is_close=true;
center_pt=pt[0];
radius=1;
# ----------------------------------------
ZAxis = Vector.ZAxis()
byCenterPointRadiusNormal_2 = Circle.ByCenterPointRadiusNormal(centerPoint=code_block_4.center_pt, radius=code_block_4.radius, normal=ZAxis)
byPoints_2 = NurbsCurve.ByPoints(points=code_block_4.pt_lst, closeCurve=code_block_4.is_close)
code_block_5 = CodeBlock(circle=byCenterPointRadiusNormal_2, curve=byPoints_2) { solid=circle.SweepAsSolid(curve); }

# group: Constructive Solid Geometry (Union, Intersection, Difference)
code_block_6 = CodeBlock()
# ---------- code_block_6.designscript (5 lines) ----------
c_pt=Point.ByCoordinates(10,15,2.5);
radius=3;

min_pt=Point.ByCoordinates(8,17,0.5);
max_pt=Point.ByCoordinates(12,13,4.5);
# ----------------------------------------
byCenterPointRadius = Sphere.ByCenterPointRadius(centerPoint=code_block_6.c_pt, radius=code_block_6.radius)
byCorners = Cuboid.ByCorners(lowPoint=code_block_6.min_pt, highPoint=code_block_6.max_pt)
intersect = Geometry.Intersect(geometry=byCenterPointRadius, other=byCorners)
code_block_7 = CodeBlock { pt=Point.ByCoordinates([10,10],[15,15],[-1,6]); pt_lst=[pt[0],pt[1]]; is_close=false; center_pt=pt[0]; radius=1; }
ZAxis_2 = Vector.ZAxis()
byCenterPointRadiusNormal_3 = Circle.ByCenterPointRadiusNormal(centerPoint=code_block_7.center_pt, radius=code_block_7.radius, normal=ZAxis_2)
byPoints_3 = NurbsCurve.ByPoints(points=code_block_7.pt, closeCurve=code_block_7.is_close)
code_block_8 = CodeBlock(circle=byCenterPointRadiusNormal_3, curve=byPoints_3) { solid=circle.SweepAsSolid(curve); }
code_block_9 = CodeBlock { pt=Point.ByCoordinates([6,14],[15,15],[2.5,2.5]); pt_lst=[pt[0],pt[1]]; is_close=false; center_pt=pt[0]; radius=1; }
XAxis = Vector.XAxis()
byCenterPointRadiusNormal_4 = Circle.ByCenterPointRadiusNormal(centerPoint=code_block_9.center_pt, radius=code_block_9.radius, normal=XAxis)
byPoints_4 = NurbsCurve.ByPoints(points=code_block_9.pt, closeCurve=code_block_9.is_close)
code_block_10 = CodeBlock(circle=byCenterPointRadiusNormal_4, curve=byPoints_4) { solid=circle.SweepAsSolid(curve); }
union = Solid.Union(solid=code_block_8, solid_2=code_block_10)
code_block_11 = CodeBlock { pt=Point.ByCoordinates([10,10],[11,19],[2.5,2.5]); pt_lst=[pt[0],pt[1]]; is_close=false; center_pt=pt[0]; radius=1; }
YAxis_2 = Vector.YAxis()
byCenterPointRadiusNormal_5 = Circle.ByCenterPointRadiusNormal(centerPoint=code_block_11.center_pt, radius=code_block_11.radius, normal=YAxis_2)
byPoints_5 = NurbsCurve.ByPoints(points=code_block_11.pt, closeCurve=code_block_11.is_close)
code_block_12 = CodeBlock(circle=byCenterPointRadiusNormal_5, curve=byPoints_5) { solid=circle.SweepAsSolid(curve); }
union_2 = Solid.Union(solid=union, solid_2=code_block_12)
difference = Solid.Difference(solid=intersect, other=union_2)
watch_3d_2 = Watch3D(difference)
watch_3d_3 = Watch3D(union_2)

# group: Tube
code_block_13 = CodeBlock()
# ---------- code_block_13.designscript (6 lines) ----------
start_point=Point.ByCoordinates(6, 15, 2);
cp_1=Point.ByCoordinates(11, 15, 2);
cp_2=Point.ByCoordinates(9, 15, 5);
cp_3=Point.ByCoordinates(12.5, 15, 7);
end_point=Point.ByCoordinates(13, 15, 8);
pt_lst=[start_point, cp_1, cp_2, cp_3, end_point];
# ----------------------------------------
radius = CodeBlock { r=0.5; }
XAxis_2 = Vector.XAxis()
byCenterPointRadiusNormal_6 = Circle.ByCenterPointRadiusNormal(centerPoint=code_block_13.start_point, radius=radius, normal=XAxis_2)
byControlPoints = NurbsCurve.ByControlPoints(points=code_block_13.pt_lst)
solid_by_sweep = CodeBlock(circle=byCenterPointRadiusNormal_6, curve=byControlPoints) { solid=circle.SweepAsSolid(curve); }
YAxis_3 = Vector.YAxis()

union_3 = Solid.Union(solid=difference, solid_2=solid_by_sweep)
watch_3d_4 = Watch3D(union_3)
code_block_14 = CodeBlock()
# ---------- code_block_14.designscript (13 lines) ----------
pt = Point.ByCoordinates([0, 5, 5, 0], [0, 0, 5, 5]);
pt_lst = [Get.ValueAtIndex(pt, 0), Get.ValueAtIndex(pt, 1), Get.ValueAtIndex(pt, 2), Get.ValueAtIndex(pt, 3)];
is_close = true;
center_pt = Get.ValueAtIndex(pt, 0);
radius = 1.5;
vector1 = Vector.YAxis();
circle1 = Circle.ByCenterPointRadiusNormal(center_pt, radius, vector1);
nurbsCurve1 = NurbsCurve.ByPoints(pt_lst, is_close);
circle = circle1;
curve = nurbsCurve1;
solid = circle.SweepAsSolid(curve);
Mesh0 = Dynamo.Mesh.ByGeometry(solid, -1, 512);
Mesh1 = Dynamo.Mesh.Explode(Mesh0);
# ----------------------------------------

# group: Background
mesh_objects = Python()  # CPython3; unwired: IN[0], IN[1], IN[2], IN[3]
# ---------- mesh_objects.python (22 lines) ----------
# Load the Python Standard and DesignScript Libraries
import sys
import clr
clr.AddReference('ProtoGeometry')
from Autodesk.DesignScript.Geometry import *
clr.AddReference('MeshToolkit')
from Autodesk.Dynamo.MeshToolkit import *

# The inputs to this node will be stored as a list in the IN variables.
mesh_lst = IN[0]
geo_name = IN[1]
geo_type = IN[2]
geometry = IN[3]

geo_lst = []
geo_data = []
for mesh in mesh_lst:
    geo_data.append(Mesh.Vertices(mesh))
    
geo_lst.append((geo_data, geo_name, geo_type, geometry))
# Assign your output to the OUT variable.
OUT = geo_lst
# ----------------------------------------
mesh2WKTExporter = Python()  # CPython3; unwired: IN[0], IN[1]
# ---------- mesh2WKTExporter.python (495 lines) ----------
# Load the Python Standard and DesignScript Libraries
import sys
import clr
import json
import os
import random
import pickle
import io
import ctypes
import math
import xml.etree.ElementTree as ET
sys.path.append(r"C:\Users\yhe\AppData\Local\Programs\Python\Python310\Lib\site-packages")
from xml.dom.minidom import parse, parseString

clr.AddReference('ProtoGeometry')
from Autodesk.DesignScript.Geometry import *
clr.AddReference('DSCoreNodes')
from DSCore import *
clr.AddReference('GeometryColor')
from Modifiers import GeometryColor
clr.AddReference('MeshToolkit')
from Autodesk.Dynamo.MeshToolkit import *

def Mesh_to_WKT(solid, solid_name):
    #sphere_mesh = Mesh.ByGeometry(solid)
    #mesh_lst = Mesh.Explode(sphere_mesh)
    mesh_lst=solid
    mesh_vert_lst = []
    
    for mesh in mesh_lst:
        mesh_vert_lst.append(Mesh.Vertices(mesh))
        
    geo_data = mesh_vert_lst
    geo_name = "MULTIPOLYGON" + "-" + str(solid_name)
    geo_type = "MULTIPOLYGON_MESH"
    geometry = solid
    geo_obj_solid = (geo_data, geo_name, geo_type, geometry)

    return geo_obj_solid

#################### WKT Converter #############################
def sphere2WKT(surface_lst, exampleInstanceNamespace, geoSparqlNamespace, name):
    wktLiteral = "<sf:MultiPolygon>";
    wktLiteral += "<rdf:Description rdf:about='" + exampleInstanceNamespace + str(name) + "'>";
    wktLiteral += "<geo:asWKT rdf:datatype='" + geoSparqlNamespace + "wktLiteral'>";
    
    # for curves/surfaces
    face_wkt_lst = ""
    for vert_lst in surface_lst:
        
        vert_wkt_lst = "(("
        for vert in vert_lst:
        
            vert_wkt_lst += str(vert.X) + " " +  str(vert.Y) + " " +  str(vert.Z);
            if vert != vert_lst[-1]:
                vert_wkt_lst += ", "
        
        vert_wkt_lst += ", " + str(vert_lst[0].X) + " " +  str(vert_lst[0].Y) + " " +  str(vert_lst[0].Z) + "))";
        
        face_wkt_lst += vert_wkt_lst
        if vert_lst != surface_lst[-1]:
            face_wkt_lst += ", "          
            
    wktLiteral += "MULTIPOLYGON Z(";
    wktLiteral += face_wkt_lst
    wktLiteral += ")"
    wktLiteral += "</geo:asWKT>";
    wktLiteral += "</rdf:Description>";
    wktLiteral += "</sf:MultiPolygon>";
    return wktLiteral

def mesh2WKT(surface_lst, exampleInstanceNamespace, geoSparqlNamespace, name):
    wktLiteral = "<sf:MultiPolygon>";
    wktLiteral += "<rdf:Description rdf:about='" + exampleInstanceNamespace + str(name) + "'>";
    wktLiteral += "<geo:asWKT rdf:datatype='" + geoSparqlNamespace + "wktLiteral'>";
    
    # for curves/surfaces
    face_wkt_lst = ""
    for vert_lst in surface_lst:
        
        vert_wkt_lst = "(("
        for vert in vert_lst:
        
            vert_wkt_lst += str(vert.X) + " " +  str(vert.Y) + " " +  str(vert.Z);
            if vert != vert_lst[-1]:
                vert_wkt_lst += ", "
        
        vert_wkt_lst += ", " + str(vert_lst[0].X) + " " +  str(vert_lst[0].Y) + " " +  str(vert_lst[0].Z) + "))";
        
        face_wkt_lst += vert_wkt_lst
        if vert_lst != surface_lst[-1]:
            face_wkt_lst += ", "          
            
    wktLiteral += "MULTIPOLYGON Z(";
    wktLiteral += face_wkt_lst
    wktLiteral += ")"
    wktLiteral += "</geo:asWKT>";
    wktLiteral += "</rdf:Description>";
    wktLiteral += "</sf:MultiPolygon>";
    return wktLiteral
    
def multipolygonInRotation2WKT(face_lst, exampleInstanceNamespace, geoSparqlNamespace, name):
    wktLiteral = "<sf:MultiPolygon>";
    wktLiteral += "<rdf:Description rdf:about='" + exampleInstanceNamespace + str(name) + "'>";
    wktLiteral += "<geo:asWKT rdf:datatype='" + geoSparqlNamespace + "wktLiteral'>";
    face_wkt_lst = ""
    
    for face in face_lst:
        
        vertice_lst = face.Vertices
        org_vert_pt = vertice_lst[0].PointGeometry 
        face_wkt = "((" + str(org_vert_pt.X) + " " +  str(org_vert_pt.Y) + " " +  str(org_vert_pt.Z) # start point
    
        for i in range(1, len(vertice_lst)):
            vert_pt = vertice_lst[i].PointGeometry
            face_wkt += ", " + str(vert_pt.X) + " " +  str(vert_pt.Y) + " " +  str(vert_pt.Z)       
        face_wkt += ", " + str(org_vert_pt.X) + " " +  str(org_vert_pt.Y) + " " +  str(org_vert_pt.Z) + "))" # end point
        
        if(face != face_lst[-1]):
            face_wkt += ", "
        face_wkt_lst += face_wkt        
    
    wktLiteral += "MULTIPOLYGON Z("
    wktLiteral += face_wkt_lst
    wktLiteral += ")" 
    wktLiteral += "</geo:asWKT>"
    wktLiteral += "</rdf:Description>"
    wktLiteral += "</sf:MultiPolygon>"
    return wktLiteral
    
    
def multipolygon2WKT(geo_data, exampleInstanceNamespace, geoSparqlNamespace, name):
    wktLiteral = "<sf:MultiPolygon>";
    wktLiteral += "<rdf:Description rdf:about='" + exampleInstanceNamespace + str(name) + "'>";
    wktLiteral += "<geo:asWKT rdf:datatype='" + geoSparqlNamespace + "wktLiteral'>";
    
    # for cuboids with geometry = [centroid, length]
    centroid = Solid.Centroid(geo_data)
    offset = geo_data.Length/2
    c_X = centroid.X
    c_Y = centroid.Y
    c_Z = centroid.Z

    # idea: determine the coordinates of bottom- and top faces
    
    # p1 -- p2
    # |  c   |
    # p3 -- p4           
    # bottom-face
    bottom_p1 = str(c_X-offset) + " " + str(c_Y-offset) + " " + str(c_Z-offset)
    bottom_p2 = str(c_X-offset) + " " + str(c_Y+offset) + " " + str(c_Z-offset) 
    bottom_p3 = str(c_X+offset) + " " + str(c_Y+offset) + " " + str(c_Z-offset)
    bottom_p4 = str(c_X+offset) + " " + str(c_Y-offset) + " " + str(c_Z-offset)
    bottom_face = "((" + bottom_p1 + ", " + bottom_p2 + ", " + bottom_p3 + ", " + bottom_p4 +  ", " + bottom_p1 + "))"
    # top-face
    top_p1 = str(c_X-offset) + " " + str(c_Y-offset) + " " + str(c_Z+offset)
    top_p2 = str(c_X-offset) + " " + str(c_Y+offset) + " " + str(c_Z+offset) 
    top_p3 = str(c_X+offset) + " " + str(c_Y+offset) + " " + str(c_Z+offset)
    top_p4 = str(c_X+offset) + " " + str(c_Y-offset) + " " + str(c_Z+offset)
    top_face = "((" + top_p1 + ", " + top_p2 + ", " + top_p3 + ", " + top_p4 +  ", " + top_p1 + "))"
    # front-face
    front_p1 = str(c_X-offset) + " " + str(c_Y-offset) + " " + str(c_Z-offset)
    front_p2 = str(c_X-offset) + " " + str(c_Y+offset) + " " + str(c_Z-offset) 
    front_p3 = str(c_X-offset) + " " + str(c_Y+offset) + " " + str(c_Z+offset) 
    front_p4 = str(c_X-offset) + " " + str(c_Y-offset) + " " + str(c_Z+offset)
    front_face = "((" + front_p1 + ", " + front_p2 + ", " + front_p3 + ", " + front_p4 + ", " + front_p1 + "))"
    # back-face             
    back_p1 = str(c_X+offset) + " " + str(c_Y-offset) + " " + str(c_Z-offset)
    back_p2 = str(c_X+offset) + " " + str(c_Y+offset) + " " + str(c_Z-offset) 
    back_p3 = str(c_X+offset) + " " + str(c_Y+offset) + " " + str(c_Z+offset) 
    back_p4 = str(c_X+offset) + " " + str(c_Y-offset) + " " + str(c_Z+offset)
    back_face = "((" + back_p1 + ", " + back_p2 + ", " + back_p3 + ", " + back_p4 + ", " + back_p1 + "))"
    # left-face
    left_p1 = str(c_X-offset) + " " + str(c_Y-offset) + " " + str(c_Z-offset)
    left_p2 = str(c_X+offset) + " " + str(c_Y-offset) + " " + str(c_Z-offset)
    left_p3 = str(c_X+offset) + " " + str(c_Y-offset) + " " + str(c_Z+offset)
    left_p4 = str(c_X-offset) + " " + str(c_Y-offset) + " " + str(c_Z+offset)
    left_face = "((" + left_p1 + ", " + left_p2 + ", " + left_p3 + ", " + left_p4 + ", " + left_p1 + "))"            
    # right-face
    right_p1 = str(c_X-offset) + " " + str(c_Y+offset) + " " + str(c_Z-offset)
    right_p2 = str(c_X+offset) + " " + str(c_Y+offset) + " " + str(c_Z-offset)
    right_p3 = str(c_X+offset) + " " + str(c_Y+offset) + " " + str(c_Z+offset)
    right_p4 = str(c_X-offset) + " " + str(c_Y+offset) + " " + str(c_Z+offset)
    right_face = "((" + right_p1 + ", " + right_p2 + ", " + right_p3 + ", " + right_p4 + ", " + right_p1 + "))"
    
    cuboid_face = bottom_face + ", " + top_face + ", " + front_face + ", " + back_face + ", " + left_face + ", " + right_face
    
    wktLiteral += "MULTIPOLYGON Z("
    try:
        wktLiteral += cuboid_face
    except e:
        return e
    print(cuboid_face)
    wktLiteral += ")"
    wktLiteral += "</geo:asWKT>"
    wktLiteral += "</rdf:Description>"
    wktLiteral += "</sf:MultiPolygon>"
    return wktLiteral
    
    
def polygon2WKT(geo_data, exampleInstanceNamespace, geoSparqlNamespace, name):
    wktLiteral = "<sf:POLYGON>";
    wktLiteral += "<rdf:Description rdf:about='" + exampleInstanceNamespace + str(name) + "'>";
    wktLiteral += "<geo:asWKT rdf:datatype='" + geoSparqlNamespace + "wktLiteral'>";
    wktLiteral += "POLYGON Z((";
    
    points =  geo_data
    originP = points[0];
    
    wktLiteral += str(originP.X) + " " +  str(originP.Y) + " " +  str(originP.Z) # start point
    for i in range(1, len(points)):
        wktLiteral += ", " + str(points[i].X) + " " +  str(points[i].Y) + " " +  str(points[i].Z);       
    wktLiteral += ", " + str(originP.X) + " " +  str(originP.Y) + " " +  str(originP.Z); # end point
    wktLiteral += "))"
    
    wktLiteral += "</geo:asWKT>";
    wktLiteral += "</rdf:Description>";
    wktLiteral += "</sf:POLYGON>";
    return wktLiteral

#####
def wkt_Converter(geo_obj):
# The inputs to this node will be stored as a list in the IN variables.
    geoSparqlNamespace = "http://www.opengis.net/ont/geosparql#"
    exampleInstanceNamespace = "https://www.inf.bi.ruhr-uni-bochum.de/jena/#"
    
    res = []
    geo_data = geo_obj[0];
    name = geo_obj[1];
    geometryType = geo_obj[2];
    
    if(geometryType.upper() == "MULTIPOLYGON_ROTATION"):
        res.append(multipolygonInRotation2WKT(geo_data, exampleInstanceNamespace, geoSparqlNamespace, name))
    
    if(geometryType.upper() == "MULTIPOLYGON_SPHERE"):
        res.append(sphere2WKT(geo_data, exampleInstanceNamespace, geoSparqlNamespace, name))    
        
    if(geometryType.upper() == "MULTIPOLYGON_MESH"):
        res.append(mesh2WKT(geo_data, exampleInstanceNamespace, geoSparqlNamespace, name))    
     
    if(geometryType.upper() == "MULTIPOLYGON"):
        res.append(multipolygon2WKT(geo_data, exampleInstanceNamespace, geoSparqlNamespace, name))
        
    if(geometryType.upper() == "POLYGON_ROTATION"):
        res.append(polygon2WKT(geo_data, exampleInstanceNamespace, geoSparqlNamespace, name))
        
    if(geometryType.upper() == "POLYGON"):
        res.append(polygon2WKT(geo_data, exampleInstanceNamespace, geoSparqlNamespace, name))
        
    if(geometryType.upper() == "LINESTRING"):
        res.append(lineString2WKT(geo_data, exampleInstanceNamespace, geoSparqlNamespace, name))
    return res

############## RDF Wrapper ###############
def RDF_Wrapper(WKT_res):
    rdf="http://www.w3.org/1999/02/22-rdf-syntax-ns#";
    owl="http://www.w3.org/2002/07/owl#";
    ogc="http://www.opengis.net/";
    my="https://www.inf.bi.ruhr-uni-bochum.de/jena/#";
    gml="http://www.opengis.net/ont/gml#";
    geo="http://www.opengis.net/ont/geosparql#";
    geof="http://www.opengis.net/def/function/geosparql/";
    rdfs="http://www.w3.org/2000/01/rdf-schema#";
    uom="http://www.opengis.net/def/uom/OGC/1.0/";
    sf="http://www.opengis.net/ont/sf#";
    xsd="http://www.w3.org/2001/XMLSchema#";
    geor="http://www.opengis.net/def/rule/geosparql/";
    namespaces = {	"rdf" : rdf,
                	"owl" : owl,
                	"ogc" : ogc,
                	"my" : my,
                	"gml" : gml,
                	"geo" : geo,
                	"geof": geof,
                	"rdfs": rdfs,
                	"uom": uom,
                	"sf": sf,
                	"xsd": xsd,
                	"geor": geor
            }
    inserts = WKT_res
    
    # open RDF header
    rdfStr = "<rdf:RDF";
    
    # handle Namespaces
    for key in namespaces:
        rdfStr += " xmlns:" + key + "='" + namespaces[key] + "'";
    
    rdfStr += ">";
    
    #add inserts
    
    rdfStr += "<rdf:Description rdf:about='my:" + "RootModel" + "'>";
    
    for insert in inserts:
        rdfStr += insert;
    
    rdfStr += "</rdf:Description>"
    
    # close RDF header
    rdfStr += "</rdf:RDF>"
    
    # Weisen Sie Ihre Ausgabe der OUT-Variablen zu.
    return rdfStr

############## Ground Truth Generator ###############
def getGeometry(geo_obj):
    return geo_obj[3]

def getGeoType(geo_obj):
    return geo_obj[2]
    
def getGeoName(geo_obj):
    return geo_obj[1]
    
def ground_truth_generator(geometry_lst):
    geo_lst = geometry_lst
    inter_geo_dict = {}
    for i in range(0, len(geo_lst)-1):
        geo_obj_1 = geo_lst[i]
        geometry_1 = getGeometry(geo_obj_1)
    
        geo_obj_1_has_intersection = False
        for j in range(1, len(geo_lst)):
            geo_obj_2 = geo_lst[j]
            geometry_2 = getGeometry(geo_obj_2)
            
            if getGeoName(geo_obj_1) != getGeoName(geo_obj_2):
                temp_bool = False
                try:
                    temp_bool = Geometry.DoesIntersect(geometry_1, geometry_2)
                except Exception as err:
                    print(f"Unexpected {err=}, {type(err)=}")
                if temp_bool:
                    geo_obj_1_has_intersection = True
                    inter_geo_dict[getGeoName(geo_obj_2)] = getGeoType(geo_obj_2)
                    
        if geo_obj_1_has_intersection:
            inter_geo_dict[getGeoName(geo_obj_1)] = getGeoType(geo_obj_1)    
    #================= Output ====================
    if inter_geo_dict is None:
        inter_geo_dict = {}
    return inter_geo_dict
    
############## RDF 2 JSON ###############
def rdfParsing2GeoData(str):
    """ it returns the json file in structure like { "POLYGON1" : [...], 
                                                     "POLYGON2" : [...], 
                                                     "MULTIPOLYGON1" : [...], ...
                                                    }
    """
    #dom = parse(path)
    #tree = ET.ElementTree(ET.fromstring(str))
    geo_dict = {}
    tree = io.StringIO(str)
    dom = parse(tree)
    data = dom.documentElement
    rdf_desc_lst = data.getElementsByTagName("rdf:Description")
    # geo_in_wkt = data.getElementsByTagName("geo:asWKT")

    for i in range(1, len(rdf_desc_lst)): # first description element (root element) should be removed.
        descr_el = rdf_desc_lst[i]
        geo_name_num = descr_el.attributes._attrs['rdf:about'].nodeValue.split('#')[1]
        geo_wkt_data = ""
        try:
            geo_wkt_data = descr_el.childNodes[0].firstChild.data
        except:
            geo_wkt_data = descr_el.childNodes[1].firstChild.data
        geo_algebra_lst = []

        if ( geo_name_num.find('POINT') != -1 or
            geo_name_num.find('Point') != -1 ):
            
            wkt_data_lst = geo_wkt_data.split("(")[1] # remove title 'POINT'
            vert_str_lst = wkt_data_lst
            vert_str_lst = vert_str_lst.replace( ")", "" ) # remove character ')'

            pt_algebra_lst = []
            pt_str_lst = vert_str_lst.split(" ")

            pt_algebra_lst = [ float(pt_str) for pt_str in pt_str_lst ]
            geo_algebra_lst.append(pt_algebra_lst)
            
        if ( geo_name_num.find('LINESTRING') != -1 or
            geo_name_num.find('Linestring') != -1 or
            geo_name_num.find('LINE') != -1 or
            geo_name_num.find('Line') != -1 ):

            wkt_data_lst = geo_wkt_data.split("((")[1] # remove title 'LINESTRING'
            vert_str_lst = wkt_data_lst
            vert_str_lst = vert_str_lst.replace( ")", "" ) # remove character ')'
            vert_str_lst = vert_str_lst.split(", ")

            line_algebra_lst = []
            for i in range(0, len(vert_str_lst)):

                pt_str_lst = vert_str_lst[i].split(" ")
                line_algebra_lst.append([ float(pt_str) for pt_str in pt_str_lst ])
            geo_algebra_lst.append(line_algebra_lst)

        if ( geo_name_num.find('POLYGON') != -1 or 
            geo_name_num.find('Polygon') != -1 ):

            wkt_data_lst = geo_wkt_data.split("((")[1] # remove title 'POLYGON Z'
            vert_str_lst = wkt_data_lst
            vert_str_lst = vert_str_lst.replace( ")", "" ) # remove character ')'
            vert_str_lst = vert_str_lst.replace( "(", "" ) # remove character '('
            vert_str_lst = vert_str_lst.split(", ")

            face_algebra_lst = []
            for i in range(0, len(vert_str_lst)-1): # last point not included

                pt_str_lst = vert_str_lst[i].split(" ")
                face_algebra_lst.append([ float(pt_str) for pt_str in pt_str_lst ])
            geo_algebra_lst.append(face_algebra_lst)

        if ( geo_name_num.find('MULTIPOLYGON') != -1 or
            geo_name_num.find('Multipolygon') != -1  or
            geo_name_num.find('CUBE') != -1 or
            geo_name_num.find('Cube') != -1 or
            geo_name_num.find('SPHERE') != -1 or
            geo_name_num.find('Sphere') != -1 ):

            wkt_data_lst = geo_wkt_data.split("(((")[1] # remove title 'MULTIPOLYGON Z'
            face_str_lst = wkt_data_lst.split("), ")

            face_algebra_lst = []
            for face_str in face_str_lst:
                vert_str_lst = face_str.replace( ")", "" ) # remove character ')'
                vert_str_lst = vert_str_lst.replace( "(", "" ) # remove character '('
                vert_str_lst = vert_str_lst.split(", ")

                pt_algebra_lst = []
                for i in range(0, len(vert_str_lst)-1): # last point not included

                    pt_str_lst = vert_str_lst[i].split(" ")
                        
                    pt_algebra = [ float(pt_str) for pt_str in pt_str_lst ]
                    pt_algebra_lst.append(pt_algebra)

                face_algebra_lst.append(pt_algebra_lst)
            geo_algebra_lst = face_algebra_lst

        if geo_name_num not in geo_dict.keys():
            geo_dict[geo_name_num] = geo_algebra_lst
    return geo_dict
    
######################################################
############## RDF File Configuration ###############
rdf_case_study_file_path = "C:\\Users\\yhe\\Documents\\Developer\\Repo\\ExtendingJena\\src\\main\\resources\\rdf\\case_study\\"
rdf_file_contents = ""

############## JSON File Configuration ###############
json_case_study_file_path = "C:\\Users\\yhe\\Documents\\Developer\\Repo\\ExtendingJena\\src\\main\\resources\\JSON\\case_study\\"
json_ground_truth_file_path = "C:\\Users\\yhe\\Documents\\Developer\\Repo\\ExtendingJena\\src\\main\\resources\\JSON\\ground_truth\\"
json_file_contents = {"test":""}

########## JSON Export #############
def JSON_export(json_file_path, json_file_name, json_file_contents):
    
    tmp_json_file_path = json_file_path + json_file_name
    try:
        with open(tmp_json_file_path, "w") as f:
            json.dump(json_file_contents, f, sort_keys=True, indent=4)
            #f.write(json_file_contents)
    except FileExistsError:
        print(f"File '{json_file_path}' already exists.")

########## RDF Export #############
def rdf_export(rdf_file_path, rdf_file_name, rdf_file_contents):

    tmp_rdf_file_path = rdf_file_path + rdf_file_name
    try:
        with open(tmp_rdf_file_path, "w") as f:
            f.write(rdf_file_contents)
    except FileExistsError:
        print(f"File '{rdf_file_path}' already exists.")
        
        
############## Contents (RDF, JSON) Generation ###############
# create geometries randomly
tmp_geo_lst = Mesh_to_WKT(IN[0], IN[1])
# convert geos to WKT
wkt_res = wkt_Converter(tmp_geo_lst)
# wrapp WKT with RDF labels
rdf_contents = RDF_Wrapper(wkt_res)
# store RDF file locally
rdf_export(rdf_case_study_file_path, "secCaseStudy_Solid.rdf", rdf_contents)
# convert RDF file to JSON file and store it locally
rdf_2_json_contents = rdfParsing2GeoData(rdf_contents)
JSON_export(json_case_study_file_path, "secCaseStudy_Solid.json", rdf_2_json_contents)

#====================================
OUT = 0
# ----------------------------------------
code_block_15 = CodeBlock { "Tube"; }
python_script = Python()  # CPython3; frozen; unwired: IN[0]
# ---------- python_script.python (37 lines) ----------
# Load the Python Standard and DesignScript Libraries
import sys
import clr
import random
import pickle
clr.AddReference('ProtoGeometry')
from Autodesk.DesignScript.Geometry import *
clr.AddReference('DSCoreNodes')
from DSCore import *
clr.AddReference('GeometryColor')
from Modifiers import GeometryColor
clr.AddReference('MeshToolkit')
from Autodesk.Dynamo.MeshToolkit import *

# random sphere(s)
for i in range(0, 1):
    
    x_axis = random.randint(-10, 10)
    y_axis = random.randint(-10, 10)
    z_axis = random.randint(-10, 10)
    offset_lst = random.sample(range(-50, 50, 2), 3)    
    
    centroid_pt = Point.ByCoordinates(x_axis + offset_lst[0], 
                                     y_axis + offset_lst[1], 
                                     z_axis + offset_lst[2])
    
    #rand_radius = random.randint(1, 7)
    
    geometry = Sphere.ByCenterPointRadius(centroid_pt, radius = 2)

    sphere_mesh = Mesh.ByGeometry(geometry)
    mesh_lst = Mesh.Explode(sphere_mesh)
    mesh_vert_lst = []
    for mesh in mesh_lst:
        mesh_vert_lst.append(Mesh.Vertices(mesh))

OUT=mesh_vert_lst
# ----------------------------------------
watch = Watch(python_script)

# group: WKT-to-RDF-to-JSON
byGeometry = Autodesk.Dynamo.MeshToolkit.Mesh.ByGeometry(inputGeometry=difference)
explode = Autodesk.Dynamo.MeshToolkit.Mesh.Explode(mesh=byGeometry)
watch_2 = Watch(explode)
python_script_2 = Python(IN[0]=explode)  # CPython3
# ---------- python_script_2.python (20 lines) ----------
# Load the Python Standard and DesignScript Libraries
import sys
import clr
import random
import pickle
clr.AddReference('ProtoGeometry')
from Autodesk.DesignScript.Geometry import *
clr.AddReference('DSCoreNodes')
from DSCore import *
clr.AddReference('GeometryColor')
from Modifiers import GeometryColor
clr.AddReference('MeshToolkit')
from Autodesk.Dynamo.MeshToolkit import *

# random sphere(s)
mesh_vert_lst = []
for mesh in IN[0][0]:
    mesh_vert_lst.append(Mesh.Vertices(mesh))

OUT=mesh_vert_lst
# ----------------------------------------
code_block_16 = CodeBlock { "MULTIPOLYGON-Dice"; }
mesh2WKT = Python(IN[0]=python_script_2, IN[1]=code_block_16)  # CPython3
# ---------- mesh2WKT.python (57 lines) ----------
# Load the Python Standard and DesignScript Libraries
import sys
import clr
import json
import os
import random
import pickle
import io
import ctypes
import math
import xml.etree.ElementTree as ET
sys.path.append(r"C:\Users\yhe\AppData\Local\Programs\Python\Python310\Lib\site-packages")
from xml.dom.minidom import parse, parseString

clr.AddReference('ProtoGeometry')
from Autodesk.DesignScript.Geometry import *
clr.AddReference('DSCoreNodes')
from DSCore import *
clr.AddReference('GeometryColor')
from Modifiers import GeometryColor
clr.AddReference('MeshToolkit')
from Autodesk.Dynamo.MeshToolkit import *

# Place your code below this line
def mesh2WKT(surface_lst, exampleInstanceNamespace, geoSparqlNamespace, name):
    wktLiteral = "<sf:MultiPolygon>";
    wktLiteral += "<rdf:Description rdf:about='" + exampleInstanceNamespace + str(name) + "'>";
    wktLiteral += "<geo:asWKT rdf:datatype='" + geoSparqlNamespace + "wktLiteral'>";
    
    # for curves/surfaces
    face_wkt_lst = ""
    for vert_lst in surface_lst:
        
        vert_wkt_lst = "(("
        for vert in vert_lst:
        
            vert_wkt_lst += str(vert.X) + " " +  str(vert.Y) + " " +  str(vert.Z);
            if vert != vert_lst[-1]:
                vert_wkt_lst += ", "
        
        vert_wkt_lst += ", " + str(vert_lst[0].X) + " " +  str(vert_lst[0].Y) + " " +  str(vert_lst[0].Z) + "))";
        
        face_wkt_lst += vert_wkt_lst
        if vert_lst != surface_lst[-1]:
            face_wkt_lst += ", "          
            
    wktLiteral += "MULTIPOLYGON Z(";
    wktLiteral += face_wkt_lst
    wktLiteral += ")"
    wktLiteral += "</geo:asWKT>";
    wktLiteral += "</rdf:Description>";
    wktLiteral += "</sf:MultiPolygon>";
    return wktLiteral
# Assign your output to the OUT variable.
geoSparqlNamespace = "http://www.opengis.net/ont/geosparql#"
exampleInstanceNamespace = "https://www.inf.bi.ruhr-uni-bochum.de/jena/#"
OUT = mesh2WKT(IN[0],  exampleInstanceNamespace, geoSparqlNamespace, IN[1])
# ----------------------------------------
watch_3 = Watch(mesh2WKT)
RDF_Wrapper = Python(IN[0]=watch_3)  # CPython3
# ---------- RDF_Wrapper.python (488 lines) ----------
# Load the Python Standard and DesignScript Libraries
import sys
import clr
import json
import os
import random
import pickle
import io
import ctypes
import math
import xml.etree.ElementTree as ET
sys.path.append(r"C:\Users\yhe\AppData\Local\Programs\Python\Python310\Lib\site-packages")
from xml.dom.minidom import parse, parseString

clr.AddReference('ProtoGeometry')
from Autodesk.DesignScript.Geometry import *
clr.AddReference('DSCoreNodes')
from DSCore import *
clr.AddReference('GeometryColor')
from Modifiers import GeometryColor
clr.AddReference('MeshToolkit')
from Autodesk.Dynamo.MeshToolkit import *

def Mesh_to_WKT(solid, solid_name):
    #sphere_mesh = Mesh.ByGeometry(solid)
    #mesh_lst = Mesh.Explode(sphere_mesh)
    mesh_lst=solid
    mesh_vert_lst = []
    
    for mesh in mesh_lst:
        mesh_vert_lst.append(Mesh.Vertices(mesh))
        
    geo_data = mesh_vert_lst
    geo_name = "MULTIPOLYGON" + "-" + str(solid_name)
    geo_type = "MULTIPOLYGON_MESH"
    geometry = solid
    geo_obj_solid = (geo_data, geo_name, geo_type, geometry)

    return geo_obj_solid

#################### WKT Converter #############################
def sphere2WKT(surface_lst, exampleInstanceNamespace, geoSparqlNamespace, name):
    wktLiteral = "<sf:MultiPolygon>";
    wktLiteral += "<rdf:Description rdf:about='" + exampleInstanceNamespace + str(name) + "'>";
    wktLiteral += "<geo:asWKT rdf:datatype='" + geoSparqlNamespace + "wktLiteral'>";
    
    # for curves/surfaces
    face_wkt_lst = ""
    for vert_lst in surface_lst:
        
        vert_wkt_lst = "(("
        for vert in vert_lst:
        
            vert_wkt_lst += str(vert.X) + " " +  str(vert.Y) + " " +  str(vert.Z);
            if vert != vert_lst[-1]:
                vert_wkt_lst += ", "
        
        vert_wkt_lst += ", " + str(vert_lst[0].X) + " " +  str(vert_lst[0].Y) + " " +  str(vert_lst[0].Z) + "))";
        
        face_wkt_lst += vert_wkt_lst
        if vert_lst != surface_lst[-1]:
            face_wkt_lst += ", "          
            
    wktLiteral += "MULTIPOLYGON Z(";
    wktLiteral += face_wkt_lst
    wktLiteral += ")"
    wktLiteral += "</geo:asWKT>";
    wktLiteral += "</rdf:Description>";
    wktLiteral += "</sf:MultiPolygon>";
    return wktLiteral

def mesh2WKT(surface_lst, exampleInstanceNamespace, geoSparqlNamespace, name):
    wktLiteral = "<sf:MultiPolygon>";
    wktLiteral += "<rdf:Description rdf:about='" + exampleInstanceNamespace + str(name) + "'>";
    wktLiteral += "<geo:asWKT rdf:datatype='" + geoSparqlNamespace + "wktLiteral'>";
    
    # for curves/surfaces
    face_wkt_lst = ""
    for vert_lst in surface_lst:
        
        vert_wkt_lst = "(("
        for vert in vert_lst:
        
            vert_wkt_lst += str(vert.X) + " " +  str(vert.Y) + " " +  str(vert.Z);
            if vert != vert_lst[-1]:
                vert_wkt_lst += ", "
        
        vert_wkt_lst += ", " + str(vert_lst[0].X) + " " +  str(vert_lst[0].Y) + " " +  str(vert_lst[0].Z) + "))";
        
        face_wkt_lst += vert_wkt_lst
        if vert_lst != surface_lst[-1]:
            face_wkt_lst += ", "          
            
    wktLiteral += "MULTIPOLYGON Z(";
    wktLiteral += face_wkt_lst
    wktLiteral += ")"
    wktLiteral += "</geo:asWKT>";
    wktLiteral += "</rdf:Description>";
    wktLiteral += "</sf:MultiPolygon>";
    return wktLiteral
    
def multipolygonInRotation2WKT(face_lst, exampleInstanceNamespace, geoSparqlNamespace, name):
    wktLiteral = "<sf:MultiPolygon>";
    wktLiteral += "<rdf:Description rdf:about='" + exampleInstanceNamespace + str(name) + "'>";
    wktLiteral += "<geo:asWKT rdf:datatype='" + geoSparqlNamespace + "wktLiteral'>";
    face_wkt_lst = ""
    
    for face in face_lst:
        
        vertice_lst = face.Vertices
        org_vert_pt = vertice_lst[0].PointGeometry 
        face_wkt = "((" + str(org_vert_pt.X) + " " +  str(org_vert_pt.Y) + " " +  str(org_vert_pt.Z) # start point
    
        for i in range(1, len(vertice_lst)):
            vert_pt = vertice_lst[i].PointGeometry
            face_wkt += ", " + str(vert_pt.X) + " " +  str(vert_pt.Y) + " " +  str(vert_pt.Z)       
        face_wkt += ", " + str(org_vert_pt.X) + " " +  str(org_vert_pt.Y) + " " +  str(org_vert_pt.Z) + "))" # end point
        
        if(face != face_lst[-1]):
            face_wkt += ", "
        face_wkt_lst += face_wkt        
    
    wktLiteral += "MULTIPOLYGON Z("
    wktLiteral += face_wkt_lst
    wktLiteral += ")" 
    wktLiteral += "</geo:asWKT>"
    wktLiteral += "</rdf:Description>"
    wktLiteral += "</sf:MultiPolygon>"
    return wktLiteral
    
    
def multipolygon2WKT(geo_data, exampleInstanceNamespace, geoSparqlNamespace, name):
    wktLiteral = "<sf:MultiPolygon>";
    wktLiteral += "<rdf:Description rdf:about='" + exampleInstanceNamespace + str(name) + "'>";
    wktLiteral += "<geo:asWKT rdf:datatype='" + geoSparqlNamespace + "wktLiteral'>";
    
    # for cuboids with geometry = [centroid, length]
    centroid = Solid.Centroid(geo_data)
    offset = geo_data.Length/2
    c_X = centroid.X
    c_Y = centroid.Y
    c_Z = centroid.Z

    # idea: determine the coordinates of bottom- and top faces
    
    # p1 -- p2
    # |  c   |
    # p3 -- p4           
    # bottom-face
    bottom_p1 = str(c_X-offset) + " " + str(c_Y-offset) + " " + str(c_Z-offset)
    bottom_p2 = str(c_X-offset) + " " + str(c_Y+offset) + " " + str(c_Z-offset) 
    bottom_p3 = str(c_X+offset) + " " + str(c_Y+offset) + " " + str(c_Z-offset)
    bottom_p4 = str(c_X+offset) + " " + str(c_Y-offset) + " " + str(c_Z-offset)
    bottom_face = "((" + bottom_p1 + ", " + bottom_p2 + ", " + bottom_p3 + ", " + bottom_p4 +  ", " + bottom_p1 + "))"
    # top-face
    top_p1 = str(c_X-offset) + " " + str(c_Y-offset) + " " + str(c_Z+offset)
    top_p2 = str(c_X-offset) + " " + str(c_Y+offset) + " " + str(c_Z+offset) 
    top_p3 = str(c_X+offset) + " " + str(c_Y+offset) + " " + str(c_Z+offset)
    top_p4 = str(c_X+offset) + " " + str(c_Y-offset) + " " + str(c_Z+offset)
    top_face = "((" + top_p1 + ", " + top_p2 + ", " + top_p3 + ", " + top_p4 +  ", " + top_p1 + "))"
    # front-face
    front_p1 = str(c_X-offset) + " " + str(c_Y-offset) + " " + str(c_Z-offset)
    front_p2 = str(c_X-offset) + " " + str(c_Y+offset) + " " + str(c_Z-offset) 
    front_p3 = str(c_X-offset) + " " + str(c_Y+offset) + " " + str(c_Z+offset) 
    front_p4 = str(c_X-offset) + " " + str(c_Y-offset) + " " + str(c_Z+offset)
    front_face = "((" + front_p1 + ", " + front_p2 + ", " + front_p3 + ", " + front_p4 + ", " + front_p1 + "))"
    # back-face             
    back_p1 = str(c_X+offset) + " " + str(c_Y-offset) + " " + str(c_Z-offset)
    back_p2 = str(c_X+offset) + " " + str(c_Y+offset) + " " + str(c_Z-offset) 
    back_p3 = str(c_X+offset) + " " + str(c_Y+offset) + " " + str(c_Z+offset) 
    back_p4 = str(c_X+offset) + " " + str(c_Y-offset) + " " + str(c_Z+offset)
    back_face = "((" + back_p1 + ", " + back_p2 + ", " + back_p3 + ", " + back_p4 + ", " + back_p1 + "))"
    # left-face
    left_p1 = str(c_X-offset) + " " + str(c_Y-offset) + " " + str(c_Z-offset)
    left_p2 = str(c_X+offset) + " " + str(c_Y-offset) + " " + str(c_Z-offset)
    left_p3 = str(c_X+offset) + " " + str(c_Y-offset) + " " + str(c_Z+offset)
    left_p4 = str(c_X-offset) + " " + str(c_Y-offset) + " " + str(c_Z+offset)
    left_face = "((" + left_p1 + ", " + left_p2 + ", " + left_p3 + ", " + left_p4 + ", " + left_p1 + "))"            
    # right-face
    right_p1 = str(c_X-offset) + " " + str(c_Y+offset) + " " + str(c_Z-offset)
    right_p2 = str(c_X+offset) + " " + str(c_Y+offset) + " " + str(c_Z-offset)
    right_p3 = str(c_X+offset) + " " + str(c_Y+offset) + " " + str(c_Z+offset)
    right_p4 = str(c_X-offset) + " " + str(c_Y+offset) + " " + str(c_Z+offset)
    right_face = "((" + right_p1 + ", " + right_p2 + ", " + right_p3 + ", " + right_p4 + ", " + right_p1 + "))"
    
    cuboid_face = bottom_face + ", " + top_face + ", " + front_face + ", " + back_face + ", " + left_face + ", " + right_face
    
    wktLiteral += "MULTIPOLYGON Z("
    try:
        wktLiteral += cuboid_face
    except e:
        return e
    print(cuboid_face)
    wktLiteral += ")"
    wktLiteral += "</geo:asWKT>"
    wktLiteral += "</rdf:Description>"
    wktLiteral += "</sf:MultiPolygon>"
    return wktLiteral
    
    
def polygon2WKT(geo_data, exampleInstanceNamespace, geoSparqlNamespace, name):
    wktLiteral = "<sf:POLYGON>";
    wktLiteral += "<rdf:Description rdf:about='" + exampleInstanceNamespace + str(name) + "'>";
    wktLiteral += "<geo:asWKT rdf:datatype='" + geoSparqlNamespace + "wktLiteral'>";
    wktLiteral += "POLYGON Z((";
    
    points =  geo_data
    originP = points[0];
    
    wktLiteral += str(originP.X) + " " +  str(originP.Y) + " " +  str(originP.Z) # start point
    for i in range(1, len(points)):
        wktLiteral += ", " + str(points[i].X) + " " +  str(points[i].Y) + " " +  str(points[i].Z);       
    wktLiteral += ", " + str(originP.X) + " " +  str(originP.Y) + " " +  str(originP.Z); # end point
    wktLiteral += "))"
    
    wktLiteral += "</geo:asWKT>";
    wktLiteral += "</rdf:Description>";
    wktLiteral += "</sf:POLYGON>";
    return wktLiteral

#####
def wkt_Converter(geo_obj):
# The inputs to this node will be stored as a list in the IN variables.
    geoSparqlNamespace = "http://www.opengis.net/ont/geosparql#"
    exampleInstanceNamespace = "https://www.inf.bi.ruhr-uni-bochum.de/jena/#"
    
    res = []
    geo_data = geo_obj[0];
    name = geo_obj[1];
    geometryType = geo_obj[2];
    
    if(geometryType.upper() == "MULTIPOLYGON_ROTATION"):
        res.append(multipolygonInRotation2WKT(geo_data, exampleInstanceNamespace, geoSparqlNamespace, name))
    
    if(geometryType.upper() == "MULTIPOLYGON_SPHERE"):
        res.append(sphere2WKT(geo_data, exampleInstanceNamespace, geoSparqlNamespace, name))    
        
    if(geometryType.upper() == "MULTIPOLYGON_MESH"):
        res.append(mesh2WKT(geo_data, exampleInstanceNamespace, geoSparqlNamespace, name))    
     
    if(geometryType.upper() == "MULTIPOLYGON"):
        res.append(multipolygon2WKT(geo_data, exampleInstanceNamespace, geoSparqlNamespace, name))
        
    if(geometryType.upper() == "POLYGON_ROTATION"):
        res.append(polygon2WKT(geo_data, exampleInstanceNamespace, geoSparqlNamespace, name))
        
    if(geometryType.upper() == "POLYGON"):
        res.append(polygon2WKT(geo_data, exampleInstanceNamespace, geoSparqlNamespace, name))
        
    if(geometryType.upper() == "LINESTRING"):
        res.append(lineString2WKT(geo_data, exampleInstanceNamespace, geoSparqlNamespace, name))
    return res

############## RDF Wrapper ###############
def RDF_Wrapper(WKT_res):
    rdf="http://www.w3.org/1999/02/22-rdf-syntax-ns#";
    owl="http://www.w3.org/2002/07/owl#";
    ogc="http://www.opengis.net/";
    my="https://www.inf.bi.ruhr-uni-bochum.de/jena/#";
    gml="http://www.opengis.net/ont/gml#";
    geo="http://www.opengis.net/ont/geosparql#";
    geof="http://www.opengis.net/def/function/geosparql/";
    rdfs="http://www.w3.org/2000/01/rdf-schema#";
    uom="http://www.opengis.net/def/uom/OGC/1.0/";
    sf="http://www.opengis.net/ont/sf#";
    xsd="http://www.w3.org/2001/XMLSchema#";
    geor="http://www.opengis.net/def/rule/geosparql/";
    namespaces = {	"rdf" : rdf,
                	"owl" : owl,
                	"ogc" : ogc,
                	"my" : my,
                	"gml" : gml,
                	"geo" : geo,
                	"geof": geof,
                	"rdfs": rdfs,
                	"uom": uom,
                	"sf": sf,
                	"xsd": xsd,
                	"geor": geor
            }
    inserts = WKT_res
    
    # open RDF header
    rdfStr = "<rdf:RDF";
    
    # handle Namespaces
    for key in namespaces:
        rdfStr += " xmlns:" + key + "='" + namespaces[key] + "'";
    
    rdfStr += ">";
    
    #add inserts
    
    rdfStr += "<rdf:Description rdf:about='my:" + "RootModel" + "'>";
    
    for insert in inserts:
        rdfStr += insert;
    
    rdfStr += "</rdf:Description>"
    
    # close RDF header
    rdfStr += "</rdf:RDF>"
    
    # Weisen Sie Ihre Ausgabe der OUT-Variablen zu.
    return rdfStr

############## Ground Truth Generator ###############
def getGeometry(geo_obj):
    return geo_obj[3]

def getGeoType(geo_obj):
    return geo_obj[2]
    
def getGeoName(geo_obj):
    return geo_obj[1]
    
def ground_truth_generator(geometry_lst):
    geo_lst = geometry_lst
    inter_geo_dict = {}
    for i in range(0, len(geo_lst)-1):
        geo_obj_1 = geo_lst[i]
        geometry_1 = getGeometry(geo_obj_1)
    
        geo_obj_1_has_intersection = False
        for j in range(1, len(geo_lst)):
            geo_obj_2 = geo_lst[j]
            geometry_2 = getGeometry(geo_obj_2)
            
            if getGeoName(geo_obj_1) != getGeoName(geo_obj_2):
                temp_bool = False
                try:
                    temp_bool = Geometry.DoesIntersect(geometry_1, geometry_2)
                except Exception as err:
                    print(f"Unexpected {err=}, {type(err)=}")
                if temp_bool:
                    geo_obj_1_has_intersection = True
                    inter_geo_dict[getGeoName(geo_obj_2)] = getGeoType(geo_obj_2)
                    
        if geo_obj_1_has_intersection:
            inter_geo_dict[getGeoName(geo_obj_1)] = getGeoType(geo_obj_1)    
    #================= Output ====================
    if inter_geo_dict is None:
        inter_geo_dict = {}
    return inter_geo_dict
    
############## RDF 2 JSON ###############
def rdfParsing2GeoData(str):
    """ it returns the json file in structure like { "POLYGON1" : [...], 
                                                     "POLYGON2" : [...], 
                                                     "MULTIPOLYGON1" : [...], ...
                                                    }
    """
    #dom = parse(path)
    #tree = ET.ElementTree(ET.fromstring(str))
    geo_dict = {}
    tree = io.StringIO(str)
    dom = parse(tree)
    data = dom.documentElement
    rdf_desc_lst = data.getElementsByTagName("rdf:Description")
    # geo_in_wkt = data.getElementsByTagName("geo:asWKT")

    for i in range(1, len(rdf_desc_lst)): # first description element (root element) should be removed.
        descr_el = rdf_desc_lst[i]
        geo_name_num = descr_el.attributes._attrs['rdf:about'].nodeValue.split('#')[1]
        geo_wkt_data = ""
        try:
            geo_wkt_data = descr_el.childNodes[0].firstChild.data
        except:
            geo_wkt_data = descr_el.childNodes[1].firstChild.data
        geo_algebra_lst = []

        if ( geo_name_num.find('POINT') != -1 or
            geo_name_num.find('Point') != -1 ):
            
            wkt_data_lst = geo_wkt_data.split("(")[1] # remove title 'POINT'
            vert_str_lst = wkt_data_lst
            vert_str_lst = vert_str_lst.replace( ")", "" ) # remove character ')'

            pt_algebra_lst = []
            pt_str_lst = vert_str_lst.split(" ")

            pt_algebra_lst = [ float(pt_str) for pt_str in pt_str_lst ]
            geo_algebra_lst.append(pt_algebra_lst)
            
        if ( geo_name_num.find('LINESTRING') != -1 or
            geo_name_num.find('Linestring') != -1 or
            geo_name_num.find('LINE') != -1 or
            geo_name_num.find('Line') != -1 ):

            wkt_data_lst = geo_wkt_data.split("((")[1] # remove title 'LINESTRING'
            vert_str_lst = wkt_data_lst
            vert_str_lst = vert_str_lst.replace( ")", "" ) # remove character ')'
            vert_str_lst = vert_str_lst.split(", ")

            line_algebra_lst = []
            for i in range(0, len(vert_str_lst)):

                pt_str_lst = vert_str_lst[i].split(" ")
                line_algebra_lst.append([ float(pt_str) for pt_str in pt_str_lst ])
            geo_algebra_lst.append(line_algebra_lst)

        if ( geo_name_num.find('POLYGON') != -1 or 
            geo_name_num.find('Polygon') != -1 ):

            wkt_data_lst = geo_wkt_data.split("((")[1] # remove title 'POLYGON Z'
            vert_str_lst = wkt_data_lst
            vert_str_lst = vert_str_lst.replace( ")", "" ) # remove character ')'
            vert_str_lst = vert_str_lst.replace( "(", "" ) # remove character '('
            vert_str_lst = vert_str_lst.split(", ")

            face_algebra_lst = []
            for i in range(0, len(vert_str_lst)-1): # last point not included

                pt_str_lst = vert_str_lst[i].split(" ")
                face_algebra_lst.append([ float(pt_str) for pt_str in pt_str_lst ])
            geo_algebra_lst.append(face_algebra_lst)

        if ( geo_name_num.find('MULTIPOLYGON') != -1 or
            geo_name_num.find('Multipolygon') != -1  or
            geo_name_num.find('CUBE') != -1 or
            geo_name_num.find('Cube') != -1 or
            geo_name_num.find('SPHERE') != -1 or
            geo_name_num.find('Sphere') != -1 ):

            wkt_data_lst = geo_wkt_data.split("(((")[1] # remove title 'MULTIPOLYGON Z'
            face_str_lst = wkt_data_lst.split("), ")

            face_algebra_lst = []
            for face_str in face_str_lst:
                vert_str_lst = face_str.replace( ")", "" ) # remove character ')'
                vert_str_lst = vert_str_lst.replace( "(", "" ) # remove character '('
                vert_str_lst = vert_str_lst.split(", ")

                pt_algebra_lst = []
                for i in range(0, len(vert_str_lst)-1): # last point not included

                    pt_str_lst = vert_str_lst[i].split(" ")
                        
                    pt_algebra = [ float(pt_str) for pt_str in pt_str_lst ]
                    pt_algebra_lst.append(pt_algebra)

                face_algebra_lst.append(pt_algebra_lst)
            geo_algebra_lst = face_algebra_lst

        if geo_name_num not in geo_dict.keys():
            geo_dict[geo_name_num] = geo_algebra_lst
    return geo_dict
    
######################################################
############## RDF File Configuration ###############
rdf_case_study_file_path = "C:\\Users\\yhe\\Documents\\Developer\\Repo\\ExtendingJena\\src\\main\\resources\\rdf\\case_study\\"
rdf_file_contents = ""

############## JSON File Configuration ###############
json_case_study_file_path = "C:\\Users\\yhe\\Documents\\Developer\\Repo\\ExtendingJena\\src\\main\\resources\\JSON\\case_study\\"
json_ground_truth_file_path = "C:\\Users\\yhe\\Documents\\Developer\\Repo\\ExtendingJena\\src\\main\\resources\\JSON\\ground_truth\\"
json_file_contents = {}

########## JSON Export #############
def JSON_export(json_file_path, json_file_name, json_file_contents):
    
    tmp_json_file_path = json_file_path + json_file_name
    try:
        with open(tmp_json_file_path, "w") as f:
            json.dump(json_file_contents, f, sort_keys=True, indent=4)
            #f.write(json_file_contents)
    except FileExistsError:
        print(f"File '{json_file_path}' already exists.")

########## RDF Export #############
def rdf_export(rdf_file_path, rdf_file_name, rdf_file_contents):

    tmp_rdf_file_path = rdf_file_path + rdf_file_name
    try:
        with open(tmp_rdf_file_path, "w") as f:
            f.write(rdf_file_contents)
    except FileExistsError:
        print(f"File '{rdf_file_path}' already exists.")
        
        
############## Contents (RDF, JSON) Generation ###############
# create geometries randomly
# convert geos to WKT
# wrapp WKT with RDF labels
rdf_contents = RDF_Wrapper(IN[0])
rdf_export(rdf_case_study_file_path, "2nd_CaseStudy_CubeSolid.rdf", rdf_contents)
#====================================
OUT = rdf_contents
# ----------------------------------------
watch_4 = Watch(RDF_Wrapper)
RDF_to_JSON = Python(IN[0]=watch_4)  # CPython3
# ---------- RDF_to_JSON.python (485 lines) ----------
# Load the Python Standard and DesignScript Libraries
import sys
import clr
import json
import os
import random
import pickle
import io
import ctypes
import math
import xml.etree.ElementTree as ET
sys.path.append(r"C:\Users\yhe\AppData\Local\Programs\Python\Python310\Lib\site-packages")
from xml.dom.minidom import parse, parseString

clr.AddReference('ProtoGeometry')
from Autodesk.DesignScript.Geometry import *
clr.AddReference('DSCoreNodes')
from DSCore import *
clr.AddReference('GeometryColor')
from Modifiers import GeometryColor
clr.AddReference('MeshToolkit')
from Autodesk.Dynamo.MeshToolkit import *

def Mesh_to_WKT(solid, solid_name):
    #sphere_mesh = Mesh.ByGeometry(solid)
    #mesh_lst = Mesh.Explode(sphere_mesh)
    mesh_lst=solid
    mesh_vert_lst = []
    
    for mesh in mesh_lst:
        mesh_vert_lst.append(Mesh.Vertices(mesh))
        
    geo_data = mesh_vert_lst
    geo_name = "MULTIPOLYGON" + "-" + str(solid_name)
    geo_type = "MULTIPOLYGON_MESH"
    geometry = solid
    geo_obj_solid = (geo_data, geo_name, geo_type, geometry)

    return geo_obj_solid

#################### WKT Converter #############################
def sphere2WKT(surface_lst, exampleInstanceNamespace, geoSparqlNamespace, name):
    wktLiteral = "<sf:MultiPolygon>";
    wktLiteral += "<rdf:Description rdf:about='" + exampleInstanceNamespace + str(name) + "'>";
    wktLiteral += "<geo:asWKT rdf:datatype='" + geoSparqlNamespace + "wktLiteral'>";
    
    # for curves/surfaces
    face_wkt_lst = ""
    for vert_lst in surface_lst:
        
        vert_wkt_lst = "(("
        for vert in vert_lst:
        
            vert_wkt_lst += str(vert.X) + " " +  str(vert.Y) + " " +  str(vert.Z);
            if vert != vert_lst[-1]:
                vert_wkt_lst += ", "
        
        vert_wkt_lst += ", " + str(vert_lst[0].X) + " " +  str(vert_lst[0].Y) + " " +  str(vert_lst[0].Z) + "))";
        
        face_wkt_lst += vert_wkt_lst
        if vert_lst != surface_lst[-1]:
            face_wkt_lst += ", "          
            
    wktLiteral += "MULTIPOLYGON Z(";
    wktLiteral += face_wkt_lst
    wktLiteral += ")"
    wktLiteral += "</geo:asWKT>";
    wktLiteral += "</rdf:Description>";
    wktLiteral += "</sf:MultiPolygon>";
    return wktLiteral

def mesh2WKT(surface_lst, exampleInstanceNamespace, geoSparqlNamespace, name):
    wktLiteral = "<sf:MultiPolygon>";
    wktLiteral += "<rdf:Description rdf:about='" + exampleInstanceNamespace + str(name) + "'>";
    wktLiteral += "<geo:asWKT rdf:datatype='" + geoSparqlNamespace + "wktLiteral'>";
    
    # for curves/surfaces
    face_wkt_lst = ""
    for vert_lst in surface_lst:
        
        vert_wkt_lst = "(("
        for vert in vert_lst:
        
            vert_wkt_lst += str(vert.X) + " " +  str(vert.Y) + " " +  str(vert.Z);
            if vert != vert_lst[-1]:
                vert_wkt_lst += ", "
        
        vert_wkt_lst += ", " + str(vert_lst[0].X) + " " +  str(vert_lst[0].Y) + " " +  str(vert_lst[0].Z) + "))";
        
        face_wkt_lst += vert_wkt_lst
        if vert_lst != surface_lst[-1]:
            face_wkt_lst += ", "          
            
    wktLiteral += "MULTIPOLYGON Z(";
    wktLiteral += face_wkt_lst
    wktLiteral += ")"
    wktLiteral += "</geo:asWKT>";
    wktLiteral += "</rdf:Description>";
    wktLiteral += "</sf:MultiPolygon>";
    return wktLiteral
    
def multipolygonInRotation2WKT(face_lst, exampleInstanceNamespace, geoSparqlNamespace, name):
    wktLiteral = "<sf:MultiPolygon>";
    wktLiteral += "<rdf:Description rdf:about='" + exampleInstanceNamespace + str(name) + "'>";
    wktLiteral += "<geo:asWKT rdf:datatype='" + geoSparqlNamespace + "wktLiteral'>";
    face_wkt_lst = ""
    
    for face in face_lst:
        
        vertice_lst = face.Vertices
        org_vert_pt = vertice_lst[0].PointGeometry 
        face_wkt = "((" + str(org_vert_pt.X) + " " +  str(org_vert_pt.Y) + " " +  str(org_vert_pt.Z) # start point
    
        for i in range(1, len(vertice_lst)):
            vert_pt = vertice_lst[i].PointGeometry
            face_wkt += ", " + str(vert_pt.X) + " " +  str(vert_pt.Y) + " " +  str(vert_pt.Z)       
        face_wkt += ", " + str(org_vert_pt.X) + " " +  str(org_vert_pt.Y) + " " +  str(org_vert_pt.Z) + "))" # end point
        
        if(face != face_lst[-1]):
            face_wkt += ", "
        face_wkt_lst += face_wkt        
    
    wktLiteral += "MULTIPOLYGON Z("
    wktLiteral += face_wkt_lst
    wktLiteral += ")" 
    wktLiteral += "</geo:asWKT>"
    wktLiteral += "</rdf:Description>"
    wktLiteral += "</sf:MultiPolygon>"
    return wktLiteral
    
    
def multipolygon2WKT(geo_data, exampleInstanceNamespace, geoSparqlNamespace, name):
    wktLiteral = "<sf:MultiPolygon>";
    wktLiteral += "<rdf:Description rdf:about='" + exampleInstanceNamespace + str(name) + "'>";
    wktLiteral += "<geo:asWKT rdf:datatype='" + geoSparqlNamespace + "wktLiteral'>";
    
    # for cuboids with geometry = [centroid, length]
    centroid = Solid.Centroid(geo_data)
    offset = geo_data.Length/2
    c_X = centroid.X
    c_Y = centroid.Y
    c_Z = centroid.Z

    # idea: determine the coordinates of bottom- and top faces
    
    # p1 -- p2
    # |  c   |
    # p3 -- p4           
    # bottom-face
    bottom_p1 = str(c_X-offset) + " " + str(c_Y-offset) + " " + str(c_Z-offset)
    bottom_p2 = str(c_X-offset) + " " + str(c_Y+offset) + " " + str(c_Z-offset) 
    bottom_p3 = str(c_X+offset) + " " + str(c_Y+offset) + " " + str(c_Z-offset)
    bottom_p4 = str(c_X+offset) + " " + str(c_Y-offset) + " " + str(c_Z-offset)
    bottom_face = "((" + bottom_p1 + ", " + bottom_p2 + ", " + bottom_p3 + ", " + bottom_p4 +  ", " + bottom_p1 + "))"
    # top-face
    top_p1 = str(c_X-offset) + " " + str(c_Y-offset) + " " + str(c_Z+offset)
    top_p2 = str(c_X-offset) + " " + str(c_Y+offset) + " " + str(c_Z+offset) 
    top_p3 = str(c_X+offset) + " " + str(c_Y+offset) + " " + str(c_Z+offset)
    top_p4 = str(c_X+offset) + " " + str(c_Y-offset) + " " + str(c_Z+offset)
    top_face = "((" + top_p1 + ", " + top_p2 + ", " + top_p3 + ", " + top_p4 +  ", " + top_p1 + "))"
    # front-face
    front_p1 = str(c_X-offset) + " " + str(c_Y-offset) + " " + str(c_Z-offset)
    front_p2 = str(c_X-offset) + " " + str(c_Y+offset) + " " + str(c_Z-offset) 
    front_p3 = str(c_X-offset) + " " + str(c_Y+offset) + " " + str(c_Z+offset) 
    front_p4 = str(c_X-offset) + " " + str(c_Y-offset) + " " + str(c_Z+offset)
    front_face = "((" + front_p1 + ", " + front_p2 + ", " + front_p3 + ", " + front_p4 + ", " + front_p1 + "))"
    # back-face             
    back_p1 = str(c_X+offset) + " " + str(c_Y-offset) + " " + str(c_Z-offset)
    back_p2 = str(c_X+offset) + " " + str(c_Y+offset) + " " + str(c_Z-offset) 
    back_p3 = str(c_X+offset) + " " + str(c_Y+offset) + " " + str(c_Z+offset) 
    back_p4 = str(c_X+offset) + " " + str(c_Y-offset) + " " + str(c_Z+offset)
    back_face = "((" + back_p1 + ", " + back_p2 + ", " + back_p3 + ", " + back_p4 + ", " + back_p1 + "))"
    # left-face
    left_p1 = str(c_X-offset) + " " + str(c_Y-offset) + " " + str(c_Z-offset)
    left_p2 = str(c_X+offset) + " " + str(c_Y-offset) + " " + str(c_Z-offset)
    left_p3 = str(c_X+offset) + " " + str(c_Y-offset) + " " + str(c_Z+offset)
    left_p4 = str(c_X-offset) + " " + str(c_Y-offset) + " " + str(c_Z+offset)
    left_face = "((" + left_p1 + ", " + left_p2 + ", " + left_p3 + ", " + left_p4 + ", " + left_p1 + "))"            
    # right-face
    right_p1 = str(c_X-offset) + " " + str(c_Y+offset) + " " + str(c_Z-offset)
    right_p2 = str(c_X+offset) + " " + str(c_Y+offset) + " " + str(c_Z-offset)
    right_p3 = str(c_X+offset) + " " + str(c_Y+offset) + " " + str(c_Z+offset)
    right_p4 = str(c_X-offset) + " " + str(c_Y+offset) + " " + str(c_Z+offset)
    right_face = "((" + right_p1 + ", " + right_p2 + ", " + right_p3 + ", " + right_p4 + ", " + right_p1 + "))"
    
    cuboid_face = bottom_face + ", " + top_face + ", " + front_face + ", " + back_face + ", " + left_face + ", " + right_face
    
    wktLiteral += "MULTIPOLYGON Z("
    try:
        wktLiteral += cuboid_face
    except e:
        return e
    print(cuboid_face)
    wktLiteral += ")"
    wktLiteral += "</geo:asWKT>"
    wktLiteral += "</rdf:Description>"
    wktLiteral += "</sf:MultiPolygon>"
    return wktLiteral
    
    
def polygon2WKT(geo_data, exampleInstanceNamespace, geoSparqlNamespace, name):
    wktLiteral = "<sf:POLYGON>";
    wktLiteral += "<rdf:Description rdf:about='" + exampleInstanceNamespace + str(name) + "'>";
    wktLiteral += "<geo:asWKT rdf:datatype='" + geoSparqlNamespace + "wktLiteral'>";
    wktLiteral += "POLYGON Z((";
    
    points =  geo_data
    originP = points[0];
    
    wktLiteral += str(originP.X) + " " +  str(originP.Y) + " " +  str(originP.Z) # start point
    for i in range(1, len(points)):
        wktLiteral += ", " + str(points[i].X) + " " +  str(points[i].Y) + " " +  str(points[i].Z);       
    wktLiteral += ", " + str(originP.X) + " " +  str(originP.Y) + " " +  str(originP.Z); # end point
    wktLiteral += "))"
    
    wktLiteral += "</geo:asWKT>";
    wktLiteral += "</rdf:Description>";
    wktLiteral += "</sf:POLYGON>";
    return wktLiteral

#####
def wkt_Converter(geo_obj):
# The inputs to this node will be stored as a list in the IN variables.
    geoSparqlNamespace = "http://www.opengis.net/ont/geosparql#"
    exampleInstanceNamespace = "https://www.inf.bi.ruhr-uni-bochum.de/jena/#"
    
    res = []
    geo_data = geo_obj[0];
    name = geo_obj[1];
    geometryType = geo_obj[2];
    
    if(geometryType.upper() == "MULTIPOLYGON_ROTATION"):
        res.append(multipolygonInRotation2WKT(geo_data, exampleInstanceNamespace, geoSparqlNamespace, name))
    
    if(geometryType.upper() == "MULTIPOLYGON_SPHERE"):
        res.append(sphere2WKT(geo_data, exampleInstanceNamespace, geoSparqlNamespace, name))    
        
    if(geometryType.upper() == "MULTIPOLYGON_MESH"):
        res.append(mesh2WKT(geo_data, exampleInstanceNamespace, geoSparqlNamespace, name))    
     
    if(geometryType.upper() == "MULTIPOLYGON"):
        res.append(multipolygon2WKT(geo_data, exampleInstanceNamespace, geoSparqlNamespace, name))
        
    if(geometryType.upper() == "POLYGON_ROTATION"):
        res.append(polygon2WKT(geo_data, exampleInstanceNamespace, geoSparqlNamespace, name))
        
    if(geometryType.upper() == "POLYGON"):
        res.append(polygon2WKT(geo_data, exampleInstanceNamespace, geoSparqlNamespace, name))
        
    if(geometryType.upper() == "LINESTRING"):
        res.append(lineString2WKT(geo_data, exampleInstanceNamespace, geoSparqlNamespace, name))
    return res

############## RDF Wrapper ###############
def RDF_Wrapper(WKT_res):
    rdf="http://www.w3.org/1999/02/22-rdf-syntax-ns#";
    owl="http://www.w3.org/2002/07/owl#";
    ogc="http://www.opengis.net/";
    my="https://www.inf.bi.ruhr-uni-bochum.de/jena/#";
    gml="http://www.opengis.net/ont/gml#";
    geo="http://www.opengis.net/ont/geosparql#";
    geof="http://www.opengis.net/def/function/geosparql/";
    rdfs="http://www.w3.org/2000/01/rdf-schema#";
    uom="http://www.opengis.net/def/uom/OGC/1.0/";
    sf="http://www.opengis.net/ont/sf#";
    xsd="http://www.w3.org/2001/XMLSchema#";
    geor="http://www.opengis.net/def/rule/geosparql/";
    namespaces = {	"rdf" : rdf,
                	"owl" : owl,
                	"ogc" : ogc,
                	"my" : my,
                	"gml" : gml,
                	"geo" : geo,
                	"geof": geof,
                	"rdfs": rdfs,
                	"uom": uom,
                	"sf": sf,
                	"xsd": xsd,
                	"geor": geor
            }
    inserts = WKT_res
    
    # open RDF header
    rdfStr = "<rdf:RDF";
    
    # handle Namespaces
    for key in namespaces:
        rdfStr += " xmlns:" + key + "='" + namespaces[key] + "'";
    
    rdfStr += ">";
    
    #add inserts
    
    rdfStr += "<rdf:Description rdf:about='my:" + "RootModel" + "'>";
    
    for insert in inserts:
        rdfStr += insert;
    
    rdfStr += "</rdf:Description>"
    
    # close RDF header
    rdfStr += "</rdf:RDF>"
    
    # Weisen Sie Ihre Ausgabe der OUT-Variablen zu.
    return rdfStr

############## Ground Truth Generator ###############
def getGeometry(geo_obj):
    return geo_obj[3]

def getGeoType(geo_obj):
    return geo_obj[2]
    
def getGeoName(geo_obj):
    return geo_obj[1]
    
def ground_truth_generator(geometry_lst):
    geo_lst = geometry_lst
    inter_geo_dict = {}
    for i in range(0, len(geo_lst)-1):
        geo_obj_1 = geo_lst[i]
        geometry_1 = getGeometry(geo_obj_1)
    
        geo_obj_1_has_intersection = False
        for j in range(1, len(geo_lst)):
            geo_obj_2 = geo_lst[j]
            geometry_2 = getGeometry(geo_obj_2)
            
            if getGeoName(geo_obj_1) != getGeoName(geo_obj_2):
                temp_bool = False
                try:
                    temp_bool = Geometry.DoesIntersect(geometry_1, geometry_2)
                except Exception as err:
                    print(f"Unexpected {err=}, {type(err)=}")
                if temp_bool:
                    geo_obj_1_has_intersection = True
                    inter_geo_dict[getGeoName(geo_obj_2)] = getGeoType(geo_obj_2)
                    
        if geo_obj_1_has_intersection:
            inter_geo_dict[getGeoName(geo_obj_1)] = getGeoType(geo_obj_1)    
    #================= Output ====================
    if inter_geo_dict is None:
        inter_geo_dict = {}
    return inter_geo_dict
    
############## RDF 2 JSON ###############
def rdfParsing2GeoData(str):
    """ it returns the json file in structure like { "POLYGON1" : [...], 
                                                     "POLYGON2" : [...], 
                                                     "MULTIPOLYGON1" : [...], ...
                                                    }
    """
    #dom = parse(path)
    #tree = ET.ElementTree(ET.fromstring(str))
    geo_dict = {}
    tree = io.StringIO(str)
    dom = parse(tree)
    data = dom.documentElement
    rdf_desc_lst = data.getElementsByTagName("rdf:Description")
    # geo_in_wkt = data.getElementsByTagName("geo:asWKT")

    for i in range(1, len(rdf_desc_lst)): # first description element (root element) should be removed.
        descr_el = rdf_desc_lst[i]
        geo_name_num = descr_el.attributes._attrs['rdf:about'].nodeValue.split('#')[1]
        geo_wkt_data = ""
        try:
            geo_wkt_data = descr_el.childNodes[0].firstChild.data
        except:
            geo_wkt_data = descr_el.childNodes[1].firstChild.data
        geo_algebra_lst = []

        if ( geo_name_num.find('POINT') != -1 or
            geo_name_num.find('Point') != -1 ):
            
            wkt_data_lst = geo_wkt_data.split("(")[1] # remove title 'POINT'
            vert_str_lst = wkt_data_lst
            vert_str_lst = vert_str_lst.replace( ")", "" ) # remove character ')'

            pt_algebra_lst = []
            pt_str_lst = vert_str_lst.split(" ")

            pt_algebra_lst = [ float(pt_str) for pt_str in pt_str_lst ]
            geo_algebra_lst.append(pt_algebra_lst)
            
        if ( geo_name_num.find('LINESTRING') != -1 or
            geo_name_num.find('Linestring') != -1 or
            geo_name_num.find('LINE') != -1 or
            geo_name_num.find('Line') != -1 ):

            wkt_data_lst = geo_wkt_data.split("((")[1] # remove title 'LINESTRING'
            vert_str_lst = wkt_data_lst
            vert_str_lst = vert_str_lst.replace( ")", "" ) # remove character ')'
            vert_str_lst = vert_str_lst.split(", ")

            line_algebra_lst = []
            for i in range(0, len(vert_str_lst)):

                pt_str_lst = vert_str_lst[i].split(" ")
                line_algebra_lst.append([ float(pt_str) for pt_str in pt_str_lst ])
            geo_algebra_lst.append(line_algebra_lst)

        if ( geo_name_num.find('POLYGON') != -1 or 
            geo_name_num.find('Polygon') != -1 ):

            wkt_data_lst = geo_wkt_data.split("((")[1] # remove title 'POLYGON Z'
            vert_str_lst = wkt_data_lst
            vert_str_lst = vert_str_lst.replace( ")", "" ) # remove character ')'
            vert_str_lst = vert_str_lst.replace( "(", "" ) # remove character '('
            vert_str_lst = vert_str_lst.split(", ")

            face_algebra_lst = []
            for i in range(0, len(vert_str_lst)-1): # last point not included

                pt_str_lst = vert_str_lst[i].split(" ")
                face_algebra_lst.append([ float(pt_str) for pt_str in pt_str_lst ])
            geo_algebra_lst.append(face_algebra_lst)

        if ( geo_name_num.find('MULTIPOLYGON') != -1 or
            geo_name_num.find('Multipolygon') != -1  or
            geo_name_num.find('CUBE') != -1 or
            geo_name_num.find('Cube') != -1 or
            geo_name_num.find('SPHERE') != -1 or
            geo_name_num.find('Sphere') != -1 ):

            wkt_data_lst = geo_wkt_data.split("(((")[1] # remove title 'MULTIPOLYGON Z'
            face_str_lst = wkt_data_lst.split("), ")

            face_algebra_lst = []
            for face_str in face_str_lst:
                vert_str_lst = face_str.replace( ")", "" ) # remove character ')'
                vert_str_lst = vert_str_lst.replace( "(", "" ) # remove character '('
                vert_str_lst = vert_str_lst.split(", ")

                pt_algebra_lst = []
                for i in range(0, len(vert_str_lst)-1): # last point not included

                    pt_str_lst = vert_str_lst[i].split(" ")
                        
                    pt_algebra = [ float(pt_str) for pt_str in pt_str_lst ]
                    pt_algebra_lst.append(pt_algebra)

                face_algebra_lst.append(pt_algebra_lst)
            geo_algebra_lst = face_algebra_lst

        if geo_name_num not in geo_dict.keys():
            geo_dict[geo_name_num] = geo_algebra_lst
    return geo_dict
    
######################################################
############## RDF File Configuration ###############
rdf_case_study_file_path = "C:\\Users\\yhe\\Documents\\Developer\\Repo\\ExtendingJena\\src\\main\\resources\\rdf\\case_study\\"
rdf_file_contents = ""

############## JSON File Configuration ###############
json_case_study_file_path = "C:\\Users\\yhe\\Documents\\Developer\\Repo\\ExtendingJena\\src\\main\\resources\\JSON\\case_study\\"
json_ground_truth_file_path = "C:\\Users\\yhe\\Documents\\Developer\\Repo\\ExtendingJena\\src\\main\\resources\\JSON\\ground_truth\\"
json_file_contents = {"test":""}

########## JSON Export #############
def JSON_export(json_file_path, json_file_name, json_file_contents):
    
    tmp_json_file_path = json_file_path + json_file_name
    try:
        with open(tmp_json_file_path, "w") as f:
            json.dump(json_file_contents, f, sort_keys=True, indent=4)
            #f.write(json_file_contents)
    except FileExistsError:
        print(f"File '{json_file_path}' already exists.")

########## RDF Export #############
def rdf_export(rdf_file_path, rdf_file_name, rdf_file_contents):

    tmp_rdf_file_path = rdf_file_path + rdf_file_name
    try:
        with open(tmp_rdf_file_path, "w") as f:
            f.write(rdf_file_contents)
    except FileExistsError:
        print(f"File '{rdf_file_path}' already exists.")
        
        
############## Contents (RDF, JSON) Generation ###############
# convert RDF file to JSON file and store it locally
rdf_2_json_contents = rdfParsing2GeoData(IN[0])
#====================================
OUT = rdf_2_json_contents
# ----------------------------------------
watch_5 = Watch(RDF_to_JSON)
json_export = Python(IN[0]=watch_5)  # CPython3
# ---------- json_export.python (484 lines) ----------
# Load the Python Standard and DesignScript Libraries
import sys
import clr
import json
import os
import random
import pickle
import io
import ctypes
import math
import xml.etree.ElementTree as ET
sys.path.append(r"C:\Users\yhe\AppData\Local\Programs\Python\Python310\Lib\site-packages")
from xml.dom.minidom import parse, parseString

clr.AddReference('ProtoGeometry')
from Autodesk.DesignScript.Geometry import *
clr.AddReference('DSCoreNodes')
from DSCore import *
clr.AddReference('GeometryColor')
from Modifiers import GeometryColor
clr.AddReference('MeshToolkit')
from Autodesk.Dynamo.MeshToolkit import *

def Mesh_to_WKT(solid, solid_name):
    #sphere_mesh = Mesh.ByGeometry(solid)
    #mesh_lst = Mesh.Explode(sphere_mesh)
    mesh_lst=solid
    mesh_vert_lst = []
    
    for mesh in mesh_lst:
        mesh_vert_lst.append(Mesh.Vertices(mesh))
        
    geo_data = mesh_vert_lst
    geo_name = "MULTIPOLYGON" + "-" + str(solid_name)
    geo_type = "MULTIPOLYGON_MESH"
    geometry = solid
    geo_obj_solid = (geo_data, geo_name, geo_type, geometry)

    return geo_obj_solid

#################### WKT Converter #############################
def sphere2WKT(surface_lst, exampleInstanceNamespace, geoSparqlNamespace, name):
    wktLiteral = "<sf:MultiPolygon>";
    wktLiteral += "<rdf:Description rdf:about='" + exampleInstanceNamespace + str(name) + "'>";
    wktLiteral += "<geo:asWKT rdf:datatype='" + geoSparqlNamespace + "wktLiteral'>";
    
    # for curves/surfaces
    face_wkt_lst = ""
    for vert_lst in surface_lst:
        
        vert_wkt_lst = "(("
        for vert in vert_lst:
        
            vert_wkt_lst += str(vert.X) + " " +  str(vert.Y) + " " +  str(vert.Z);
            if vert != vert_lst[-1]:
                vert_wkt_lst += ", "
        
        vert_wkt_lst += ", " + str(vert_lst[0].X) + " " +  str(vert_lst[0].Y) + " " +  str(vert_lst[0].Z) + "))";
        
        face_wkt_lst += vert_wkt_lst
        if vert_lst != surface_lst[-1]:
            face_wkt_lst += ", "          
            
    wktLiteral += "MULTIPOLYGON Z(";
    wktLiteral += face_wkt_lst
    wktLiteral += ")"
    wktLiteral += "</geo:asWKT>";
    wktLiteral += "</rdf:Description>";
    wktLiteral += "</sf:MultiPolygon>";
    return wktLiteral

def mesh2WKT(surface_lst, exampleInstanceNamespace, geoSparqlNamespace, name):
    wktLiteral = "<sf:MultiPolygon>";
    wktLiteral += "<rdf:Description rdf:about='" + exampleInstanceNamespace + str(name) + "'>";
    wktLiteral += "<geo:asWKT rdf:datatype='" + geoSparqlNamespace + "wktLiteral'>";
    
    # for curves/surfaces
    face_wkt_lst = ""
    for vert_lst in surface_lst:
        
        vert_wkt_lst = "(("
        for vert in vert_lst:
        
            vert_wkt_lst += str(vert.X) + " " +  str(vert.Y) + " " +  str(vert.Z);
            if vert != vert_lst[-1]:
                vert_wkt_lst += ", "
        
        vert_wkt_lst += ", " + str(vert_lst[0].X) + " " +  str(vert_lst[0].Y) + " " +  str(vert_lst[0].Z) + "))";
        
        face_wkt_lst += vert_wkt_lst
        if vert_lst != surface_lst[-1]:
            face_wkt_lst += ", "          
            
    wktLiteral += "MULTIPOLYGON Z(";
    wktLiteral += face_wkt_lst
    wktLiteral += ")"
    wktLiteral += "</geo:asWKT>";
    wktLiteral += "</rdf:Description>";
    wktLiteral += "</sf:MultiPolygon>";
    return wktLiteral
    
def multipolygonInRotation2WKT(face_lst, exampleInstanceNamespace, geoSparqlNamespace, name):
    wktLiteral = "<sf:MultiPolygon>";
    wktLiteral += "<rdf:Description rdf:about='" + exampleInstanceNamespace + str(name) + "'>";
    wktLiteral += "<geo:asWKT rdf:datatype='" + geoSparqlNamespace + "wktLiteral'>";
    face_wkt_lst = ""
    
    for face in face_lst:
        
        vertice_lst = face.Vertices
        org_vert_pt = vertice_lst[0].PointGeometry 
        face_wkt = "((" + str(org_vert_pt.X) + " " +  str(org_vert_pt.Y) + " " +  str(org_vert_pt.Z) # start point
    
        for i in range(1, len(vertice_lst)):
            vert_pt = vertice_lst[i].PointGeometry
            face_wkt += ", " + str(vert_pt.X) + " " +  str(vert_pt.Y) + " " +  str(vert_pt.Z)       
        face_wkt += ", " + str(org_vert_pt.X) + " " +  str(org_vert_pt.Y) + " " +  str(org_vert_pt.Z) + "))" # end point
        
        if(face != face_lst[-1]):
            face_wkt += ", "
        face_wkt_lst += face_wkt        
    
    wktLiteral += "MULTIPOLYGON Z("
    wktLiteral += face_wkt_lst
    wktLiteral += ")" 
    wktLiteral += "</geo:asWKT>"
    wktLiteral += "</rdf:Description>"
    wktLiteral += "</sf:MultiPolygon>"
    return wktLiteral
    
    
def multipolygon2WKT(geo_data, exampleInstanceNamespace, geoSparqlNamespace, name):
    wktLiteral = "<sf:MultiPolygon>";
    wktLiteral += "<rdf:Description rdf:about='" + exampleInstanceNamespace + str(name) + "'>";
    wktLiteral += "<geo:asWKT rdf:datatype='" + geoSparqlNamespace + "wktLiteral'>";
    
    # for cuboids with geometry = [centroid, length]
    centroid = Solid.Centroid(geo_data)
    offset = geo_data.Length/2
    c_X = centroid.X
    c_Y = centroid.Y
    c_Z = centroid.Z

    # idea: determine the coordinates of bottom- and top faces
    
    # p1 -- p2
    # |  c   |
    # p3 -- p4           
    # bottom-face
    bottom_p1 = str(c_X-offset) + " " + str(c_Y-offset) + " " + str(c_Z-offset)
    bottom_p2 = str(c_X-offset) + " " + str(c_Y+offset) + " " + str(c_Z-offset) 
    bottom_p3 = str(c_X+offset) + " " + str(c_Y+offset) + " " + str(c_Z-offset)
    bottom_p4 = str(c_X+offset) + " " + str(c_Y-offset) + " " + str(c_Z-offset)
    bottom_face = "((" + bottom_p1 + ", " + bottom_p2 + ", " + bottom_p3 + ", " + bottom_p4 +  ", " + bottom_p1 + "))"
    # top-face
    top_p1 = str(c_X-offset) + " " + str(c_Y-offset) + " " + str(c_Z+offset)
    top_p2 = str(c_X-offset) + " " + str(c_Y+offset) + " " + str(c_Z+offset) 
    top_p3 = str(c_X+offset) + " " + str(c_Y+offset) + " " + str(c_Z+offset)
    top_p4 = str(c_X+offset) + " " + str(c_Y-offset) + " " + str(c_Z+offset)
    top_face = "((" + top_p1 + ", " + top_p2 + ", " + top_p3 + ", " + top_p4 +  ", " + top_p1 + "))"
    # front-face
    front_p1 = str(c_X-offset) + " " + str(c_Y-offset) + " " + str(c_Z-offset)
    front_p2 = str(c_X-offset) + " " + str(c_Y+offset) + " " + str(c_Z-offset) 
    front_p3 = str(c_X-offset) + " " + str(c_Y+offset) + " " + str(c_Z+offset) 
    front_p4 = str(c_X-offset) + " " + str(c_Y-offset) + " " + str(c_Z+offset)
    front_face = "((" + front_p1 + ", " + front_p2 + ", " + front_p3 + ", " + front_p4 + ", " + front_p1 + "))"
    # back-face             
    back_p1 = str(c_X+offset) + " " + str(c_Y-offset) + " " + str(c_Z-offset)
    back_p2 = str(c_X+offset) + " " + str(c_Y+offset) + " " + str(c_Z-offset) 
    back_p3 = str(c_X+offset) + " " + str(c_Y+offset) + " " + str(c_Z+offset) 
    back_p4 = str(c_X+offset) + " " + str(c_Y-offset) + " " + str(c_Z+offset)
    back_face = "((" + back_p1 + ", " + back_p2 + ", " + back_p3 + ", " + back_p4 + ", " + back_p1 + "))"
    # left-face
    left_p1 = str(c_X-offset) + " " + str(c_Y-offset) + " " + str(c_Z-offset)
    left_p2 = str(c_X+offset) + " " + str(c_Y-offset) + " " + str(c_Z-offset)
    left_p3 = str(c_X+offset) + " " + str(c_Y-offset) + " " + str(c_Z+offset)
    left_p4 = str(c_X-offset) + " " + str(c_Y-offset) + " " + str(c_Z+offset)
    left_face = "((" + left_p1 + ", " + left_p2 + ", " + left_p3 + ", " + left_p4 + ", " + left_p1 + "))"            
    # right-face
    right_p1 = str(c_X-offset) + " " + str(c_Y+offset) + " " + str(c_Z-offset)
    right_p2 = str(c_X+offset) + " " + str(c_Y+offset) + " " + str(c_Z-offset)
    right_p3 = str(c_X+offset) + " " + str(c_Y+offset) + " " + str(c_Z+offset)
    right_p4 = str(c_X-offset) + " " + str(c_Y+offset) + " " + str(c_Z+offset)
    right_face = "((" + right_p1 + ", " + right_p2 + ", " + right_p3 + ", " + right_p4 + ", " + right_p1 + "))"
    
    cuboid_face = bottom_face + ", " + top_face + ", " + front_face + ", " + back_face + ", " + left_face + ", " + right_face
    
    wktLiteral += "MULTIPOLYGON Z("
    try:
        wktLiteral += cuboid_face
    except e:
        return e
    print(cuboid_face)
    wktLiteral += ")"
    wktLiteral += "</geo:asWKT>"
    wktLiteral += "</rdf:Description>"
    wktLiteral += "</sf:MultiPolygon>"
    return wktLiteral
    
    
def polygon2WKT(geo_data, exampleInstanceNamespace, geoSparqlNamespace, name):
    wktLiteral = "<sf:POLYGON>";
    wktLiteral += "<rdf:Description rdf:about='" + exampleInstanceNamespace + str(name) + "'>";
    wktLiteral += "<geo:asWKT rdf:datatype='" + geoSparqlNamespace + "wktLiteral'>";
    wktLiteral += "POLYGON Z((";
    
    points =  geo_data
    originP = points[0];
    
    wktLiteral += str(originP.X) + " " +  str(originP.Y) + " " +  str(originP.Z) # start point
    for i in range(1, len(points)):
        wktLiteral += ", " + str(points[i].X) + " " +  str(points[i].Y) + " " +  str(points[i].Z);       
    wktLiteral += ", " + str(originP.X) + " " +  str(originP.Y) + " " +  str(originP.Z); # end point
    wktLiteral += "))"
    
    wktLiteral += "</geo:asWKT>";
    wktLiteral += "</rdf:Description>";
    wktLiteral += "</sf:POLYGON>";
    return wktLiteral

#####
def wkt_Converter(geo_obj):
# The inputs to this node will be stored as a list in the IN variables.
    geoSparqlNamespace = "http://www.opengis.net/ont/geosparql#"
    exampleInstanceNamespace = "https://www.inf.bi.ruhr-uni-bochum.de/jena/#"
    
    res = []
    geo_data = geo_obj[0];
    name = geo_obj[1];
    geometryType = geo_obj[2];
    
    if(geometryType.upper() == "MULTIPOLYGON_ROTATION"):
        res.append(multipolygonInRotation2WKT(geo_data, exampleInstanceNamespace, geoSparqlNamespace, name))
    
    if(geometryType.upper() == "MULTIPOLYGON_SPHERE"):
        res.append(sphere2WKT(geo_data, exampleInstanceNamespace, geoSparqlNamespace, name))    
        
    if(geometryType.upper() == "MULTIPOLYGON_MESH"):
        res.append(mesh2WKT(geo_data, exampleInstanceNamespace, geoSparqlNamespace, name))    
     
    if(geometryType.upper() == "MULTIPOLYGON"):
        res.append(multipolygon2WKT(geo_data, exampleInstanceNamespace, geoSparqlNamespace, name))
        
    if(geometryType.upper() == "POLYGON_ROTATION"):
        res.append(polygon2WKT(geo_data, exampleInstanceNamespace, geoSparqlNamespace, name))
        
    if(geometryType.upper() == "POLYGON"):
        res.append(polygon2WKT(geo_data, exampleInstanceNamespace, geoSparqlNamespace, name))
        
    if(geometryType.upper() == "LINESTRING"):
        res.append(lineString2WKT(geo_data, exampleInstanceNamespace, geoSparqlNamespace, name))
    return res

############## RDF Wrapper ###############
def RDF_Wrapper(WKT_res):
    rdf="http://www.w3.org/1999/02/22-rdf-syntax-ns#";
    owl="http://www.w3.org/2002/07/owl#";
    ogc="http://www.opengis.net/";
    my="https://www.inf.bi.ruhr-uni-bochum.de/jena/#";
    gml="http://www.opengis.net/ont/gml#";
    geo="http://www.opengis.net/ont/geosparql#";
    geof="http://www.opengis.net/def/function/geosparql/";
    rdfs="http://www.w3.org/2000/01/rdf-schema#";
    uom="http://www.opengis.net/def/uom/OGC/1.0/";
    sf="http://www.opengis.net/ont/sf#";
    xsd="http://www.w3.org/2001/XMLSchema#";
    geor="http://www.opengis.net/def/rule/geosparql/";
    namespaces = {	"rdf" : rdf,
                	"owl" : owl,
                	"ogc" : ogc,
                	"my" : my,
                	"gml" : gml,
                	"geo" : geo,
                	"geof": geof,
                	"rdfs": rdfs,
                	"uom": uom,
                	"sf": sf,
                	"xsd": xsd,
                	"geor": geor
            }
    inserts = WKT_res
    
    # open RDF header
    rdfStr = "<rdf:RDF";
    
    # handle Namespaces
    for key in namespaces:
        rdfStr += " xmlns:" + key + "='" + namespaces[key] + "'";
    
    rdfStr += ">";
    
    #add inserts
    
    rdfStr += "<rdf:Description rdf:about='my:" + "RootModel" + "'>";
    
    for insert in inserts:
        rdfStr += insert;
    
    rdfStr += "</rdf:Description>"
    
    # close RDF header
    rdfStr += "</rdf:RDF>"
    
    # Weisen Sie Ihre Ausgabe der OUT-Variablen zu.
    return rdfStr

############## Ground Truth Generator ###############
def getGeometry(geo_obj):
    return geo_obj[3]

def getGeoType(geo_obj):
    return geo_obj[2]
    
def getGeoName(geo_obj):
    return geo_obj[1]
    
def ground_truth_generator(geometry_lst):
    geo_lst = geometry_lst
    inter_geo_dict = {}
    for i in range(0, len(geo_lst)-1):
        geo_obj_1 = geo_lst[i]
        geometry_1 = getGeometry(geo_obj_1)
    
        geo_obj_1_has_intersection = False
        for j in range(1, len(geo_lst)):
            geo_obj_2 = geo_lst[j]
            geometry_2 = getGeometry(geo_obj_2)
            
            if getGeoName(geo_obj_1) != getGeoName(geo_obj_2):
                temp_bool = False
                try:
                    temp_bool = Geometry.DoesIntersect(geometry_1, geometry_2)
                except Exception as err:
                    print(f"Unexpected {err=}, {type(err)=}")
                if temp_bool:
                    geo_obj_1_has_intersection = True
                    inter_geo_dict[getGeoName(geo_obj_2)] = getGeoType(geo_obj_2)
                    
        if geo_obj_1_has_intersection:
            inter_geo_dict[getGeoName(geo_obj_1)] = getGeoType(geo_obj_1)    
    #================= Output ====================
    if inter_geo_dict is None:
        inter_geo_dict = {}
    return inter_geo_dict
    
############## RDF 2 JSON ###############
def rdfParsing2GeoData(str):
    """ it returns the json file in structure like { "POLYGON1" : [...], 
                                                     "POLYGON2" : [...], 
                                                     "MULTIPOLYGON1" : [...], ...
                                                    }
    """
    #dom = parse(path)
    #tree = ET.ElementTree(ET.fromstring(str))
    geo_dict = {}
    tree = io.StringIO(str)
    dom = parse(tree)
    data = dom.documentElement
    rdf_desc_lst = data.getElementsByTagName("rdf:Description")
    # geo_in_wkt = data.getElementsByTagName("geo:asWKT")

    for i in range(1, len(rdf_desc_lst)): # first description element (root element) should be removed.
        descr_el = rdf_desc_lst[i]
        geo_name_num = descr_el.attributes._attrs['rdf:about'].nodeValue.split('#')[1]
        geo_wkt_data = ""
        try:
            geo_wkt_data = descr_el.childNodes[0].firstChild.data
        except:
            geo_wkt_data = descr_el.childNodes[1].firstChild.data
        geo_algebra_lst = []

        if ( geo_name_num.find('POINT') != -1 or
            geo_name_num.find('Point') != -1 ):
            
            wkt_data_lst = geo_wkt_data.split("(")[1] # remove title 'POINT'
            vert_str_lst = wkt_data_lst
            vert_str_lst = vert_str_lst.replace( ")", "" ) # remove character ')'

            pt_algebra_lst = []
            pt_str_lst = vert_str_lst.split(" ")

            pt_algebra_lst = [ float(pt_str) for pt_str in pt_str_lst ]
            geo_algebra_lst.append(pt_algebra_lst)
            
        if ( geo_name_num.find('LINESTRING') != -1 or
            geo_name_num.find('Linestring') != -1 or
            geo_name_num.find('LINE') != -1 or
            geo_name_num.find('Line') != -1 ):

            wkt_data_lst = geo_wkt_data.split("((")[1] # remove title 'LINESTRING'
            vert_str_lst = wkt_data_lst
            vert_str_lst = vert_str_lst.replace( ")", "" ) # remove character ')'
            vert_str_lst = vert_str_lst.split(", ")

            line_algebra_lst = []
            for i in range(0, len(vert_str_lst)):

                pt_str_lst = vert_str_lst[i].split(" ")
                line_algebra_lst.append([ float(pt_str) for pt_str in pt_str_lst ])
            geo_algebra_lst.append(line_algebra_lst)

        if ( geo_name_num.find('POLYGON') != -1 or 
            geo_name_num.find('Polygon') != -1 ):

            wkt_data_lst = geo_wkt_data.split("((")[1] # remove title 'POLYGON Z'
            vert_str_lst = wkt_data_lst
            vert_str_lst = vert_str_lst.replace( ")", "" ) # remove character ')'
            vert_str_lst = vert_str_lst.replace( "(", "" ) # remove character '('
            vert_str_lst = vert_str_lst.split(", ")

            face_algebra_lst = []
            for i in range(0, len(vert_str_lst)-1): # last point not included

                pt_str_lst = vert_str_lst[i].split(" ")
                face_algebra_lst.append([ float(pt_str) for pt_str in pt_str_lst ])
            geo_algebra_lst.append(face_algebra_lst)

        if ( geo_name_num.find('MULTIPOLYGON') != -1 or
            geo_name_num.find('Multipolygon') != -1  or
            geo_name_num.find('CUBE') != -1 or
            geo_name_num.find('Cube') != -1 or
            geo_name_num.find('SPHERE') != -1 or
            geo_name_num.find('Sphere') != -1 ):

            wkt_data_lst = geo_wkt_data.split("(((")[1] # remove title 'MULTIPOLYGON Z'
            face_str_lst = wkt_data_lst.split("), ")

            face_algebra_lst = []
            for face_str in face_str_lst:
                vert_str_lst = face_str.replace( ")", "" ) # remove character ')'
                vert_str_lst = vert_str_lst.replace( "(", "" ) # remove character '('
                vert_str_lst = vert_str_lst.split(", ")

                pt_algebra_lst = []
                for i in range(0, len(vert_str_lst)-1): # last point not included

                    pt_str_lst = vert_str_lst[i].split(" ")
                        
                    pt_algebra = [ float(pt_str) for pt_str in pt_str_lst ]
                    pt_algebra_lst.append(pt_algebra)

                face_algebra_lst.append(pt_algebra_lst)
            geo_algebra_lst = face_algebra_lst

        if geo_name_num not in geo_dict.keys():
            geo_dict[geo_name_num] = geo_algebra_lst
    return geo_dict
    
######################################################
############## RDF File Configuration ###############
rdf_case_study_file_path = "C:\\Users\\yhe\\Documents\\Developer\\Repo\\ExtendingJena\\src\\main\\resources\\rdf\\case_study\\"
rdf_file_contents = ""

############## JSON File Configuration ###############
json_case_study_file_path = "C:\\Users\\yhe\\Documents\\Developer\\Repo\\ExtendingJena\\src\\main\\resources\\JSON\\case_study\\"
json_ground_truth_file_path = "C:\\Users\\yhe\\Documents\\Developer\\Repo\\ExtendingJena\\src\\main\\resources\\JSON\\ground_truth\\"
json_file_contents = {"test":""}

########## JSON Export #############
def JSON_export(json_file_path, json_file_name, json_file_contents):
    
    tmp_json_file_path = json_file_path + json_file_name
    try:
        with open(tmp_json_file_path, "w") as f:
            json.dump(json_file_contents, f, sort_keys=True, indent=4)
            #f.write(json_file_contents)
    except FileExistsError:
        print(f"File '{json_file_path}' already exists.")

########## RDF Export #############
def rdf_export(rdf_file_path, rdf_file_name, rdf_file_contents):

    tmp_rdf_file_path = rdf_file_path + rdf_file_name
    try:
        with open(tmp_rdf_file_path, "w") as f:
            f.write(rdf_file_contents)
    except FileExistsError:
        print(f"File '{rdf_file_path}' already exists.")
        
        
############## Contents (RDF, JSON) Generation ###############
JSON_export(json_case_study_file_path, "2nd_CaseStudy_CubeSolid.json", IN[0])
#====================================
OUT = 0
# ----------------------------------------
watch_6 = Watch(python_script_2)

# group: WKT-to-RDF-to-JSON
byGeometry_2 = Autodesk.Dynamo.MeshToolkit.Mesh.ByGeometry(inputGeometry=solid_by_sweep)
explode_2 = Autodesk.Dynamo.MeshToolkit.Mesh.Explode(mesh=byGeometry_2)
python_script_3 = Python(IN[0]=explode_2)  # CPython3
# ---------- python_script_3.python (20 lines) ----------
# Load the Python Standard and DesignScript Libraries
import sys
import clr
import random
import pickle
clr.AddReference('ProtoGeometry')
from Autodesk.DesignScript.Geometry import *
clr.AddReference('DSCoreNodes')
from DSCore import *
clr.AddReference('GeometryColor')
from Modifiers import GeometryColor
clr.AddReference('MeshToolkit')
from Autodesk.Dynamo.MeshToolkit import *

# random sphere(s)
mesh_vert_lst = []
for mesh in IN[0]:
    mesh_vert_lst.append(Mesh.Vertices(mesh))

OUT=mesh_vert_lst
# ----------------------------------------
watch_7 = Watch(python_script_3)
code_block_17 = CodeBlock { "MULTIPOLYGON-Tube"; }
mesh2WKT_2 = Python(IN[0]=watch_7, IN[1]=code_block_17)  # CPython3; same code as mesh2WKT
watch_8 = Watch(mesh2WKT_2)
RDF_Wrapper_2 = Python(IN[0]=watch_8)  # CPython3
# ---------- RDF_Wrapper_2.python (488 lines) ----------
# Load the Python Standard and DesignScript Libraries
import sys
import clr
import json
import os
import random
import pickle
import io
import ctypes
import math
import xml.etree.ElementTree as ET
sys.path.append(r"C:\Users\yhe\AppData\Local\Programs\Python\Python310\Lib\site-packages")
from xml.dom.minidom import parse, parseString

clr.AddReference('ProtoGeometry')
from Autodesk.DesignScript.Geometry import *
clr.AddReference('DSCoreNodes')
from DSCore import *
clr.AddReference('GeometryColor')
from Modifiers import GeometryColor
clr.AddReference('MeshToolkit')
from Autodesk.Dynamo.MeshToolkit import *

def Mesh_to_WKT(solid, solid_name):
    #sphere_mesh = Mesh.ByGeometry(solid)
    #mesh_lst = Mesh.Explode(sphere_mesh)
    mesh_lst=solid
    mesh_vert_lst = []
    
    for mesh in mesh_lst:
        mesh_vert_lst.append(Mesh.Vertices(mesh))
        
    geo_data = mesh_vert_lst
    geo_name = "MULTIPOLYGON" + "-" + str(solid_name)
    geo_type = "MULTIPOLYGON_MESH"
    geometry = solid
    geo_obj_solid = (geo_data, geo_name, geo_type, geometry)

    return geo_obj_solid

#################### WKT Converter #############################
def sphere2WKT(surface_lst, exampleInstanceNamespace, geoSparqlNamespace, name):
    wktLiteral = "<sf:MultiPolygon>";
    wktLiteral += "<rdf:Description rdf:about='" + exampleInstanceNamespace + str(name) + "'>";
    wktLiteral += "<geo:asWKT rdf:datatype='" + geoSparqlNamespace + "wktLiteral'>";
    
    # for curves/surfaces
    face_wkt_lst = ""
    for vert_lst in surface_lst:
        
        vert_wkt_lst = "(("
        for vert in vert_lst:
        
            vert_wkt_lst += str(vert.X) + " " +  str(vert.Y) + " " +  str(vert.Z);
            if vert != vert_lst[-1]:
                vert_wkt_lst += ", "
        
        vert_wkt_lst += ", " + str(vert_lst[0].X) + " " +  str(vert_lst[0].Y) + " " +  str(vert_lst[0].Z) + "))";
        
        face_wkt_lst += vert_wkt_lst
        if vert_lst != surface_lst[-1]:
            face_wkt_lst += ", "          
            
    wktLiteral += "MULTIPOLYGON Z(";
    wktLiteral += face_wkt_lst
    wktLiteral += ")"
    wktLiteral += "</geo:asWKT>";
    wktLiteral += "</rdf:Description>";
    wktLiteral += "</sf:MultiPolygon>";
    return wktLiteral

def mesh2WKT(surface_lst, exampleInstanceNamespace, geoSparqlNamespace, name):
    wktLiteral = "<sf:MultiPolygon>";
    wktLiteral += "<rdf:Description rdf:about='" + exampleInstanceNamespace + str(name) + "'>";
    wktLiteral += "<geo:asWKT rdf:datatype='" + geoSparqlNamespace + "wktLiteral'>";
    
    # for curves/surfaces
    face_wkt_lst = ""
    for vert_lst in surface_lst:
        
        vert_wkt_lst = "(("
        for vert in vert_lst:
        
            vert_wkt_lst += str(vert.X) + " " +  str(vert.Y) + " " +  str(vert.Z);
            if vert != vert_lst[-1]:
                vert_wkt_lst += ", "
        
        vert_wkt_lst += ", " + str(vert_lst[0].X) + " " +  str(vert_lst[0].Y) + " " +  str(vert_lst[0].Z) + "))";
        
        face_wkt_lst += vert_wkt_lst
        if vert_lst != surface_lst[-1]:
            face_wkt_lst += ", "          
            
    wktLiteral += "MULTIPOLYGON Z(";
    wktLiteral += face_wkt_lst
    wktLiteral += ")"
    wktLiteral += "</geo:asWKT>";
    wktLiteral += "</rdf:Description>";
    wktLiteral += "</sf:MultiPolygon>";
    return wktLiteral
    
def multipolygonInRotation2WKT(face_lst, exampleInstanceNamespace, geoSparqlNamespace, name):
    wktLiteral = "<sf:MultiPolygon>";
    wktLiteral += "<rdf:Description rdf:about='" + exampleInstanceNamespace + str(name) + "'>";
    wktLiteral += "<geo:asWKT rdf:datatype='" + geoSparqlNamespace + "wktLiteral'>";
    face_wkt_lst = ""
    
    for face in face_lst:
        
        vertice_lst = face.Vertices
        org_vert_pt = vertice_lst[0].PointGeometry 
        face_wkt = "((" + str(org_vert_pt.X) + " " +  str(org_vert_pt.Y) + " " +  str(org_vert_pt.Z) # start point
    
        for i in range(1, len(vertice_lst)):
            vert_pt = vertice_lst[i].PointGeometry
            face_wkt += ", " + str(vert_pt.X) + " " +  str(vert_pt.Y) + " " +  str(vert_pt.Z)       
        face_wkt += ", " + str(org_vert_pt.X) + " " +  str(org_vert_pt.Y) + " " +  str(org_vert_pt.Z) + "))" # end point
        
        if(face != face_lst[-1]):
            face_wkt += ", "
        face_wkt_lst += face_wkt        
    
    wktLiteral += "MULTIPOLYGON Z("
    wktLiteral += face_wkt_lst
    wktLiteral += ")" 
    wktLiteral += "</geo:asWKT>"
    wktLiteral += "</rdf:Description>"
    wktLiteral += "</sf:MultiPolygon>"
    return wktLiteral
    
    
def multipolygon2WKT(geo_data, exampleInstanceNamespace, geoSparqlNamespace, name):
    wktLiteral = "<sf:MultiPolygon>";
    wktLiteral += "<rdf:Description rdf:about='" + exampleInstanceNamespace + str(name) + "'>";
    wktLiteral += "<geo:asWKT rdf:datatype='" + geoSparqlNamespace + "wktLiteral'>";
    
    # for cuboids with geometry = [centroid, length]
    centroid = Solid.Centroid(geo_data)
    offset = geo_data.Length/2
    c_X = centroid.X
    c_Y = centroid.Y
    c_Z = centroid.Z

    # idea: determine the coordinates of bottom- and top faces
    
    # p1 -- p2
    # |  c   |
    # p3 -- p4           
    # bottom-face
    bottom_p1 = str(c_X-offset) + " " + str(c_Y-offset) + " " + str(c_Z-offset)
    bottom_p2 = str(c_X-offset) + " " + str(c_Y+offset) + " " + str(c_Z-offset) 
    bottom_p3 = str(c_X+offset) + " " + str(c_Y+offset) + " " + str(c_Z-offset)
    bottom_p4 = str(c_X+offset) + " " + str(c_Y-offset) + " " + str(c_Z-offset)
    bottom_face = "((" + bottom_p1 + ", " + bottom_p2 + ", " + bottom_p3 + ", " + bottom_p4 +  ", " + bottom_p1 + "))"
    # top-face
    top_p1 = str(c_X-offset) + " " + str(c_Y-offset) + " " + str(c_Z+offset)
    top_p2 = str(c_X-offset) + " " + str(c_Y+offset) + " " + str(c_Z+offset) 
    top_p3 = str(c_X+offset) + " " + str(c_Y+offset) + " " + str(c_Z+offset)
    top_p4 = str(c_X+offset) + " " + str(c_Y-offset) + " " + str(c_Z+offset)
    top_face = "((" + top_p1 + ", " + top_p2 + ", " + top_p3 + ", " + top_p4 +  ", " + top_p1 + "))"
    # front-face
    front_p1 = str(c_X-offset) + " " + str(c_Y-offset) + " " + str(c_Z-offset)
    front_p2 = str(c_X-offset) + " " + str(c_Y+offset) + " " + str(c_Z-offset) 
    front_p3 = str(c_X-offset) + " " + str(c_Y+offset) + " " + str(c_Z+offset) 
    front_p4 = str(c_X-offset) + " " + str(c_Y-offset) + " " + str(c_Z+offset)
    front_face = "((" + front_p1 + ", " + front_p2 + ", " + front_p3 + ", " + front_p4 + ", " + front_p1 + "))"
    # back-face             
    back_p1 = str(c_X+offset) + " " + str(c_Y-offset) + " " + str(c_Z-offset)
    back_p2 = str(c_X+offset) + " " + str(c_Y+offset) + " " + str(c_Z-offset) 
    back_p3 = str(c_X+offset) + " " + str(c_Y+offset) + " " + str(c_Z+offset) 
    back_p4 = str(c_X+offset) + " " + str(c_Y-offset) + " " + str(c_Z+offset)
    back_face = "((" + back_p1 + ", " + back_p2 + ", " + back_p3 + ", " + back_p4 + ", " + back_p1 + "))"
    # left-face
    left_p1 = str(c_X-offset) + " " + str(c_Y-offset) + " " + str(c_Z-offset)
    left_p2 = str(c_X+offset) + " " + str(c_Y-offset) + " " + str(c_Z-offset)
    left_p3 = str(c_X+offset) + " " + str(c_Y-offset) + " " + str(c_Z+offset)
    left_p4 = str(c_X-offset) + " " + str(c_Y-offset) + " " + str(c_Z+offset)
    left_face = "((" + left_p1 + ", " + left_p2 + ", " + left_p3 + ", " + left_p4 + ", " + left_p1 + "))"            
    # right-face
    right_p1 = str(c_X-offset) + " " + str(c_Y+offset) + " " + str(c_Z-offset)
    right_p2 = str(c_X+offset) + " " + str(c_Y+offset) + " " + str(c_Z-offset)
    right_p3 = str(c_X+offset) + " " + str(c_Y+offset) + " " + str(c_Z+offset)
    right_p4 = str(c_X-offset) + " " + str(c_Y+offset) + " " + str(c_Z+offset)
    right_face = "((" + right_p1 + ", " + right_p2 + ", " + right_p3 + ", " + right_p4 + ", " + right_p1 + "))"
    
    cuboid_face = bottom_face + ", " + top_face + ", " + front_face + ", " + back_face + ", " + left_face + ", " + right_face
    
    wktLiteral += "MULTIPOLYGON Z("
    try:
        wktLiteral += cuboid_face
    except e:
        return e
    print(cuboid_face)
    wktLiteral += ")"
    wktLiteral += "</geo:asWKT>"
    wktLiteral += "</rdf:Description>"
    wktLiteral += "</sf:MultiPolygon>"
    return wktLiteral
    
    
def polygon2WKT(geo_data, exampleInstanceNamespace, geoSparqlNamespace, name):
    wktLiteral = "<sf:POLYGON>";
    wktLiteral += "<rdf:Description rdf:about='" + exampleInstanceNamespace + str(name) + "'>";
    wktLiteral += "<geo:asWKT rdf:datatype='" + geoSparqlNamespace + "wktLiteral'>";
    wktLiteral += "POLYGON Z((";
    
    points =  geo_data
    originP = points[0];
    
    wktLiteral += str(originP.X) + " " +  str(originP.Y) + " " +  str(originP.Z) # start point
    for i in range(1, len(points)):
        wktLiteral += ", " + str(points[i].X) + " " +  str(points[i].Y) + " " +  str(points[i].Z);       
    wktLiteral += ", " + str(originP.X) + " " +  str(originP.Y) + " " +  str(originP.Z); # end point
    wktLiteral += "))"
    
    wktLiteral += "</geo:asWKT>";
    wktLiteral += "</rdf:Description>";
    wktLiteral += "</sf:POLYGON>";
    return wktLiteral

#####
def wkt_Converter(geo_obj):
# The inputs to this node will be stored as a list in the IN variables.
    geoSparqlNamespace = "http://www.opengis.net/ont/geosparql#"
    exampleInstanceNamespace = "https://www.inf.bi.ruhr-uni-bochum.de/jena/#"
    
    res = []
    geo_data = geo_obj[0];
    name = geo_obj[1];
    geometryType = geo_obj[2];
    
    if(geometryType.upper() == "MULTIPOLYGON_ROTATION"):
        res.append(multipolygonInRotation2WKT(geo_data, exampleInstanceNamespace, geoSparqlNamespace, name))
    
    if(geometryType.upper() == "MULTIPOLYGON_SPHERE"):
        res.append(sphere2WKT(geo_data, exampleInstanceNamespace, geoSparqlNamespace, name))    
        
    if(geometryType.upper() == "MULTIPOLYGON_MESH"):
        res.append(mesh2WKT(geo_data, exampleInstanceNamespace, geoSparqlNamespace, name))    
     
    if(geometryType.upper() == "MULTIPOLYGON"):
        res.append(multipolygon2WKT(geo_data, exampleInstanceNamespace, geoSparqlNamespace, name))
        
    if(geometryType.upper() == "POLYGON_ROTATION"):
        res.append(polygon2WKT(geo_data, exampleInstanceNamespace, geoSparqlNamespace, name))
        
    if(geometryType.upper() == "POLYGON"):
        res.append(polygon2WKT(geo_data, exampleInstanceNamespace, geoSparqlNamespace, name))
        
    if(geometryType.upper() == "LINESTRING"):
        res.append(lineString2WKT(geo_data, exampleInstanceNamespace, geoSparqlNamespace, name))
    return res

############## RDF Wrapper ###############
def RDF_Wrapper(WKT_res):
    rdf="http://www.w3.org/1999/02/22-rdf-syntax-ns#";
    owl="http://www.w3.org/2002/07/owl#";
    ogc="http://www.opengis.net/";
    my="https://www.inf.bi.ruhr-uni-bochum.de/jena/#";
    gml="http://www.opengis.net/ont/gml#";
    geo="http://www.opengis.net/ont/geosparql#";
    geof="http://www.opengis.net/def/function/geosparql/";
    rdfs="http://www.w3.org/2000/01/rdf-schema#";
    uom="http://www.opengis.net/def/uom/OGC/1.0/";
    sf="http://www.opengis.net/ont/sf#";
    xsd="http://www.w3.org/2001/XMLSchema#";
    geor="http://www.opengis.net/def/rule/geosparql/";
    namespaces = {	"rdf" : rdf,
                	"owl" : owl,
                	"ogc" : ogc,
                	"my" : my,
                	"gml" : gml,
                	"geo" : geo,
                	"geof": geof,
                	"rdfs": rdfs,
                	"uom": uom,
                	"sf": sf,
                	"xsd": xsd,
                	"geor": geor
            }
    inserts = WKT_res
    
    # open RDF header
    rdfStr = "<rdf:RDF";
    
    # handle Namespaces
    for key in namespaces:
        rdfStr += " xmlns:" + key + "='" + namespaces[key] + "'";
    
    rdfStr += ">";
    
    #add inserts
    
    rdfStr += "<rdf:Description rdf:about='my:" + "RootModel" + "'>";
    
    for insert in inserts:
        rdfStr += insert;
    
    rdfStr += "</rdf:Description>"
    
    # close RDF header
    rdfStr += "</rdf:RDF>"
    
    # Weisen Sie Ihre Ausgabe der OUT-Variablen zu.
    return rdfStr

############## Ground Truth Generator ###############
def getGeometry(geo_obj):
    return geo_obj[3]

def getGeoType(geo_obj):
    return geo_obj[2]
    
def getGeoName(geo_obj):
    return geo_obj[1]
    
def ground_truth_generator(geometry_lst):
    geo_lst = geometry_lst
    inter_geo_dict = {}
    for i in range(0, len(geo_lst)-1):
        geo_obj_1 = geo_lst[i]
        geometry_1 = getGeometry(geo_obj_1)
    
        geo_obj_1_has_intersection = False
        for j in range(1, len(geo_lst)):
            geo_obj_2 = geo_lst[j]
            geometry_2 = getGeometry(geo_obj_2)
            
            if getGeoName(geo_obj_1) != getGeoName(geo_obj_2):
                temp_bool = False
                try:
                    temp_bool = Geometry.DoesIntersect(geometry_1, geometry_2)
                except Exception as err:
                    print(f"Unexpected {err=}, {type(err)=}")
                if temp_bool:
                    geo_obj_1_has_intersection = True
                    inter_geo_dict[getGeoName(geo_obj_2)] = getGeoType(geo_obj_2)
                    
        if geo_obj_1_has_intersection:
            inter_geo_dict[getGeoName(geo_obj_1)] = getGeoType(geo_obj_1)    
    #================= Output ====================
    if inter_geo_dict is None:
        inter_geo_dict = {}
    return inter_geo_dict
    
############## RDF 2 JSON ###############
def rdfParsing2GeoData(str):
    """ it returns the json file in structure like { "POLYGON1" : [...], 
                                                     "POLYGON2" : [...], 
                                                     "MULTIPOLYGON1" : [...], ...
                                                    }
    """
    #dom = parse(path)
    #tree = ET.ElementTree(ET.fromstring(str))
    geo_dict = {}
    tree = io.StringIO(str)
    dom = parse(tree)
    data = dom.documentElement
    rdf_desc_lst = data.getElementsByTagName("rdf:Description")
    # geo_in_wkt = data.getElementsByTagName("geo:asWKT")

    for i in range(1, len(rdf_desc_lst)): # first description element (root element) should be removed.
        descr_el = rdf_desc_lst[i]
        geo_name_num = descr_el.attributes._attrs['rdf:about'].nodeValue.split('#')[1]
        geo_wkt_data = ""
        try:
            geo_wkt_data = descr_el.childNodes[0].firstChild.data
        except:
            geo_wkt_data = descr_el.childNodes[1].firstChild.data
        geo_algebra_lst = []

        if ( geo_name_num.find('POINT') != -1 or
            geo_name_num.find('Point') != -1 ):
            
            wkt_data_lst = geo_wkt_data.split("(")[1] # remove title 'POINT'
            vert_str_lst = wkt_data_lst
            vert_str_lst = vert_str_lst.replace( ")", "" ) # remove character ')'

            pt_algebra_lst = []
            pt_str_lst = vert_str_lst.split(" ")

            pt_algebra_lst = [ float(pt_str) for pt_str in pt_str_lst ]
            geo_algebra_lst.append(pt_algebra_lst)
            
        if ( geo_name_num.find('LINESTRING') != -1 or
            geo_name_num.find('Linestring') != -1 or
            geo_name_num.find('LINE') != -1 or
            geo_name_num.find('Line') != -1 ):

            wkt_data_lst = geo_wkt_data.split("((")[1] # remove title 'LINESTRING'
            vert_str_lst = wkt_data_lst
            vert_str_lst = vert_str_lst.replace( ")", "" ) # remove character ')'
            vert_str_lst = vert_str_lst.split(", ")

            line_algebra_lst = []
            for i in range(0, len(vert_str_lst)):

                pt_str_lst = vert_str_lst[i].split(" ")
                line_algebra_lst.append([ float(pt_str) for pt_str in pt_str_lst ])
            geo_algebra_lst.append(line_algebra_lst)

        if ( geo_name_num.find('POLYGON') != -1 or 
            geo_name_num.find('Polygon') != -1 ):

            wkt_data_lst = geo_wkt_data.split("((")[1] # remove title 'POLYGON Z'
            vert_str_lst = wkt_data_lst
            vert_str_lst = vert_str_lst.replace( ")", "" ) # remove character ')'
            vert_str_lst = vert_str_lst.replace( "(", "" ) # remove character '('
            vert_str_lst = vert_str_lst.split(", ")

            face_algebra_lst = []
            for i in range(0, len(vert_str_lst)-1): # last point not included

                pt_str_lst = vert_str_lst[i].split(" ")
                face_algebra_lst.append([ float(pt_str) for pt_str in pt_str_lst ])
            geo_algebra_lst.append(face_algebra_lst)

        if ( geo_name_num.find('MULTIPOLYGON') != -1 or
            geo_name_num.find('Multipolygon') != -1  or
            geo_name_num.find('CUBE') != -1 or
            geo_name_num.find('Cube') != -1 or
            geo_name_num.find('SPHERE') != -1 or
            geo_name_num.find('Sphere') != -1 ):

            wkt_data_lst = geo_wkt_data.split("(((")[1] # remove title 'MULTIPOLYGON Z'
            face_str_lst = wkt_data_lst.split("), ")

            face_algebra_lst = []
            for face_str in face_str_lst:
                vert_str_lst = face_str.replace( ")", "" ) # remove character ')'
                vert_str_lst = vert_str_lst.replace( "(", "" ) # remove character '('
                vert_str_lst = vert_str_lst.split(", ")

                pt_algebra_lst = []
                for i in range(0, len(vert_str_lst)-1): # last point not included

                    pt_str_lst = vert_str_lst[i].split(" ")
                        
                    pt_algebra = [ float(pt_str) for pt_str in pt_str_lst ]
                    pt_algebra_lst.append(pt_algebra)

                face_algebra_lst.append(pt_algebra_lst)
            geo_algebra_lst = face_algebra_lst

        if geo_name_num not in geo_dict.keys():
            geo_dict[geo_name_num] = geo_algebra_lst
    return geo_dict
    
######################################################
############## RDF File Configuration ###############
rdf_case_study_file_path = "C:\\Users\\yhe\\Documents\\Developer\\Repo\\ExtendingJena\\src\\main\\resources\\rdf\\case_study\\"
rdf_file_contents = ""

############## JSON File Configuration ###############
json_case_study_file_path = "C:\\Users\\yhe\\Documents\\Developer\\Repo\\ExtendingJena\\src\\main\\resources\\JSON\\case_study\\"
json_ground_truth_file_path = "C:\\Users\\yhe\\Documents\\Developer\\Repo\\ExtendingJena\\src\\main\\resources\\JSON\\ground_truth\\"
json_file_contents = {"test":""}

########## JSON Export #############
def JSON_export(json_file_path, json_file_name, json_file_contents):
    
    tmp_json_file_path = json_file_path + json_file_name
    try:
        with open(tmp_json_file_path, "w") as f:
            json.dump(json_file_contents, f, sort_keys=True, indent=4)
            #f.write(json_file_contents)
    except FileExistsError:
        print(f"File '{json_file_path}' already exists.")

########## RDF Export #############
def rdf_export(rdf_file_path, rdf_file_name, rdf_file_contents):

    tmp_rdf_file_path = rdf_file_path + rdf_file_name
    try:
        with open(tmp_rdf_file_path, "w") as f:
            f.write(rdf_file_contents)
    except FileExistsError:
        print(f"File '{rdf_file_path}' already exists.")
        
        
############## Contents (RDF, JSON) Generation ###############
# create geometries randomly
# convert geos to WKT
# wrapp WKT with RDF labels
rdf_contents = RDF_Wrapper(IN[0])
rdf_export(rdf_case_study_file_path, "2nd_CaseStudy_TubeSolid.rdf", rdf_contents)
#====================================
OUT = rdf_contents
# ----------------------------------------
watch_9 = Watch(RDF_Wrapper_2)
RDF_to_JSON_2 = Python(IN[0]=watch_9)  # CPython3; same code as RDF_to_JSON
watch_10 = Watch(RDF_to_JSON_2)
json_export_2 = Python(IN[0]=watch_10)  # CPython3
# ---------- json_export_2.python (484 lines) ----------
# Load the Python Standard and DesignScript Libraries
import sys
import clr
import json
import os
import random
import pickle
import io
import ctypes
import math
import xml.etree.ElementTree as ET
sys.path.append(r"C:\Users\yhe\AppData\Local\Programs\Python\Python310\Lib\site-packages")
from xml.dom.minidom import parse, parseString

clr.AddReference('ProtoGeometry')
from Autodesk.DesignScript.Geometry import *
clr.AddReference('DSCoreNodes')
from DSCore import *
clr.AddReference('GeometryColor')
from Modifiers import GeometryColor
clr.AddReference('MeshToolkit')
from Autodesk.Dynamo.MeshToolkit import *

def Mesh_to_WKT(solid, solid_name):
    #sphere_mesh = Mesh.ByGeometry(solid)
    #mesh_lst = Mesh.Explode(sphere_mesh)
    mesh_lst=solid
    mesh_vert_lst = []
    
    for mesh in mesh_lst:
        mesh_vert_lst.append(Mesh.Vertices(mesh))
        
    geo_data = mesh_vert_lst
    geo_name = "MULTIPOLYGON" + "-" + str(solid_name)
    geo_type = "MULTIPOLYGON_MESH"
    geometry = solid
    geo_obj_solid = (geo_data, geo_name, geo_type, geometry)

    return geo_obj_solid

#################### WKT Converter #############################
def sphere2WKT(surface_lst, exampleInstanceNamespace, geoSparqlNamespace, name):
    wktLiteral = "<sf:MultiPolygon>";
    wktLiteral += "<rdf:Description rdf:about='" + exampleInstanceNamespace + str(name) + "'>";
    wktLiteral += "<geo:asWKT rdf:datatype='" + geoSparqlNamespace + "wktLiteral'>";
    
    # for curves/surfaces
    face_wkt_lst = ""
    for vert_lst in surface_lst:
        
        vert_wkt_lst = "(("
        for vert in vert_lst:
        
            vert_wkt_lst += str(vert.X) + " " +  str(vert.Y) + " " +  str(vert.Z);
            if vert != vert_lst[-1]:
                vert_wkt_lst += ", "
        
        vert_wkt_lst += ", " + str(vert_lst[0].X) + " " +  str(vert_lst[0].Y) + " " +  str(vert_lst[0].Z) + "))";
        
        face_wkt_lst += vert_wkt_lst
        if vert_lst != surface_lst[-1]:
            face_wkt_lst += ", "          
            
    wktLiteral += "MULTIPOLYGON Z(";
    wktLiteral += face_wkt_lst
    wktLiteral += ")"
    wktLiteral += "</geo:asWKT>";
    wktLiteral += "</rdf:Description>";
    wktLiteral += "</sf:MultiPolygon>";
    return wktLiteral

def mesh2WKT(surface_lst, exampleInstanceNamespace, geoSparqlNamespace, name):
    wktLiteral = "<sf:MultiPolygon>";
    wktLiteral += "<rdf:Description rdf:about='" + exampleInstanceNamespace + str(name) + "'>";
    wktLiteral += "<geo:asWKT rdf:datatype='" + geoSparqlNamespace + "wktLiteral'>";
    
    # for curves/surfaces
    face_wkt_lst = ""
    for vert_lst in surface_lst:
        
        vert_wkt_lst = "(("
        for vert in vert_lst:
        
            vert_wkt_lst += str(vert.X) + " " +  str(vert.Y) + " " +  str(vert.Z);
            if vert != vert_lst[-1]:
                vert_wkt_lst += ", "
        
        vert_wkt_lst += ", " + str(vert_lst[0].X) + " " +  str(vert_lst[0].Y) + " " +  str(vert_lst[0].Z) + "))";
        
        face_wkt_lst += vert_wkt_lst
        if vert_lst != surface_lst[-1]:
            face_wkt_lst += ", "          
            
    wktLiteral += "MULTIPOLYGON Z(";
    wktLiteral += face_wkt_lst
    wktLiteral += ")"
    wktLiteral += "</geo:asWKT>";
    wktLiteral += "</rdf:Description>";
    wktLiteral += "</sf:MultiPolygon>";
    return wktLiteral
    
def multipolygonInRotation2WKT(face_lst, exampleInstanceNamespace, geoSparqlNamespace, name):
    wktLiteral = "<sf:MultiPolygon>";
    wktLiteral += "<rdf:Description rdf:about='" + exampleInstanceNamespace + str(name) + "'>";
    wktLiteral += "<geo:asWKT rdf:datatype='" + geoSparqlNamespace + "wktLiteral'>";
    face_wkt_lst = ""
    
    for face in face_lst:
        
        vertice_lst = face.Vertices
        org_vert_pt = vertice_lst[0].PointGeometry 
        face_wkt = "((" + str(org_vert_pt.X) + " " +  str(org_vert_pt.Y) + " " +  str(org_vert_pt.Z) # start point
    
        for i in range(1, len(vertice_lst)):
            vert_pt = vertice_lst[i].PointGeometry
            face_wkt += ", " + str(vert_pt.X) + " " +  str(vert_pt.Y) + " " +  str(vert_pt.Z)       
        face_wkt += ", " + str(org_vert_pt.X) + " " +  str(org_vert_pt.Y) + " " +  str(org_vert_pt.Z) + "))" # end point
        
        if(face != face_lst[-1]):
            face_wkt += ", "
        face_wkt_lst += face_wkt        
    
    wktLiteral += "MULTIPOLYGON Z("
    wktLiteral += face_wkt_lst
    wktLiteral += ")" 
    wktLiteral += "</geo:asWKT>"
    wktLiteral += "</rdf:Description>"
    wktLiteral += "</sf:MultiPolygon>"
    return wktLiteral
    
    
def multipolygon2WKT(geo_data, exampleInstanceNamespace, geoSparqlNamespace, name):
    wktLiteral = "<sf:MultiPolygon>";
    wktLiteral += "<rdf:Description rdf:about='" + exampleInstanceNamespace + str(name) + "'>";
    wktLiteral += "<geo:asWKT rdf:datatype='" + geoSparqlNamespace + "wktLiteral'>";
    
    # for cuboids with geometry = [centroid, length]
    centroid = Solid.Centroid(geo_data)
    offset = geo_data.Length/2
    c_X = centroid.X
    c_Y = centroid.Y
    c_Z = centroid.Z

    # idea: determine the coordinates of bottom- and top faces
    
    # p1 -- p2
    # |  c   |
    # p3 -- p4           
    # bottom-face
    bottom_p1 = str(c_X-offset) + " " + str(c_Y-offset) + " " + str(c_Z-offset)
    bottom_p2 = str(c_X-offset) + " " + str(c_Y+offset) + " " + str(c_Z-offset) 
    bottom_p3 = str(c_X+offset) + " " + str(c_Y+offset) + " " + str(c_Z-offset)
    bottom_p4 = str(c_X+offset) + " " + str(c_Y-offset) + " " + str(c_Z-offset)
    bottom_face = "((" + bottom_p1 + ", " + bottom_p2 + ", " + bottom_p3 + ", " + bottom_p4 +  ", " + bottom_p1 + "))"
    # top-face
    top_p1 = str(c_X-offset) + " " + str(c_Y-offset) + " " + str(c_Z+offset)
    top_p2 = str(c_X-offset) + " " + str(c_Y+offset) + " " + str(c_Z+offset) 
    top_p3 = str(c_X+offset) + " " + str(c_Y+offset) + " " + str(c_Z+offset)
    top_p4 = str(c_X+offset) + " " + str(c_Y-offset) + " " + str(c_Z+offset)
    top_face = "((" + top_p1 + ", " + top_p2 + ", " + top_p3 + ", " + top_p4 +  ", " + top_p1 + "))"
    # front-face
    front_p1 = str(c_X-offset) + " " + str(c_Y-offset) + " " + str(c_Z-offset)
    front_p2 = str(c_X-offset) + " " + str(c_Y+offset) + " " + str(c_Z-offset) 
    front_p3 = str(c_X-offset) + " " + str(c_Y+offset) + " " + str(c_Z+offset) 
    front_p4 = str(c_X-offset) + " " + str(c_Y-offset) + " " + str(c_Z+offset)
    front_face = "((" + front_p1 + ", " + front_p2 + ", " + front_p3 + ", " + front_p4 + ", " + front_p1 + "))"
    # back-face             
    back_p1 = str(c_X+offset) + " " + str(c_Y-offset) + " " + str(c_Z-offset)
    back_p2 = str(c_X+offset) + " " + str(c_Y+offset) + " " + str(c_Z-offset) 
    back_p3 = str(c_X+offset) + " " + str(c_Y+offset) + " " + str(c_Z+offset) 
    back_p4 = str(c_X+offset) + " " + str(c_Y-offset) + " " + str(c_Z+offset)
    back_face = "((" + back_p1 + ", " + back_p2 + ", " + back_p3 + ", " + back_p4 + ", " + back_p1 + "))"
    # left-face
    left_p1 = str(c_X-offset) + " " + str(c_Y-offset) + " " + str(c_Z-offset)
    left_p2 = str(c_X+offset) + " " + str(c_Y-offset) + " " + str(c_Z-offset)
    left_p3 = str(c_X+offset) + " " + str(c_Y-offset) + " " + str(c_Z+offset)
    left_p4 = str(c_X-offset) + " " + str(c_Y-offset) + " " + str(c_Z+offset)
    left_face = "((" + left_p1 + ", " + left_p2 + ", " + left_p3 + ", " + left_p4 + ", " + left_p1 + "))"            
    # right-face
    right_p1 = str(c_X-offset) + " " + str(c_Y+offset) + " " + str(c_Z-offset)
    right_p2 = str(c_X+offset) + " " + str(c_Y+offset) + " " + str(c_Z-offset)
    right_p3 = str(c_X+offset) + " " + str(c_Y+offset) + " " + str(c_Z+offset)
    right_p4 = str(c_X-offset) + " " + str(c_Y+offset) + " " + str(c_Z+offset)
    right_face = "((" + right_p1 + ", " + right_p2 + ", " + right_p3 + ", " + right_p4 + ", " + right_p1 + "))"
    
    cuboid_face = bottom_face + ", " + top_face + ", " + front_face + ", " + back_face + ", " + left_face + ", " + right_face
    
    wktLiteral += "MULTIPOLYGON Z("
    try:
        wktLiteral += cuboid_face
    except e:
        return e
    print(cuboid_face)
    wktLiteral += ")"
    wktLiteral += "</geo:asWKT>"
    wktLiteral += "</rdf:Description>"
    wktLiteral += "</sf:MultiPolygon>"
    return wktLiteral
    
    
def polygon2WKT(geo_data, exampleInstanceNamespace, geoSparqlNamespace, name):
    wktLiteral = "<sf:POLYGON>";
    wktLiteral += "<rdf:Description rdf:about='" + exampleInstanceNamespace + str(name) + "'>";
    wktLiteral += "<geo:asWKT rdf:datatype='" + geoSparqlNamespace + "wktLiteral'>";
    wktLiteral += "POLYGON Z((";
    
    points =  geo_data
    originP = points[0];
    
    wktLiteral += str(originP.X) + " " +  str(originP.Y) + " " +  str(originP.Z) # start point
    for i in range(1, len(points)):
        wktLiteral += ", " + str(points[i].X) + " " +  str(points[i].Y) + " " +  str(points[i].Z);       
    wktLiteral += ", " + str(originP.X) + " " +  str(originP.Y) + " " +  str(originP.Z); # end point
    wktLiteral += "))"
    
    wktLiteral += "</geo:asWKT>";
    wktLiteral += "</rdf:Description>";
    wktLiteral += "</sf:POLYGON>";
    return wktLiteral

#####
def wkt_Converter(geo_obj):
# The inputs to this node will be stored as a list in the IN variables.
    geoSparqlNamespace = "http://www.opengis.net/ont/geosparql#"
    exampleInstanceNamespace = "https://www.inf.bi.ruhr-uni-bochum.de/jena/#"
    
    res = []
    geo_data = geo_obj[0];
    name = geo_obj[1];
    geometryType = geo_obj[2];
    
    if(geometryType.upper() == "MULTIPOLYGON_ROTATION"):
        res.append(multipolygonInRotation2WKT(geo_data, exampleInstanceNamespace, geoSparqlNamespace, name))
    
    if(geometryType.upper() == "MULTIPOLYGON_SPHERE"):
        res.append(sphere2WKT(geo_data, exampleInstanceNamespace, geoSparqlNamespace, name))    
        
    if(geometryType.upper() == "MULTIPOLYGON_MESH"):
        res.append(mesh2WKT(geo_data, exampleInstanceNamespace, geoSparqlNamespace, name))    
     
    if(geometryType.upper() == "MULTIPOLYGON"):
        res.append(multipolygon2WKT(geo_data, exampleInstanceNamespace, geoSparqlNamespace, name))
        
    if(geometryType.upper() == "POLYGON_ROTATION"):
        res.append(polygon2WKT(geo_data, exampleInstanceNamespace, geoSparqlNamespace, name))
        
    if(geometryType.upper() == "POLYGON"):
        res.append(polygon2WKT(geo_data, exampleInstanceNamespace, geoSparqlNamespace, name))
        
    if(geometryType.upper() == "LINESTRING"):
        res.append(lineString2WKT(geo_data, exampleInstanceNamespace, geoSparqlNamespace, name))
    return res

############## RDF Wrapper ###############
def RDF_Wrapper(WKT_res):
    rdf="http://www.w3.org/1999/02/22-rdf-syntax-ns#";
    owl="http://www.w3.org/2002/07/owl#";
    ogc="http://www.opengis.net/";
    my="https://www.inf.bi.ruhr-uni-bochum.de/jena/#";
    gml="http://www.opengis.net/ont/gml#";
    geo="http://www.opengis.net/ont/geosparql#";
    geof="http://www.opengis.net/def/function/geosparql/";
    rdfs="http://www.w3.org/2000/01/rdf-schema#";
    uom="http://www.opengis.net/def/uom/OGC/1.0/";
    sf="http://www.opengis.net/ont/sf#";
    xsd="http://www.w3.org/2001/XMLSchema#";
    geor="http://www.opengis.net/def/rule/geosparql/";
    namespaces = {	"rdf" : rdf,
                	"owl" : owl,
                	"ogc" : ogc,
                	"my" : my,
                	"gml" : gml,
                	"geo" : geo,
                	"geof": geof,
                	"rdfs": rdfs,
                	"uom": uom,
                	"sf": sf,
                	"xsd": xsd,
                	"geor": geor
            }
    inserts = WKT_res
    
    # open RDF header
    rdfStr = "<rdf:RDF";
    
    # handle Namespaces
    for key in namespaces:
        rdfStr += " xmlns:" + key + "='" + namespaces[key] + "'";
    
    rdfStr += ">";
    
    #add inserts
    
    rdfStr += "<rdf:Description rdf:about='my:" + "RootModel" + "'>";
    
    for insert in inserts:
        rdfStr += insert;
    
    rdfStr += "</rdf:Description>"
    
    # close RDF header
    rdfStr += "</rdf:RDF>"
    
    # Weisen Sie Ihre Ausgabe der OUT-Variablen zu.
    return rdfStr

############## Ground Truth Generator ###############
def getGeometry(geo_obj):
    return geo_obj[3]

def getGeoType(geo_obj):
    return geo_obj[2]
    
def getGeoName(geo_obj):
    return geo_obj[1]
    
def ground_truth_generator(geometry_lst):
    geo_lst = geometry_lst
    inter_geo_dict = {}
    for i in range(0, len(geo_lst)-1):
        geo_obj_1 = geo_lst[i]
        geometry_1 = getGeometry(geo_obj_1)
    
        geo_obj_1_has_intersection = False
        for j in range(1, len(geo_lst)):
            geo_obj_2 = geo_lst[j]
            geometry_2 = getGeometry(geo_obj_2)
            
            if getGeoName(geo_obj_1) != getGeoName(geo_obj_2):
                temp_bool = False
                try:
                    temp_bool = Geometry.DoesIntersect(geometry_1, geometry_2)
                except Exception as err:
                    print(f"Unexpected {err=}, {type(err)=}")
                if temp_bool:
                    geo_obj_1_has_intersection = True
                    inter_geo_dict[getGeoName(geo_obj_2)] = getGeoType(geo_obj_2)
                    
        if geo_obj_1_has_intersection:
            inter_geo_dict[getGeoName(geo_obj_1)] = getGeoType(geo_obj_1)    
    #================= Output ====================
    if inter_geo_dict is None:
        inter_geo_dict = {}
    return inter_geo_dict
    
############## RDF 2 JSON ###############
def rdfParsing2GeoData(str):
    """ it returns the json file in structure like { "POLYGON1" : [...], 
                                                     "POLYGON2" : [...], 
                                                     "MULTIPOLYGON1" : [...], ...
                                                    }
    """
    #dom = parse(path)
    #tree = ET.ElementTree(ET.fromstring(str))
    geo_dict = {}
    tree = io.StringIO(str)
    dom = parse(tree)
    data = dom.documentElement
    rdf_desc_lst = data.getElementsByTagName("rdf:Description")
    # geo_in_wkt = data.getElementsByTagName("geo:asWKT")

    for i in range(1, len(rdf_desc_lst)): # first description element (root element) should be removed.
        descr_el = rdf_desc_lst[i]
        geo_name_num = descr_el.attributes._attrs['rdf:about'].nodeValue.split('#')[1]
        geo_wkt_data = ""
        try:
            geo_wkt_data = descr_el.childNodes[0].firstChild.data
        except:
            geo_wkt_data = descr_el.childNodes[1].firstChild.data
        geo_algebra_lst = []

        if ( geo_name_num.find('POINT') != -1 or
            geo_name_num.find('Point') != -1 ):
            
            wkt_data_lst = geo_wkt_data.split("(")[1] # remove title 'POINT'
            vert_str_lst = wkt_data_lst
            vert_str_lst = vert_str_lst.replace( ")", "" ) # remove character ')'

            pt_algebra_lst = []
            pt_str_lst = vert_str_lst.split(" ")

            pt_algebra_lst = [ float(pt_str) for pt_str in pt_str_lst ]
            geo_algebra_lst.append(pt_algebra_lst)
            
        if ( geo_name_num.find('LINESTRING') != -1 or
            geo_name_num.find('Linestring') != -1 or
            geo_name_num.find('LINE') != -1 or
            geo_name_num.find('Line') != -1 ):

            wkt_data_lst = geo_wkt_data.split("((")[1] # remove title 'LINESTRING'
            vert_str_lst = wkt_data_lst
            vert_str_lst = vert_str_lst.replace( ")", "" ) # remove character ')'
            vert_str_lst = vert_str_lst.split(", ")

            line_algebra_lst = []
            for i in range(0, len(vert_str_lst)):

                pt_str_lst = vert_str_lst[i].split(" ")
                line_algebra_lst.append([ float(pt_str) for pt_str in pt_str_lst ])
            geo_algebra_lst.append(line_algebra_lst)

        if ( geo_name_num.find('POLYGON') != -1 or 
            geo_name_num.find('Polygon') != -1 ):

            wkt_data_lst = geo_wkt_data.split("((")[1] # remove title 'POLYGON Z'
            vert_str_lst = wkt_data_lst
            vert_str_lst = vert_str_lst.replace( ")", "" ) # remove character ')'
            vert_str_lst = vert_str_lst.replace( "(", "" ) # remove character '('
            vert_str_lst = vert_str_lst.split(", ")

            face_algebra_lst = []
            for i in range(0, len(vert_str_lst)-1): # last point not included

                pt_str_lst = vert_str_lst[i].split(" ")
                face_algebra_lst.append([ float(pt_str) for pt_str in pt_str_lst ])
            geo_algebra_lst.append(face_algebra_lst)

        if ( geo_name_num.find('MULTIPOLYGON') != -1 or
            geo_name_num.find('Multipolygon') != -1  or
            geo_name_num.find('CUBE') != -1 or
            geo_name_num.find('Cube') != -1 or
            geo_name_num.find('SPHERE') != -1 or
            geo_name_num.find('Sphere') != -1 ):

            wkt_data_lst = geo_wkt_data.split("(((")[1] # remove title 'MULTIPOLYGON Z'
            face_str_lst = wkt_data_lst.split("), ")

            face_algebra_lst = []
            for face_str in face_str_lst:
                vert_str_lst = face_str.replace( ")", "" ) # remove character ')'
                vert_str_lst = vert_str_lst.replace( "(", "" ) # remove character '('
                vert_str_lst = vert_str_lst.split(", ")

                pt_algebra_lst = []
                for i in range(0, len(vert_str_lst)-1): # last point not included

                    pt_str_lst = vert_str_lst[i].split(" ")
                        
                    pt_algebra = [ float(pt_str) for pt_str in pt_str_lst ]
                    pt_algebra_lst.append(pt_algebra)

                face_algebra_lst.append(pt_algebra_lst)
            geo_algebra_lst = face_algebra_lst

        if geo_name_num not in geo_dict.keys():
            geo_dict[geo_name_num] = geo_algebra_lst
    return geo_dict
    
######################################################
############## RDF File Configuration ###############
rdf_case_study_file_path = "C:\\Users\\yhe\\Documents\\Developer\\Repo\\ExtendingJena\\src\\main\\resources\\rdf\\case_study\\"
rdf_file_contents = ""

############## JSON File Configuration ###############
json_case_study_file_path = "C:\\Users\\yhe\\Documents\\Developer\\Repo\\ExtendingJena\\src\\main\\resources\\JSON\\case_study\\"
json_ground_truth_file_path = "C:\\Users\\yhe\\Documents\\Developer\\Repo\\ExtendingJena\\src\\main\\resources\\JSON\\ground_truth\\"
json_file_contents = {"test":""}

########## JSON Export #############
def JSON_export(json_file_path, json_file_name, json_file_contents):
    
    tmp_json_file_path = json_file_path + json_file_name
    try:
        with open(tmp_json_file_path, "w") as f:
            json.dump(json_file_contents, f, sort_keys=True, indent=4)
            #f.write(json_file_contents)
    except FileExistsError:
        print(f"File '{json_file_path}' already exists.")

########## RDF Export #############
def rdf_export(rdf_file_path, rdf_file_name, rdf_file_contents):

    tmp_rdf_file_path = rdf_file_path + rdf_file_name
    try:
        with open(tmp_rdf_file_path, "w") as f:
            f.write(rdf_file_contents)
    except FileExistsError:
        print(f"File '{rdf_file_path}' already exists.")
        
        
############## Contents (RDF, JSON) Generation ###############
JSON_export(json_case_study_file_path, "2nd_CaseStudy_TubeSolid.json", IN[0])
#====================================
OUT = 0
# ----------------------------------------
