# Dynamo graph [Methodology][Sample_data_gen] cylinder.dyn (Dynamo 2.8.0.2471)

code_block = CodeBlock()
# ---------- code_block.designscript (6 lines) ----------
cylinder_1_st_pt=Point.ByCoordinates(0,0,0);
cylinder_1_ed_pt=Point.ByCoordinates(0,0,5);
cylinder_2_st_pt=Point.ByCoordinates(9,0,0);
cylinder_2_ed_pt=Point.ByCoordinates(9,0,5);
cylinder_1_radius=2;
cylinder_2_radius=4;
# ----------------------------------------
byPointsRadius = Cylinder.ByPointsRadius(startPoint=code_block.cylinder_1_st_pt, endPoint=code_block.cylinder_1_ed_pt, radius=code_block.cylinder_1_radius)
byPointsRadius_2 = Cylinder.ByPointsRadius(startPoint=code_block.cylinder_2_st_pt, endPoint=code_block.cylinder_2_ed_pt, radius=code_block.cylinder_2_radius)
code_block_2 = CodeBlock()
# ---------- code_block_2.designscript (6 lines) ----------
cylinder_1_st_pt=Point.ByCoordinates(0,12,0);
cylinder_1_ed_pt=Point.ByCoordinates(0,12,5);
cylinder_2_st_pt=Point.ByCoordinates(0,12,0);
cylinder_2_ed_pt=Point.ByCoordinates(0,12,5);
cylinder_1_radius=2;
cylinder_2_radius=4;
# ----------------------------------------
byPointsRadius_3 = Cylinder.ByPointsRadius(startPoint=code_block_2.cylinder_2_st_pt, endPoint=code_block_2.cylinder_2_ed_pt, radius=code_block_2.cylinder_2_radius)
byPointsRadius_4 = Cylinder.ByPointsRadius(startPoint=code_block_2.cylinder_1_st_pt, endPoint=code_block_2.cylinder_1_ed_pt, radius=code_block_2.cylinder_1_radius)
difference = Solid.Difference(solid=byPointsRadius_3, other=byPointsRadius_4)
watch_3d = Watch3D(difference)
