# Dynamo graph [Methodology][Sample_data_gen]basic_geometry.dyn (Dynamo 2.8.0.2471)

code_block = CodeBlock()
# ---------- code_block.designscript (5 lines) ----------
line_st_pt=Point.ByCoordinates(1,1,0);
line_mid_pt=Point.ByCoordinates(1,3,2);
line_ed_pt=Point.ByCoordinates(1,5,5);
line_pt_lst=[line_st_pt, line_mid_pt, line_ed_pt];
false;
# ----------------------------------------
byPoints = PolyCurve.ByPoints(points=code_block.line_pt_lst, connectLastToFirst=code_block.out4)
code_block_2 = CodeBlock { lo_pt=Point.ByCoordinates(5,0,0); hi_pt=Point.ByCoordinates(8,3,3); }
byCorners = Cuboid.ByCorners(lowPoint=code_block_2.lo_pt, highPoint=code_block_2.hi_pt)
code_block_3 = CodeBlock()
# ---------- code_block_3.designscript (4 lines) ----------
pt_1=Point.ByCoordinates(-5,0,0);
pt_2=Point.ByCoordinates(-8,3,0);
pt_3=Point.ByCoordinates(-12,3,3);
pt_lst=[pt_1,pt_2,pt_3];
# ----------------------------------------
byPerimeterPoints = Surface.ByPerimeterPoints(points=code_block_3.pt_lst)
join = List.Join(list0=byPoints, list1=byCorners, list2=byPerimeterPoints)
