# Dynamo graph Dynamo_GeometryOntology.dyn "lines" (Dynamo 2.8.0.2471)

number_slider = DoubleSlider(14.1, range=0..100 step 0.1)
number_slider_2 = DoubleSlider(7.5, range=0..100 step 0.1)
number_slider_3 = DoubleSlider(7.5, range=0..100 step 0.1)
byCoordinates = Point.ByCoordinates(x=number_slider, y=number_slider_2, z=number_slider_3)
byCoordinates_2 = Point.ByCoordinates(x=number_slider_2, y=number_slider, z=number_slider_3)

# group: A
byStartPointEndPoint = Line.ByStartPointEndPoint(startPoint=byCoordinates, endPoint=byCoordinates_2)

startPoint = Curve.StartPoint(curve=byStartPointEndPoint)
watch = Watch(startPoint)
endPoint = Curve.EndPoint(curve=byStartPointEndPoint)
watch_2 = Watch(endPoint)
byCoordinates_3 = Point.ByCoordinates(x=number_slider, y=number_slider, z=number_slider_3)
byCoordinates_4 = Point.ByCoordinates(x=number_slider_2, y=number_slider_2, z=number_slider_3)

# group: B
byStartPointEndPoint_2 = Line.ByStartPointEndPoint(startPoint=byCoordinates_3, endPoint=byCoordinates_4)

endPoint_2 = Curve.EndPoint(curve=byStartPointEndPoint_2)
watch_3 = Watch(endPoint_2)
startPoint_2 = Curve.StartPoint(curve=byStartPointEndPoint_2)
watch_4 = Watch(startPoint_2)
number_slider_4 = DoubleSlider(14.1, range=0..100 step 0.1)
number_slider_5 = DoubleSlider(8.8, range=0..100 step 0.1)
byCoordinates_5 = Point.ByCoordinates(y=number_slider_4, z=number_slider_5)
number_slider_6 = DoubleSlider(7.5, range=0..100 step 0.1)
number_slider_7 = DoubleSlider(3.6, range=0..100 step 0.1)
byCoordinates_6 = Point.ByCoordinates(x=number_slider_6, z=number_slider_7)

# group: C
byStartPointEndPoint_3 = Line.ByStartPointEndPoint(startPoint=byCoordinates_5, endPoint=byCoordinates_6)

endPoint_3 = Curve.EndPoint(curve=byStartPointEndPoint_3)
watch_5 = Watch(endPoint_3)
startPoint_3 = Curve.StartPoint(curve=byStartPointEndPoint_3)
watch_6 = Watch(startPoint_3)
number_slider_8 = DoubleSlider(14.1, range=0..100 step 0.1)
number_slider_9 = DoubleSlider(8.8, range=0..100 step 0.1)
byCoordinates_7 = Point.ByCoordinates(x=number_slider_8, z=number_slider_9)
number_slider_10 = DoubleSlider(7.5, range=0..100 step 0.1)
number_slider_11 = DoubleSlider(3.6, range=0..100 step 0.1)
byCoordinates_8 = Point.ByCoordinates(y=number_slider_10, z=number_slider_11)

# group: D
byStartPointEndPoint_4 = Line.ByStartPointEndPoint(startPoint=byCoordinates_7, endPoint=byCoordinates_8)

endPoint_4 = Curve.EndPoint(curve=byStartPointEndPoint_4)
watch_7 = Watch(endPoint_4)
startPoint_4 = Curve.StartPoint(curve=byStartPointEndPoint_4)
watch_8 = Watch(startPoint_4)
number_slider_12 = DoubleSlider(12.6, range=0..100 step 0.1)
number_slider_13 = DoubleSlider(10, range=0..100 step 0.1)
byCoordinates_9 = Point.ByCoordinates(x=number_slider_12, z=number_slider_13)
number_slider_14 = DoubleSlider(4.7, range=0..100 step 0.1)
number_slider_15 = DoubleSlider(4.9, range=0..100 step 0.1)
byCoordinates_10 = Point.ByCoordinates(y=number_slider_14, z=number_slider_15)

# group: E
byStartPointEndPoint_5 = Line.ByStartPointEndPoint(startPoint=byCoordinates_9, endPoint=byCoordinates_10)

endPoint_5 = Curve.EndPoint(curve=byStartPointEndPoint_5)
watch_9 = Watch(endPoint_5)
startPoint_5 = Curve.StartPoint(curve=byStartPointEndPoint_5)
watch_10 = Watch(startPoint_5)
number_slider_16 = DoubleSlider(15.2, range=0..100 step 0.1)
number_slider_17 = DoubleSlider(9.7, range=0..100 step 0.1)
number_slider_18 = DoubleSlider(7.5, range=0..100 step 0.1)
byCoordinates_11 = Point.ByCoordinates(x=number_slider_16, y=number_slider_17, z=number_slider_18)
number_slider_19 = DoubleSlider(8.6, range=0..100 step 0.1)
byCoordinates_12 = Point.ByCoordinates(x=number_slider_19, y=number_slider_17, z=number_slider_18)

# group: F
byStartPointEndPoint_6 = Line.ByStartPointEndPoint(startPoint=byCoordinates_11, endPoint=byCoordinates_12)

endPoint_6 = Curve.EndPoint(curve=byStartPointEndPoint_6)
watch_11 = Watch(endPoint_6)
startPoint_6 = Curve.StartPoint(curve=byStartPointEndPoint_6)
watch_12 = Watch(startPoint_6)
intersect = Geometry.Intersect(geometry=byStartPointEndPoint, other=byStartPointEndPoint_2)
intersect_2 = Geometry.Intersect(geometry=byStartPointEndPoint, other=byStartPointEndPoint_6)
number_slider_20 = DoubleSlider(5, range=0..100 step 0.1)
number_slider_21 = DoubleSlider(4, range=0..100 step 0.1)
number_slider_22 = DoubleSlider(7.4, range=-5..100 step 0.1)
byCoordinates_13 = Point.ByCoordinates(x=number_slider_20, y=number_slider_21, z=number_slider_22)
number_slider_23 = DoubleSlider(4, range=0..100 step 0.1)
number_slider_24 = DoubleSlider(4, range=0..100 step 0.1)
number_slider_25 = DoubleSlider(4, range=0..100 step 0.1)
byCoordinates_14 = Point.ByCoordinates(x=number_slider_23, y=number_slider_24, z=number_slider_25)
number_slider_26 = DoubleSlider(3, range=0..100 step 0.1)
number_slider_27 = DoubleSlider(3, range=0..100 step 0.1)
number_slider_28 = DoubleSlider(3, range=0..100 step 0.1)
byCoordinates_15 = Point.ByCoordinates(x=number_slider_26, y=number_slider_27, z=number_slider_28)
byThreePoints = Plane.ByThreePoints(origin=byCoordinates_13, planePoint=byCoordinates_14, xAxisPoint=byCoordinates_15)
intersect_3 = Geometry.Intersect(geometry=byStartPointEndPoint, other=byThreePoints)
number_slider_29 = DoubleSlider(5, range=0..100 step 0.1)
number_slider_30 = DoubleSlider(4, range=0..100 step 0.1)
number_slider_31 = DoubleSlider(7.4, range=-5..100 step 0.1)
byCoordinates_16 = Point.ByCoordinates(x=number_slider_29, y=number_slider_30, z=number_slider_31)
number_slider_32 = DoubleSlider(4, range=0..100 step 0.1)
number_slider_33 = DoubleSlider(4, range=0..100 step 0.1)
number_slider_34 = DoubleSlider(4, range=0..100 step 0.1)
byCoordinates_17 = Point.ByCoordinates(x=number_slider_32, y=number_slider_33, z=number_slider_34)
number_slider_35 = DoubleSlider(3, range=0..100 step 0.1)
number_slider_36 = DoubleSlider(7.4, range=0..100 step 0.1)
number_slider_37 = DoubleSlider(39.5, range=0..100 step 0.1)
byCoordinates_18 = Point.ByCoordinates(x=number_slider_35, y=number_slider_36, z=number_slider_37)
byThreePoints_2 = Plane.ByThreePoints(origin=byCoordinates_16, planePoint=byCoordinates_17, xAxisPoint=byCoordinates_18)
intersect_4 = Geometry.Intersect(geometry=byThreePoints_2, other=byThreePoints)
code_block = CodeBlock { x1 = 0.5; y1 = 0.5; z1 = 0.5; x2 = 3.5; y2 = 3.5; z2 = 3.5; }
byCoordinates_19 = Point.ByCoordinates(x=code_block.x1, y=code_block.y1, z=code_block.z1)
byCoordinates_20 = Point.ByCoordinates(x=code_block.x2, y=code_block.y2, z=code_block.z2)
byCorners = Cuboid.ByCorners(lowPoint=byCoordinates_19, highPoint=byCoordinates_20)
code_block_2 = CodeBlock { x1 = 0; y1 = 0; z1 = 8; x2 = 4; y2 = 4; z2 = 12; }
byCoordinates_21 = Point.ByCoordinates(x=code_block_2.x1, y=code_block_2.y1, z=code_block_2.z1)
byCoordinates_22 = Point.ByCoordinates(x=code_block_2.x2, y=code_block_2.y2, z=code_block_2.z2)
byCorners_2 = Cuboid.ByCorners(lowPoint=byCoordinates_21, highPoint=byCoordinates_22)
code_block_3 = CodeBlock { x1 = 0; y1 = 0; z1 = 0; x2 = 4; y2 = 4; z2 = 4; }
byCoordinates_23 = Point.ByCoordinates(x=code_block_3.x1, y=code_block_3.y1, z=code_block_3.z1)
byCoordinates_24 = Point.ByCoordinates(x=code_block_3.x2, y=code_block_3.y2, z=code_block_3.z2)
byCorners_3 = Cuboid.ByCorners(lowPoint=byCoordinates_23, highPoint=byCoordinates_24)
code_block_4 = CodeBlock { x1 = 3; y1 = 3; z1 = 3; x2 = 8; y2 = 8; z2 = 8; }
byCoordinates_25 = Point.ByCoordinates(x=code_block_4.x1, y=code_block_4.y1, z=code_block_4.z1)
byCoordinates_26 = Point.ByCoordinates(x=code_block_4.x2, y=code_block_4.y2, z=code_block_4.z2)
byCorners_4 = Cuboid.ByCorners(lowPoint=byCoordinates_25, highPoint=byCoordinates_26)
code_block_5 = CodeBlock { x1 = 6; y1 = 0; z1 = 0; x2 = 11; y2 = 5; z2 = 5; }
byCoordinates_27 = Point.ByCoordinates(x=code_block_5.x1, y=code_block_5.y1, z=code_block_5.z1)
byCoordinates_28 = Point.ByCoordinates(x=code_block_5.x2, y=code_block_5.y2, z=code_block_5.z2)
byCorners_5 = Cuboid.ByCorners(lowPoint=byCoordinates_27, highPoint=byCoordinates_28)
