# Dynamo graph Dynamo_TestingScenario.dyn (Dynamo 2.8.0.2471)

# group: Points
polygonCoordList1 = CodeBlock()
# ---------- polygonCoordList1.designscript (6 lines) ----------
p1 = Point.ByCoordinates(2,-1,0);
p2 = Point.ByCoordinates(2,1,0);
p3 = Point.ByCoordinates(0,1,0);
p4 = Point.ByCoordinates(0,-1,0);
//p5 = Point.ByCoordinates(2,-1,0);
p = [p1,p2,p3,p4];
# ----------------------------------------
polygonCoordList2 = CodeBlock()
# ---------- polygonCoordList2.designscript (6 lines) ----------
p1 = Point.ByCoordinates(4,0,0);
p2 = Point.ByCoordinates(4,4,0);
p3 = Point.ByCoordinates(0,4,0);
p4 = Point.ByCoordinates(0,0,0);
//p5 = Point.ByCoordinates(4,0,0);
p = [p1,p2,p3,p4];
# ----------------------------------------
points = CodeBlock()
# ---------- points.designscript (8 lines) ----------
p1 = Point.ByCoordinates(2.5,3);
p2 = Point.ByCoordinates(5,0);

line1S = Point.ByCoordinates(2.5,0,1);
line1E = Point.ByCoordinates(2.5,6,2);

line2S = Point.ByCoordinates(0,4,1);
line2E = Point.ByCoordinates(4,4,2);
# ----------------------------------------
cubeALPoint = CodeBlock { lp = Point.ByCoordinates(2,2,0); }
cubeAHPoint = CodeBlock { hp = Point.ByCoordinates(4,4,2); }
cubeBLPoint = CodeBlock { lp = Point.ByCoordinates(4,4,0); }
cubeBHPoint = CodeBlock { hp = Point.ByCoordinates(8,8,4); }

# group: Polygons
polygon1 = Surface.ByPerimeterPoints(points=polygonCoordList1.p)
polygon2 = Surface.ByPerimeterPoints(points=polygonCoordList2.p)

# group: Lines
line1 = Line.ByStartPointEndPoint(startPoint=points.line1S, endPoint=points.line1E)
line2 = Line.ByStartPointEndPoint(startPoint=points.line2S, endPoint=points.line2E)

# group: Keys
code_block = CodeBlock { "Points"; "Lines"; "Polygons"; "Cubes"; }
list_create = List.Create(item0=code_block.out0, item1=code_block.out1, item2=code_block.out2)

# group: Cubes
cubeA = Cuboid.ByCorners(lowPoint=cubeALPoint, highPoint=cubeAHPoint)
cubeB = Cuboid.ByCorners(lowPoint=cubeBLPoint, highPoint=cubeBHPoint)

# group: Values
points_list = List.Create(item0=points.p1, item1=points.p2)
line1_list = List.Create(item0=points.line1S, item1=points.line1E)
line2_list = List.Create(item0=points.line2S, item1=points.line2E)
lines_list = List.Create(item0=line1_list, item1=line2_list)
polygon1_list = List.Create(item0=polygonCoordList1.p1, item1=polygonCoordList1.p2, item2=polygonCoordList1.p3, item3=polygonCoordList1.p4)
polygon2_list = List.Create(item0=polygonCoordList2.p1, item1=polygonCoordList2.p2, item2=polygonCoordList2.p3, item3=polygonCoordList2.p4)
polygons_list = List.Create(item0=polygon1_list, item1=polygon2_list)
values_list = List.Create(item0=points_list, item1=lines_list, item2=polygons_list)
cubes_list = List.Create(item0=cubeA, item1=cubeB)

# group: Export as JSON
byKeysValues = DesignScript.Builtin.Dictionary.ByKeysValues(keys=list_create, values=values_list@L2)
stringifyJSON = Data.StringifyJSON()  # unwired: values
file_path = Filename(".\CRS.json")
writeText = FileSystem.WriteText(filePath=file_path)  # unwired: text
