# Dynamo graph Dynamo_Geometry3D.dyn (Dynamo 2.8.0.2471)

points = CodeBlock()
# ---------- points.designscript (7 lines) ----------
10;
lp = Point.ByCoordinates(2,0,0);
hp = Point.ByCoordinates(2,2,2);

sphere_cp = Point.ByCoordinates(2.5,0,0);
5;
 // sphere_radius;
# ----------------------------------------
byCenterPointRadius = Sphere.ByCenterPointRadius(centerPoint=points.sphere_cp, radius=points.out4)
colors = CodeBlock { R = 102; G = 223; B = 142; }
byARGB = Color.ByARGB(r=colors.R, g=colors.G, b=colors.B)
byGeometryColor = Modifiers.GeometryColor.ByGeometryColor(geometry=byCenterPointRadius, color=byARGB)
watch_3d = Watch3D(byGeometryColor)
byLengths = Cuboid.ByLengths(width=points.out0, length=points.out0, height=points.out0)
intersect = Geometry.Intersect(geometry=byLengths, other=byCenterPointRadius)
watch_3d_2 = Watch3D(byLengths)
