# Dynamo graph Dynamo_GeometryTriangles.dyn (Dynamo 2.8.0.2471)

code_block = CodeBlock { p1 = Point.ByCoordinates(2,3,5); p2 = Point.ByCoordinates(4,6,7); p3 = Point.ByCoordinates(5,7,4); p = [p1,p2,p3]; }
byPerimeterPoints = Surface.ByPerimeterPoints(points=code_block.p)
code_block_2 = CodeBlock { p1 = Point.ByCoordinates(1,6,5); p2 = Point.ByCoordinates(6,4,7); p3 = Point.ByCoordinates(7,5,4); p = [p1,p2,p3]; }
byPerimeterPoints_2 = Surface.ByPerimeterPoints(points=code_block_2.p)
intersect = Geometry.Intersect(geometry=byPerimeterPoints, other=byPerimeterPoints_2)
code_block_3 = CodeBlock { p1 = Point.ByCoordinates(11,6,5); p2 = Point.ByCoordinates(16,4,7); p3 = Point.ByCoordinates(17,5,4); p = [p1,p2,p3]; }
byPerimeterPoints_3 = Surface.ByPerimeterPoints(points=code_block_3.p)
code_block_4 = CodeBlock { p1 = Point.ByCoordinates(11,7,5); p2 = Point.ByCoordinates(16,4,7); p3 = Point.ByCoordinates(17,3,4); p = [p1,p2,p3]; }
byPerimeterPoints_4 = Surface.ByPerimeterPoints(points=code_block_4.p)
intersect_2 = Geometry.Intersect(geometry=byPerimeterPoints_3, other=byPerimeterPoints_4)
code_block_5 = CodeBlock { p1 = Point.ByCoordinates(6,1,5); p2 = Point.ByCoordinates(6,7,7); }
byStartPointEndPoint = Line.ByStartPointEndPoint(startPoint=code_block_5.p1, endPoint=code_block_5.p2)
intersect_3 = Geometry.Intersect(geometry=byStartPointEndPoint, other=byPerimeterPoints_2)
